# Grasshopper definition CW section_1.gh (Grasshopper 1.0.7)
# plug-ins: Human

honeybee = Honeybee_Honeybee()  # -> out; plug-in component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
ladybug = Ladybug_Ladybug()  # -> out; plug-in component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
# Glazing to optimize
brep = Brep([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])
deconstruct_brep = DeconstructBrep(Brep=brep)  # -> Faces, Edges, Vertices
number_slider = Slider(0.2, range=0.1..1)
is_planar = IsPlanar(Surface=deconstruct_brep.Faces, Interior=True)  # -> Planar, Plane
# Front and right wall
scale_nu = ScaleNU(Geometry=deconstruct_brep.Faces, Plane=is_planar.Plane, ScaleX=1, ScaleY=number_slider, ScaleZ=1)  # -> Geometry, Transform
# Adiabatic wall
brep_2 = Brep(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)
# Adiabatic floor
brep_3 = Brep(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)
# Roof
brep_4 = Brep(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)
# Wall with fixed glazing
brep_5 = Brep(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)
# Fixed Glazing
brep_6 = Brep([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])
brep_7 = Brep([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])

# ----
# EP Simplified Context
# Surrounding buildings
# + ground plane
brep_8 = Brep([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])

# ----
# Daylight Original Context
# Surrounding buildings
# + ground plane
brep_9 = Brep([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])

area = Area(Geometry=scale_nu.Geometry)  # -> Area, Centroid
createhbsrfs = Honeybee_createHBSrfs(geometry=brep_3, srfName="Floor", EPBC="Adiabatic")  # -> out, simplify(HBSurface); plug-in component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
createhbsrfs_2 = Honeybee_createHBSrfs(geometry=brep_4, srfName="Roof", EPBC="Outdoors")  # -> out, simplify(HBSurface); plug-in component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
createhbsrfs_3 = Honeybee_createHBSrfs(geometry=brep_5, srfName="Wall_L")  # -> out, simplify(HBSurface); plug-in component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
createhbsrfs_4 = Honeybee_createHBSrfs(geometry=brep_7, srfName="Wall_FR")  # -> out, simplify(HBSurface); plug-in component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
createhbsrfs_5 = Honeybee_createHBSrfs(geometry=brep_2, srfName="Adiabatic wall", EPBC="Adiabatic")  # -> out, simplify(HBSurface); plug-in component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
move = Move(Geometry=scale_nu.Geometry, Motion="{0,0,0.01}")  # -> Geometry, Transform
move_2 = Move(Geometry=brep_6, Motion="{0,0,0.01}")  # -> Geometry, Transform
mass_addition = MassAddition(Input=flatten(area.Area))  # -> Result, PartialResults
# area 100%
number = Number(372.38644)
ghpython_script = GhPythonScript(x=mass_addition.Result, y=number)  # -> out, a
# ---------- ghpython_script: Python ----------
__author__ = "BT"
__version__ = "2020.03.06"

import rhinoscriptsyntax as rs
a=x/y*100
# ---------- end ghpython_script ----------
panel = Panel(ghpython_script.a)
# Daylight BREP
createhbzones = Honeybee_createHBZones(
    name="Daylight",
    HBSurfaces=flatten([createhbsrfs.HBSurface, createhbsrfs_2.HBSurface, createhbsrfs_5.HBSurface, createhbsrfs_3.HBSurface, createhbsrfs_4.HBSurface]),
    isConditioned=True)  # -> out, HBZone; plug-in component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
# Add Fixed Glazing
addhbglz = Honeybee_addHBGlz(HBObj=createhbsrfs_3.HBSurface, childSurfaces=flatten(move_2.Geometry))  # -> HBObjWGLZ; plug-in component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
# Surface with variable glazing
addhbglz_2 = Honeybee_addHBGlz(HBObj=createhbsrfs_4.HBSurface, childSurfaces=flatten(move.Geometry))  # -> HBObjWGLZ; plug-in component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
# Split BREP by floors
split2floors = Honeybee_SplitBuildingMass2Floors(bldgMasses=createhbzones.HBZone, bldgsFlr2FlrHeights=["1@3.55", "2@3.15", "1@3.525"], runIt=Toggle(True))  # -> out, flatten(splitBldgFloors); plug-in component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
# E+ BREP
createhbzones_2 = Honeybee_createHBZones(
    name="Energy_Building",
    HBSurfaces=flatten([createhbsrfs.HBSurface, createhbsrfs_2.HBSurface, createhbsrfs_5.HBSurface, addhbglz, addhbglz_2]),
    isConditioned=True)  # -> out, HBZone; plug-in component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

# ----
# WALL
# ROOF
# WINDOW
callfromepconstrlibrary = Honeybee_CallFromEPConstructionLibrary()  # -> ThermMaterials, EPMaterials, EPWindowMaterials, EPConstructions; plug-in component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
searchepconstruction = Honeybee_SearchEPConstruction(EPConstrList=callfromepconstrlibrary.EPConstructions, standard="2", surfaceType="1", keywords="SEMIHEATED")  # -> EPSelectedConstr; plug-in component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
# EP CONSTRUCTION
searchepconstruction_2 = Honeybee_SearchEPConstruction(EPConstrList=callfromepconstrlibrary.EPConstructions, standard="2", climateZone="8", surfaceType="0", keywords="MASS")  # -> EPSelectedConstr; plug-in component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
searchepconstruction_3 = Honeybee_SearchEPConstruction(
    EPConstrList=callfromepconstrlibrary.EPConstructions,
    standard="2",
    climateZone="8",
    surfaceType="4",
    keywords="NONMETAL")  # -> EPSelectedConstr; plug-in component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
list_item = ListItem(List=searchepconstruction, Index=Slider(4, range=0..10), Wrap=True)
list_item_2 = ListItem(List=searchepconstruction_2, Index=Slider(0, range=0..10), Wrap=True)
setepzonecnstr = Honeybee_SetEPZoneConstruction(
    HBZones=flatten(createhbzones_2.HBZone),
    wallEPConstruction=list_item_2,
    windowEPConstruction=searchepconstruction_3,
    roofEPConstruction=list_item)  # -> simplify(modifiedHBZones); plug-in component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

# ----
# Create HB zones with names
panel_2 = Panel("""Zone 1
Zone 2
Zone 3
Zone 4
Zone 5""")
mass2zone = Honeybee_Masses2Zones(zoneMasses=flatten(split2floors.splitBldgFloors), zoneNames=panel_2, maxRoofAngle=30, createHBZones=Toggle(True))  # -> out, HBZones; plug-in component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
# Add both Fixed Glazing
# and surface with variable glazing
addhbglz_3 = Honeybee_addHBGlz(HBObj=mass2zone.HBZones, childSurfaces=flatten([move_2.Geometry, move.Geometry]))  # -> HBObjWGLZ; plug-in component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
decomposeepconstruction = Honeybee_DecomposeEPConstruction(cnstrName=searchepconstruction_3)  # -> materials, comments, UValue_SI, UValue_IP, RValue_SI, RValue_IP; plug-in component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
honeybee_bldgprograms = Honeybee_bldgPrograms({"Office": 0, "Retail": 1, "MidriseApartment": 2, "PrimarySchool": 3, "SecondarySchool": 4, "SmallHotel": 5, "LargeHotel": 6, "Hospital": 7, "Outpatient": 8, "Warehouse": 9, "SuperMarket": 10, "FullServiceRestaurant": 11, "QuickServiceRestaurant": 12}, selected="Office")
honeybee_zone_attribute_list = Honeybee_ZoneAttributeList({"Name": "name", "Zone Program": "zoneProgram", "Zone Floor Area": "zoneFloorArea", "Zone Volume": "zoneVolume", "Building Program": "bldgProgram", "Is Conditioned": "isConditioned", "HVAC System Type": "HVACSystem", "Occupancy Schedule": "occupancySchedule", "Occupancy Activity Schedule": "occupancyActivitySch", "Heating SetPoint Schedule": "heatingSetPtSchedule"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}, selected="Name")
# HB zones for Daylighting
solveadjc = Honeybee_SolveAdjacencies(HBZones=flatten(addhbglz_3), removeCurrentAdjc=False, findAdjc=Toggle(True))  # -> out, HBZonesWADJ; plug-in component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
decomposeepmaterial = Honeybee_DecomposeEPMaterial(materialName=simplify(decomposeepconstruction.materials))  # -> names, values, comments, UValue_SI, UValue_IP, RValue_SI, RValue_IP; plug-in component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
epwindowmat = Honeybee_EnergyPlusWindowMaterial(name="GlazingBT", U_Value=Slider(2, range=0..10), SHGC=Slider(0.45, range=0..1), VT=Slider(0.25, range=0..1))  # -> EPMaterial; plug-in component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
listzoneprograms = Honeybee_ListZonePrograms(bldgProgram=honeybee_bldgprograms)  # -> OfficeZonePrograms; plug-in component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
panel_3 = Panel([decomposeepmaterial.comments, decomposeepmaterial.values])
decomposeepmaterial_2 = Honeybee_DecomposeEPMaterial(materialName=simplify(epwindowmat))  # -> names, values, comments, UValue_SI, UValue_IP, RValue_SI, RValue_IP; plug-in component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
epconstruction = Honeybee_EnergyPlusConstruction(name="WindowMAterial:SimpleGlazingSystem", layer_1=epwindowmat)  # -> EPConstruction; plug-in component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
boolean_toggle = BooleanToggle(False)
labelzones = Honeybee_LabelZones(HBZones=flatten(solveadjc.HBZonesWADJ), attribute=honeybee_zone_attribute_list, textHeight=Slider(1, range=0..10))  # -> zoneTxtLabels, labelBasePts, brepTxtLabels, zoneWireFrames; plug-in component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
division = Division(A=Slider(5, range=0..10), B=Slider(12, range=0..100))
item_selector = ItemSelector(
    listzoneprograms,
    {"Office::BreakRoom", "Office::Storage", "Office::Vending", "Office::OpenOffice", "Office::ClosedOffice", "Office::Conference", "Office::PrintRoom", "Office::Restroom", "Office::Elec/MechRoom", "Office::IT_Room", "Office::Stair", "Office::Corridor", "Office::Lobby"}, selected="Office::OpenOffice")
decomposeepconstruction_2 = Honeybee_DecomposeEPConstruction(cnstrName=epconstruction)  # -> materials, comments, UValue_SI, UValue_IP, RValue_SI, RValue_IP; plug-in component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
addtoeplibrary = Honeybee_AddToEnergyPlusLibrary(EPObject=epconstruction)  # -> out; plug-in component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
radmaterialsinfo = Honeybee_RadianceMaterialsInfo(RADMaterial="Interior_Wall")  # -> RADMaterialStr; plug-in component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
radmaterialsinfo_2 = Honeybee_RadianceMaterialsInfo(RADMaterial="Context_Material")  # -> RADMaterialStr; plug-in component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
radglassmaterial = Honeybee_RadianceGlassMaterial(materialName="g", RTransmittance="0.8", GTransmittance="0.8", BTransmittance="0.8", refractiveIndex="1.52")  # -> avrgTrans, RADMaterial; plug-in component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
radmaterialsinfo_3 = Honeybee_RadianceMaterialsInfo(RADMaterial="Interior_Floor")  # -> RADMaterialStr; plug-in component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
# RAD MATERIAL
radmaterialsinfo_4 = Honeybee_RadianceMaterialsInfo(RADMaterial="Interior_Ceiling")  # -> RADMaterialStr; plug-in component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
setloadsandschedules = Honeybee_SetLoadsAndSchedules(HBZones=flatten(setepzonecnstr), zonePrograms=item_selector)  # -> currentSchedules, currentLoads, HBZones; plug-in component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
ach2m3_s_m2_calculator = Honeybee_infORventPerAreaCalculator(HBZones=flatten(setloadsandschedules.HBZones), airFlowRate=Slider(0.2, range=0..1), ACHorM3sM2=Toggle(True))  # -> out, infPerAreaFacade, ventPerAreaFloor, allExposed, allFloors; plug-in component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
setepzoneloads = Honeybee_SetEnergyPlusZoneLoads(
    HBZones=setloadsandschedules.HBZones,
    equipmentLoadPerArea=Slider(50, range=0..100),
    infilRatePerArea_Facade=ach2m3_s_m2_calculator.infPerAreaFacade,
    lightingDensityPerArea=Slider(50, range=0..100),
    numOfPeoplePerArea=division,
    ventilationPerArea=Slider(0, range=0..100),
    ventilationPerPerson=Slider(0.01, range=0..0.01))  # -> loads, HBZones; plug-in component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
decomposebytype = Honeybee_DecomposeBasedOnType(HBZone=solveadjc.HBZonesWADJ)  # -> walls, interiorWalls, airWalls, windows, interiorWindows, skylights, roofs, ceilings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; plug-in component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
setradmaterials = Honeybee_SetRadianceMaterials(
    HBObject=solveadjc.HBZonesWADJ,
    wallRADMaterial=radmaterialsinfo,
    windowRADMaterial=radglassmaterial.RADMaterial,
    roofRADMaterial=radmaterialsinfo_2,
    floorRADMaterial=radmaterialsinfo_3,
    ceilingRADMaterial=radmaterialsinfo_4)  # -> simplify(modifiedHBObject); plug-in component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
radmaterialsinfo_5 = Honeybee_RadianceMaterialsInfo(RADMaterial="Context_Material")  # -> RADMaterialStr; plug-in component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
shadowpar = Honeybee_ShadowPar(maximumFigure=Slider(15000, range=0..100000))  # -> shadowPar; plug-in component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
panel_4 = Panel("""hourly
daily
monthly
annual""")
honeybee_zone_attribute_list_2 = Honeybee_ZoneAttributeList({"Name": "name", "Zone Program": "zoneProgram", "Zone Floor Area": "zoneFloorArea", "Zone Volume": "zoneVolume", "Building Program": "bldgProgram", "Is Conditioned": "isConditioned", "HVAC System Type": "HVACSystem", "Occupancy Schedule": "occupancySchedule", "Occupancy Activity Schedule": "occupancyActivitySch", "Heating SetPoint Schedule": "heatingSetPtSchedule"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}, selected="Name")
boolean_toggle_2 = BooleanToggle(True)
panel_5 = Panel(setepzoneloads.loads)
item_selector_2 = ItemSelector(panel_4, {"hourly", "daily", "monthly", "annual"}, selected="annual")
brep_10 = Brep([decomposebytype.ceilings, decomposebytype.roofs])
hb_epcontextsrf = HoneybeeEPContextSurfaces(shdSurfaces=flatten(brep_8), RADMaterial=radmaterialsinfo_5)  # -> HBContext; inputs shdSurfaces: list of Brep, justBoundingBox: Boolean
# ---------- hb_epcontextsrf: Python ----------
"""
prepare shading/context geometries

    Args:
        northVectorOrRotation: A vector that shows North or a number that shows
                               the rotation of the North from the Y axis
        bldgMasses: List of closed Breps as thermal zones.
    Returns:
        report: ...
        thermalZones: Thermal zone's geometries for visualiza
"""

ghenv.Component.Name = 'Honeybee EP context Surfaces'
ghenv.Component.NickName = 'HB_EPContextSrf'
ghenv.Component.Message = 'VER 0.0.65\nJAN_01_2020'
ghenv.Component.IconDisplayMode = ghenv.Component.IconDisplayMode.application
ghenv.Component.Category = "Honeybee"
ghenv.Component.SubCategory = "10 | Energy | Energy"
#compatibleHBVersion = VER 0.0.57\nNOV_04_2016
#compatibleLBVersion = VER 0.0.59\nFEB_01_2015
ghenv.Component.AdditionalHelpFromDocStrings = "2"

import rhinoscriptsyntax as rs
import Rhino as rc
import scriptcontext as sc
import os
import System
import Grasshopper.Kernel as gh
import uuid

tolerance = sc.doc.ModelAbsoluteTolerance
import math


def main(shdSurfaces, EPTransSchedule, meshingSettings, justBoundingBox):
    
    # import the classes
    if sc.sticky.has_key('honeybee_release'):

        try:
            if not sc.sticky['honeybee_release'].isCompatible(ghenv.Component): return -1
            if sc.sticky['honeybee_release'].isInputMissing(ghenv.Component): return -1
        except:
            warning = "You need a newer version of Honeybee to use this compoent." + \
            " Use updateHoneybee component to update userObjects.\n" + \
            "If you have already updated userObjects drag Honeybee_Honeybee component " + \
            "into canvas and try again."
            w = gh.GH_RuntimeMessageLevel.Warning
            ghenv.Component.AddRuntimeMessage(w, warning)
            return -1
        
        # don't customize this part
        hb_EPSrf = sc.sticky["honeybee_EPSurface"]
        hb_EPSHDSurface = sc.sticky["honeybee_EPShdSurface"]
        hb_RADMaterialAUX = sc.sticky["honeybee_RADMaterialAUX"]
        hb_EPObjectsAux = sc.sticky["honeybee_EPObjectsAUX"]()
        HBScheduleList = sc.sticky["honeybee_ScheduleLib"].keys()

        ########################################################################
        #----------------------------------------------------------------------#
        shdBreps = []
        # create bounding box of shading geometries
        if justBoundingBox:
            for brep in shdSurfaces:
                if brep.Faces.Count>1 or not brep.Faces[0].IsPlanar(sc.doc.ModelAbsoluteTolerance):
                    shdBreps.append(brep.GetBoundingBox(True).ToBrep())
                else:
                    shdBreps.append(brep)
        else:
            shdBreps = shdSurfaces
        
        shadingClasses = []
        shadingMeshPreview = []
        
        if meshingSettings == None:
            mp = rc.Geometry.MeshingParameters.Minimal
            mp.SimplePlanes = True
        else:
            mp = meshingSettings
        
        def getRadMaterialName(radMaterial):
            nameStr = radMaterial.split(" ")[2]
            name =  nameStr.split("\n")[0]
            return name
        
        for brepCount, brep in enumerate(shdBreps):
            if brep != None:
                isPlanar = True
                # check planarity
                for face in brep.Faces:
                    if not face.IsPlanar(tolerance):
                        isPlanar = False
                        break
                
                shadingBreps = []
                if not isPlanar:
                    meshArray = rc.Geometry.Mesh.CreateFromBrep(brep, mp)
                    for mesh in meshArray:
                        for meshFace in range(mesh.Faces.Count):
                            vertices = list(mesh.Faces.GetFaceVertices(meshFace))[1:]
                            vertices = vertices + [sc.doc.ModelAbsoluteTolerance]
                            # create the brep from mesh
                            shdBrep = rc.Geometry.Brep.CreateFromCornerPoints(*vertices)
                            shadingBreps.append(shdBrep)
                else:
                    for face in brep.Faces:
                        shadingBreps.append(face.DuplicateFace(False))
                
                for faceCount, shdBrep in enumerate(shadingBreps):
                        thisShading = hb_EPSHDSurface(shdBrep, 1000*brepCount + faceCount, 'shdSrf_' + `brepCount` + '_' + `faceCount` + "_" + str(uuid.uuid4()))
                        
                        # add transmittance schedule if any
                        if EPTransSchedule!=None:
                            schedule= EPTransSchedule.upper()
                            if schedule!=None and not schedule.lower().endswith(".csv") and schedule not in HBScheduleList:
                                msg = "Cannot find " + schedule + " in Honeybee schedule library."
                                print msg
                                ghenv.Component.AddRuntimeMessage(gh.GH_RuntimeMessageLevel.Warning, msg)
                                return -1
                            elif schedule!=None and schedule.lower().endswith(".csv"):
                                # check if csv file is existed
                                if not os.path.isfile(schedule):
                                    msg = "Cannot find the shchedule file: " + schedule
                                    print msg
                                    ghenv.Component.AddRuntimeMessage(gh.GH_RuntimeMessageLevel.Warning, msg)
                                    return -1
                            
                            thisShading.TransmittanceSCH = schedule
                        
                        # add the Rad Material if any
                        if RADMaterial!=None:
                            # if it is just the name of the material make sure it is already defined
                            if len(RADMaterial.split(" ")) == 1:
                                # if the material is not in the library add it to the library
                                if not hb_RADMaterialAUX.isMatrialExistInLibrary(RADMaterial):
                                    warningMsg = "Can't find " + RADMaterial + " in RAD Material Library.\n" + \
                                                "Add the material to the library and try again."
                                    ghenv.Component.AddRuntimeMessage(gh.GH_RuntimeMessageLevel.Warning, warningMsg)
                                    return
                                
                                try:
                                    thisShading.setRADMaterial(RADMaterial)
                                except Exception, e:
                                    print e
                                    warningMsg = "You are using an old version of Honeybee_Honeybee! Update your files and try again."
                                    print warningMsg
                                    ghenv.Component.AddRuntimeMessage(gh.GH_RuntimeMessageLevel.Warning, warningMsg)
                                    return
                                
                                addedToLib = True
                            else:
                                
                                # try to add the material to the library
                                addedToLib, thisShading.RadMaterial = hb_RADMaterialAUX.analyseRadMaterials(RADMaterial, True)
                                
                            if addedToLib==False:
                                warningMsg = "Failed to add " + RADMaterial + " to the Library."
                                ghenv.Component.AddRuntimeMessage(gh.GH_RuntimeMessageLevel.Warning, warningMsg)
                                return
                        
                        # add shading to the list
                        shadingClasses.append(thisShading)
                
        # add to the hive
        hb_hive = sc.sticky["honeybee_Hive"]()
        HBContext  = hb_hive.addToHoneybeeHive(shadingClasses, ghenv.Component)
        return HBContext
        ################################################################################################
    else:
        print "You should first let Honeybee to fly..."
        w = gh.GH_RuntimeMessageLevel.Warning
        ghenv.Component.AddRuntimeMessage(w, "You should first let Honeybee to fly...")
        return -1
        

if _shdSurfaces and _shdSurfaces[0]!=None:
    # add cleaning function
    result= main(_shdSurfaces, EPTransSchedule_, meshingSettings_, justBoundingBox_)
    
    if result != -1: HBContext = result
# ---------- end hb_epcontextsrf ----------
energysimpar = Honeybee_EnergySimulationPar(timestep=Slider(4, range=0..10), shadowCalcPar=shadowpar, solarDistribution="4")  # -> energySimPar; plug-in component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
custom_preview = CustomPreview(Geometry=decomposebytype.walls, Material=ColourSwatch(SwatchColor=RGB(75, 83, 87)))
custom_preview_2 = CustomPreview(Geometry=decomposebytype.interiorWalls, Material=ColourSwatch(SwatchColor=RGB(75, 83, 87)))
custom_preview_3 = CustomPreview(Geometry=decomposebytype.windows, Material=ColourSwatch(SwatchColor=RGB(36, 167, 242)))
custom_preview_4 = CustomPreview(Geometry=decomposebytype.roofs, Material=ColourSwatch(SwatchColor=RGB(209, 65, 106)))
custom_preview_5 = CustomPreview(Geometry=decomposebytype.exposedFloors, Material=ColourSwatch(SwatchColor=RGB(8, 20, 18)))
custom_preview_6 = CustomPreview(Geometry=decomposebytype.floors, Material=ColourSwatch(SwatchColor=RGB(44, 97, 87)))
custom_preview_7 = CustomPreview(Geometry=decomposebytype.ceilings, Material=ColourSwatch(SwatchColor=RGB(46, 209, 179)))
# Radiance parameters
radparameters = Honeybee_RADParameters(
    quality=0,
    ab=Slider(2, range=0..10),
    ad=Slider(1000, range=0..1000),
    as=Slider(300, range=0..1000),
    aa=Slider(0.1, range=0..0.1))  # -> out, radParameters; plug-in component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
epoutput = Honeybee_GenerateEPOutput(
    zoneEnergyUse=boolean_toggle_2,
    zoneGainsAndLosses=boolean_toggle_2,
    zoneComfortMetrics="False",
    surfaceTempAnalysis="False",
    timestep=item_selector_2)  # -> out, flatten(simulationOutputs); plug-in component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
boolean_toggle_3 = BooleanToggle(False)
radmaterialsinfo_6 = Honeybee_RadianceMaterialsInfo(RADMaterial="Context_Material")  # -> RADMaterialStr; plug-in component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
labelzones_2 = Honeybee_LabelZones(
    HBZones=flatten(setloadsandschedules.HBZones),
    attribute=honeybee_zone_attribute_list_2,
    textHeight=Slider(1, range=0..10))  # -> zoneTxtLabels, labelBasePts, brepTxtLabels, zoneWireFrames; plug-in component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
honeybee_surface_attribute_list = Honeybee_SurfaceAttributeList({"Name": "name", "Radiance Material": "RadMaterial", "EnergyPlus Construction": "EPConstruction", "Surface Type": "type", "Boundary Condition": "BC", "BC Object": "BCObject", "Sun Exposure": "sunExposure", "Wind Exposure": "windExposure", "Has Child Surface": "hasChild", "Is Child Surface": "isChild", "Is Planar": "isPlanar", "Srf Type Set By User": "srfTypeByUser", "Boundary Condition Set By User": "srfBCByUser", "Shade Material Name": "shadeMaterialName", "Shading Control Name": "shadingControlName", "Shcading Schedule Name": "shadingSchName"}, selected="Radiance Material")
move_3 = Move(Geometry=brep_10, Motion="{0,0,-0.4}")  # -> Geometry, Transform
honeybee_surface_attribute_list_2 = Honeybee_SurfaceAttributeList({"Name": "name", "Radiance Material": "RadMaterial", "EnergyPlus Construction": "EPConstruction", "Surface Type": "type", "Boundary Condition": "BC", "BC Object": "BCObject", "Sun Exposure": "sunExposure", "Wind Exposure": "windExposure", "Has Child Surface": "hasChild", "Is Child Surface": "isChild", "Is Planar": "isPlanar", "Srf Type Set By User": "srfTypeByUser", "Boundary Condition Set By User": "srfBCByUser", "Shade Material Name": "shadeMaterialName", "Shading Control Name": "shadingControlName", "Shcading Schedule Name": "shadingSchName"}, selected="Name")
genhbzonetestpts = Honeybee_GenerateZoneTestPoints(HBZone=setradmaterials, gridSize=Slider(0.5, range=0..2), distBaseSrf=Slider(0.8, range=0..1), moveTestMesh=True)  # -> out, simplify(testPoints), simplify(ptsVectors), simplify(facesArea), simplify(mesh); plug-in component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
radmaterialsinfo_7 = Honeybee_RadianceMaterialsInfo(RADMaterial="Interior_Ceiling")  # -> RADMaterialStr; plug-in component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
file_path = FilePath("C:\Users\BT\Desktop\GBR_London.epw")
panel_6 = Panel(energysimpar)
item_selector_3 = ItemSelector(setradmaterials, {"Closed Brep", "Closed Brep", "Closed Brep", "Closed Brep", "Closed Brep"}, selected="Closed Brep")
runenergysimulation = Honeybee_RunEnergySimulation(
    epwFile=file_path,
    energySimPar=energysimpar,
    HBZones=flatten(setepzoneloads.HBZones),
    HBContext=flatten(hb_epcontextsrf),
    simulationOutputs=flatten(epoutput.simulationOutputs),
    writeIdf=boolean_toggle_3,
    runEnergyPlus=boolean_toggle_3,
    idfFileName="EP")  # -> out, idfFileAddress, resultFileAddress, eioFileAddress, rddFileAddress, htmlReport, studyFolder; plug-in component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
createhbsrfs_6 = Honeybee_createHBSrfs(geometry=move_3.Geometry, srfName="Ceiling", RADMaterial=radmaterialsinfo_7)  # -> out, simplify(HBSurface); plug-in component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
hb_epcontextsrf_2 = HoneybeeEPContextSurfaces(shdSurfaces=flatten([brep_9, createhbsrfs_6.HBSurface]), RADMaterial=radmaterialsinfo_6)  # -> HBContext; inputs shdSurfaces: list of Brep, justBoundingBox: Boolean; same code as hb_epcontextsrf
daylighfactorsimulation = Honeybee_DaylightFactorSimulation(
    testPoints=genhbzonetestpts.testPoints,
    ptsVectors=genhbzonetestpts.ptsVectors,
    testMesh=genhbzonetestpts.mesh,
    uniformSky=False,
    radParameters=radparameters.radParameters)  # -> analysisRecipe; plug-in component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
labelsurfaces = Honeybee_LabelZoneSurfaces(HBObjects=flatten(hb_epcontextsrf), attribute=honeybee_surface_attribute_list, textHeight=Slider(2, range=0..2))  # -> surfaceTxtLabels, labelBasePts, brepTxtLabels, surfaceWireFrames; plug-in component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
labelsurfaces_2 = Honeybee_LabelZoneSurfaces(HBObjects=flatten(item_selector_3), attribute=honeybee_surface_attribute_list_2, windows=Toggle(False), textHeight="1")  # -> surfaceTxtLabels, labelBasePts, brepTxtLabels, surfaceWireFrames; plug-in component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
decomposebybc = Honeybee_DecomposeBasedOnBoundaryCondition(HBZone=setepzoneloads.HBZones)  # -> outdoors, surface, adiabatic, ground; plug-in component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
decomposebytype_2 = Honeybee_DecomposeBasedOnType(HBZone=setepzoneloads.HBZones)  # -> walls, interiorWalls, airWalls, windows, interiorWindows, skylights, roofs, ceilings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; plug-in component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
boolean_toggle_4 = BooleanToggle(False)
readepresult = Honeybee_ReadEPResult(resultFileAddress=runenergysimulation.resultFileAddress)  # -> totalThermalLoad, thermalLoadBalance, cooling, heating, electricLight, electricEquip, fanElectric, pumpElectric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; plug-in component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
brep_11 = Brep([setradmaterials, hb_epcontextsrf_2, createhbsrfs_6.HBSurface])
custom_preview_8 = CustomPreview(Geometry=createhbsrfs_6.HBSurface, Material=ColourSwatch(SwatchColor=RGB(46, 209, 179)))
panel_7 = Panel(runenergysimulation.out)
# Boundary conditions check
colour_swatch = ColourSwatch(SwatchColor=RGB(46, 209, 179))
point = Point(Point(81.13886995, 182.3423829, 0.6255793037))
rundaylightanalysis = Honeybee_RunDaylightSimulation(
    HBObjects=flatten(brep_11),
    analysisRecipe=daylighfactorsimulation,
    writeRad=boolean_toggle_4,
    runRad=boolean_toggle_4,
    numOfCPUs=Slider(7, range=0..10),
    overwriteResults=True)  # -> out, analysisType, resultsUnit, results, testPts, resultFiles, radGeoFile, studyFolder, done; plug-in component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
legendpar = Ladybug_LegendParameters(lowBound=Slider(0, range=0..100), highBound=Slider(20, range=0..100), legendLocation=point)  # -> legendPar; plug-in component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
custom_preview_9 = CustomPreview(Geometry=decomposebybc.adiabatic, Material=colour_swatch)
strnum = Ladybug_SeparateData(inputList=flatten(readepresult.totalThermalLoad))  # -> numbers, strings; plug-in component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
strnum_2 = Ladybug_SeparateData(inputList=flatten(readepresult.cooling))  # -> numbers, strings; plug-in component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
strnum_3 = Ladybug_SeparateData(inputList=flatten(readepresult.heating))  # -> numbers, strings; plug-in component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
custom_preview_10 = CustomPreview(Geometry=decomposebytype_2.walls, Material=ColourSwatch(SwatchColor=RGB(75, 83, 87)))
custom_preview_11 = CustomPreview(Geometry=decomposebytype_2.interiorWalls, Material=ColourSwatch(SwatchColor=RGB(75, 83, 87)))
custom_preview_12 = CustomPreview(Geometry=decomposebytype_2.windows, Material=ColourSwatch(SwatchColor=RGB(36, 167, 242)))
custom_preview_13 = CustomPreview(Geometry=decomposebytype_2.roofs, Material=ColourSwatch(SwatchColor=RGB(209, 65, 106)))
custom_preview_14 = CustomPreview(Geometry=decomposebytype_2.floors, Material=ColourSwatch(SwatchColor=RGB(44, 97, 87)))
number_2 = Number(Tree({0}: [8.57, 10.21, 13.25, 11.93, 6.83, 3.64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], {1}: [5.61, 1.68, 0.53, 0.3, 0.2, 0.15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], {2}: [6.75, 2.07, 0.88, 0.35, 0.21, 0.15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], {3}: [9.53, 3.64, 1.7, 0.97, 0.62, 0.39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], {4}: [11.01, 5.65, 2.59, 1.46, 0.98, 0.65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]))
number_3 = Number(rundaylightanalysis.results)
average = Average(Input=number_2)  # -> reverse(flatten(ArithmeticMean))
average_2 = Average(Input=number_3)  # -> reverse(flatten(ArithmeticMean))
mass_addition_2 = MassAddition(Input=strnum.numbers)  # -> Result, PartialResults
quick_graph = QuickGraph(strnum_2.numbers, SortOrder=0)
quick_graph_2 = QuickGraph(strnum_3.numbers, SortOrder=0)
recolormesh = Ladybug_RecolorMesh(
    analysisResult=rundaylightanalysis.results,
    inputMesh=genhbzonetestpts.mesh,
    legendPar=legendpar,
    analysisTitle=" ",
    legendTitle="Daylight factor")  # -> out, newMesh, newLegend, legendBasePt, meshColors, legendColors; plug-in component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
average_3 = Average(Input=average)  # -> reverse(flatten(ArithmeticMean))
round = Round(Number=mass_addition_2.Result)  # -> Nearest, Floor, Ceiling
panel_8 = Panel(average)
average_4 = Average(Input=average_2)  # -> reverse(flatten(ArithmeticMean))
subtraction = Subtraction(A=average, B=average_2)
panel_9 = Panel(average_2)
quick_graph_3 = QuickGraph(panel_8, SortOrder=0)
quick_graph_4 = QuickGraph(panel_9, SortOrder=0)
total_energy = Panel(round.Nearest)
round_2 = Round(Number=strnum_2.numbers)  # -> Nearest, Floor, Ceiling
round_3 = Round(Number=strnum_3.numbers)  # -> Nearest, Floor, Ceiling
panel_10 = Panel(average_3)
panel_11 = Panel(average_4)
panel_12 = Panel([number_slider, round_2.Nearest, round_3.Nearest, average_2, average_4])
ghpython_script_2 = GhPythonScript(x=average_4)  # -> out, a
# ---------- ghpython_script_2: Python ----------
__author__ = "BT"
__version__ = "2020.03.06"

import rhinoscriptsyntax as rs
a=round(x,4)
# ---------- end ghpython_script_2 ----------
ghpython_script_3 = GhPythonScript(x=average, y=average_2)  # -> out, a
# ---------- ghpython_script_3: Python ----------
__author__ = "BT"
__version__ = "2020.03.06"

import rhinoscriptsyntax as rs
a=round((x-y)/x*100,4)
# ---------- end ghpython_script_3 ----------
quick_graph_5 = QuickGraph(ghpython_script_3.a, SortOrder=0)

# ---- group: Section 1 - Solar radiation plot on SW facade
# Ensure normal vectors points outward
# Internalised data
# 100% context
# SW facade
number_slider_2 = Slider(9, range=1..12)
number_slider_3 = Slider(15, range=1..31)
file_path_2 = FilePath("C:\Users\BT\Desktop\GBR_London.epw")
analysisperiod = Ladybug_AnalysisPeriod(fromMonth=Slider(6, range=1..12), fromDay=number_slider_3, toMonth=number_slider_2, toDay=number_slider_3)  # -> out, analysisPeriod; plug-in component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
gencumulativeskymtx = Ladybug_GenCumulativeSkyMtx(epwFile=file_path_2, skyDensity="1", useOldRes=True, runIt=Toggle(False))  # -> out, cumulativeSkyMtx; plug-in component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
selectskymtx = Ladybug_selectSkyMtx(
    cumulativeSkyMtx=gencumulativeskymtx.cumulativeSkyMtx,
    analysisPeriod=analysisperiod.analysisPeriod,
    removeDiffuse=False,
    removeDirect=False)  # -> out, selectedSkyMtx; plug-in component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
boolean_toggle_5 = BooleanToggle(False)
legendpar_2 = Ladybug_LegendParameters(
    lowBound=Slider(50, range=0..100),
    highBound=Slider(150, range=0..1000),
    numSegments=Slider(11, range=0..20),
    legendScale=Slider(0.1, range=0..1),
    fontSize=Slider(0.5, range=0..1))  # -> legendPar; plug-in component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
brep_12 = Brep(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)
plane = Plane(brep_12)
radiationanalysis = Ladybug_RadiationAnalysis(
    geometry=flatten(brep_12),
    context=flatten(brep_9),
    gridSize=Slider(0.5, range=0..2),
    disFromBase=Slider(0.01, range=0..1),
    selectedSkyMtx=flatten(selectskymtx.selectedSkyMtx),
    legendPar=flatten(legendpar_2),
    parallel=boolean_toggle_5,
    runIt=boolean_toggle_5)  # -> out, contextMesh, analysisMesh, testPts, testVec, port, radiationResult, radiationMesh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; plug-in component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
vector_display = VectorDisplay(Anchor=plane, Vector=plane)
negative = Negative(Value=radiationanalysis.radiationResult)
number_4 = Number([156.0125732, 156.0125732, 145.0993014, 134.4171353, 133.3899116, 129.4689397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])
multiplication = Multiplication(A=negative, B=Slider(0.28, range=0..1))
subtraction_2 = Subtraction(A=number_4, B=radiationanalysis.radiationResult)
line_sdl = LineSDL(Start=radiationanalysis.testPts, Direction=radiationanalysis.testVec, Length=multiplication)
mass_addition_3 = MassAddition(Input=number_4)  # -> Result, PartialResults
mass_addition_4 = MassAddition(Input=subtraction_2)  # -> Result, PartialResults
quick_graph_6 = QuickGraph(subtraction_2, SortOrder=0)
end_points = EndPoints(Curve=line_sdl)  # -> Start, End
point_2 = Point(end_points.End)
surface_from_points = SurfaceFromPoints(Points=point_2, UCount=Slider(51, range=0..100), Interpolate=False)

# ----
ghpython_script_4 = GhPythonScript(x=mass_addition_4.Result, y=mass_addition_3.Result)  # -> out, a; same code as ghpython_script

# ---- group: Section 1 - Solar radiation plot on SW facade (continued)
panel_13 = Panel(ghpython_script_4.a)
