# Grasshopper definition CW section_2.gh (Grasshopper 1.0.7)
# plug-ins: Human

honeybee = Honeybee_Honeybee()  # -> out; plug-in component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
ladybug = Ladybug_Ladybug()  # -> out; plug-in component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

# ----
# Variable panel width
# Variable panel count
# Variable panel width
# Shading Depth
# Window ratio
# Center/Left/Right
i3_b = Slider(1, range=0.1..1.1)
i5_step1 = Slider(8.9, range=0.1..13)
i1_a = Slider(2.3, range=-5..5)
i1_b = Slider(7, range=1..10)
i5_step2 = Slider(8.2, range=0.1..13)
i3_a = Slider(0.04, range=0..0.25)
i2_a = Slider(-0.3, range=-0.4..0.4)
i2_b = Slider(0.8, range=0.1..1.1)
clr_012 = Slider(0, range=0..2)

panel = Panel("""4
3
2
1
0""")
number = Number(panel)
ghpython_script = GhPythonScript(a=i1_a, b=i1_b, ymax="15", x=number)  # -> out, y
# ---------- ghpython_script: Python ----------
__author__ = "BT"
__version__ = "2020.03.08"

import rhinoscriptsyntax as rs
y=abs(a*x+b)
if y>=ymax:
    y=ymax
elif y==0:
    y=1
else:
    y=round(y,0)
# ---------- end ghpython_script ----------
series = Series(Start=0, Step=i5_step1, Count=720)
series_2 = Series(Start=0, Step=i5_step2, Count=720)
radians = Radians(Degrees=series)
radians_2 = Radians(Degrees=series_2)
panel_2 = Panel(ghpython_script.y)
series_3 = Series(Start=30, Step="7", Count="5")
series_4 = Series(Start="9", Step="18", Count=ghpython_script.y)
sine = Sine(Value=radians)
sine_2 = Sine(Value=radians_2)
list_item = ListItem(List=sine_2, Index=series_3, Wrap=True)  # -> graft(Item)
list_item_2 = ListItem(List=sine, Index=series_4, Wrap=True)
ghpython_script_2 = GhPythonScript(a=i3_a, b=i3_b, x=number)  # -> out, y
# ---------- ghpython_script_2: Python ----------
__author__ = "BT"
__version__ = "2020.03.08"

import rhinoscriptsyntax as rs
y=a*x+b
if y>1.0:
    y=1
# ---------- end ghpython_script_2 ----------
ghpython_script_3 = GhPythonScript(a=i2_a, b=i2_b, x=number)  # -> out, y
# ---------- ghpython_script_3: Python ----------
__author__ = "BT"
__version__ = "2020.03.08"

import rhinoscriptsyntax as rs
y=abs(a*x+b)
if y>1.0:
    y=1
# ---------- end ghpython_script_3 ----------
subtraction = Subtraction(A=list_item_2, B=list_item)
absolute = Absolute(Value=subtraction)

# ----
# Inputs to grasshoppers geometry nodes
# Input 1 & 5
# Variable panel
# count and width
# Input 3
# Shading Depth
# Input 2
# Window ratio
# Input 4
# Center/Left/Right
panel_3 = Panel(clr_012)
panel_4 = Panel(ghpython_script_3.y)
panel_5 = Panel(ghpython_script_2.y)
panel_6 = Panel(absolute)
quick_graph = QuickGraph(panel_6, SortOrder=0)

# ----
# 100% Glazing to optimize
# Param 1 & 5 - Variable panel count on each floor with variable width for each panel
# Panels
# Param 3 - Variable overhang and fins depth on each floor
# Shading
# Param 2 - Variable window ratio on each floor
# Windows
# Center
# Placeholder
# area 100%
# Left
# Fixed Glazing
# Right
# EP Simplified Context
# Surrounding buildings
# + ground plane
# Daylight Original Context
# Surrounding buildings
# + ground plane
brep = Brep([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])
mass_addition = MassAddition(Input=panel_6)  # -> Result, PartialResults
deconstruct_domain² = DeconstructDomain²(Domain=brep)  # -> UComponent, graft(VComponent)
construct_domain = ConstructDomain(DomainStart=0, DomainEnd=mass_addition.Result)
quick_graph_2 = QuickGraph(mass_addition.PartialResults, SortOrder=0)
remap_numbers = RemapNumbers(Value=mass_addition.PartialResults, Source=construct_domain, Target=deconstruct_domain².UComponent)  # -> Mapped, flatten(Clipped)
deconstruct_domain = DeconstructDomain(Domain=deconstruct_domain².UComponent)  # -> graft(Start), graft(End)
cull_index = CullIndex(List=remap_numbers.Mapped, Indices="-1", Wrap=True)
insert_items = InsertItems(List=cull_index, Item=deconstruct_domain.Start, Indices="0", Wrap=True)
construct_domain_2 = ConstructDomain(DomainStart=insert_items, DomainEnd=remap_numbers.Mapped)
construct_domain² = ConstructDomain²(DomainU=construct_domain_2, DomainV=deconstruct_domain².VComponent)
isotrim = Isotrim(Surface=brep, Domain=graft(construct_domain²))  # -> simplify(Surface)
panel_7 = Panel(isotrim)
boolean_toggle = BooleanToggle(True)
clean_tree = CleanTree(RemoveNulls=boolean_toggle, RemoveInvalid=True, RemoveEmpty=boolean_toggle, Tree=isotrim)
panel_8 = Panel(clean_tree)
trim_tree = TrimTree(Tree=clean_tree, Depth=1)
panel_9 = Panel(trim_tree)
deconstruct_brep = DeconstructBrep(Brep=trim_tree)  # -> Faces, Edges, Vertices
trim_tree_2 = TrimTree(Tree=deconstruct_brep.Faces, Depth=1)
list_item_3 = ListItem(List=deconstruct_brep.Edges, Index=Slider(1, range=0..3), Wrap=True)
list_item_4 = ListItem(List=deconstruct_brep.Edges, Index=Slider(3, range=0..3), Wrap=True)
vector = Vector(trim_tree_2)
curve_middle = CurveMiddle(Curve=list_item_3)
curve_middle_2 = CurveMiddle(Curve=list_item_4)
list_item_5 = ListItem(List=vector, Index=0, Wrap=True)
surface = Surface(trim_tree)
panel_10 = Panel(panel_4)
trim_tree_3 = TrimTree(Tree=deconstruct_brep.Edges, Depth=1)
trim_tree_4 = TrimTree(Tree=curve_middle, Depth=1)
trim_tree_5 = TrimTree(Tree=curve_middle_2, Depth=1)
area = Area(Geometry=surface)  # -> Area, Centroid
multiplication = Multiplication(A=list_item_5, B=graft(panel_5))
vector_display = VectorDisplay(Anchor=deconstruct_brep.Vertices, Vector=multiplication)
construct_domain_3 = ConstructDomain(DomainStart=0, DomainEnd=area.Area)
stream_filter = StreamFilter(Gate=panel_3, Stream0=area.Centroid, Stream1=trim_tree_4, Stream2=trim_tree_5)
line = Line(trim_tree_3)
deconstruct_vector = DeconstructVector(Vector=multiplication)  # -> XComponent, YComponent, ZComponent
vector_xyz = VectorXYZ(XComponent=deconstruct_vector.XComponent, YComponent=deconstruct_vector.YComponent, ZComponent=0)  # -> Vector, simplify(flatten(Length))
remap_numbers_2 = RemapNumbers(Value=graft(panel_10), Source=construct_domain_3, Target=construct_domain_3)  # -> Mapped, Clipped
plane_normal = PlaneNormal(Origin=stream_filter, ZAxis=vector)
scale_nu = ScaleNU(Geometry=surface, Plane=plane_normal, ScaleX=remap_numbers_2.Mapped, ScaleY=1, ScaleZ=1)  # -> Geometry, Transform
extrude = Extrude(Base=line, Direction=vector_xyz.Vector)
panel_11 = Panel(vector_xyz.Length)
brep_2 = Brep(Tree({0;0}: [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], {0;1}: [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], {0;2}: [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], {0;3}: [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], {0;4}: [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]))
custom_preview = CustomPreview(Geometry=extrude, Material=ColourSwatch(SwatchColor=RGB(66, 69, 63)))
brep_3 = Brep([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])
brep_4 = Brep([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])
brep_5 = Brep([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])
brep_6 = Brep([brep_4, extrude])
brep_7 = Brep([brep_5, extrude])
move = Move(Geometry=brep_3, Motion="{0,0,0.01}")  # -> Geometry, Transform
number_2 = Number(372.38644)

# ----
# Parametric glazing
brep_8 = Brep(scale_nu.Geometry)

deconstruct_brep_2 = DeconstructBrep(Brep=brep_8)  # -> Faces, Edges, Vertices
is_planar = IsPlanar(Surface=deconstruct_brep_2.Faces, Interior=True)  # -> Planar, Plane
scale_nu_2 = ScaleNU(Geometry=deconstruct_brep_2.Faces, Plane=is_planar.Plane, ScaleX=1, ScaleY=Slider(1, range=0.1..1), ScaleZ=1)  # -> Geometry, Transform
area_2 = Area(Geometry=scale_nu_2.Geometry)  # -> Area, Centroid
move_2 = Move(Geometry=flatten(scale_nu_2.Geometry), Motion="{0,0,0.01}")  # -> Geometry, Transform
mass_addition_2 = MassAddition(Input=flatten(area_2.Area))  # -> Result, PartialResults
ghpython_script_4 = GhPythonScript(x=mass_addition_2.Result, y=number_2)  # -> out, a
# ---------- ghpython_script_4: Python ----------
__author__ = "BT"
__version__ = "2020.03.06"

import rhinoscriptsyntax as rs
a=x/y*100
# ---------- end ghpython_script_4 ----------
panel_12 = Panel(ghpython_script_4.a)

# ----
# Adiabatic wall
# E+ HB zone
# Add Fixed Glazing
# Adiabatic floor
# Surface with variable glazing
# Roof
# Wall with fixed glazing
# Daylight HB zones
# Front and right wall
# Create HB zones with names
# Split BREP by floors
# Add both Fixed Glazing
# and surface with variable glazing
brep_9 = Brep(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)
brep_10 = Brep(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)
brep_11 = Brep(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)
brep_12 = Brep(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)
brep_13 = Brep([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])
createhbsrfs = Honeybee_createHBSrfs(geometry=brep_10, srfName="Floor", EPBC="Adiabatic")  # -> out, simplify(HBSurface); plug-in component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
createhbsrfs_2 = Honeybee_createHBSrfs(geometry=brep_11, srfName="Roof", EPBC="Outdoors")  # -> out, simplify(HBSurface); plug-in component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
createhbsrfs_3 = Honeybee_createHBSrfs(geometry=brep_12, srfName="Wall_L")  # -> out, simplify(HBSurface); plug-in component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
createhbsrfs_4 = Honeybee_createHBSrfs(geometry=brep_13, srfName="Wall_FR")  # -> out, simplify(HBSurface); plug-in component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
createhbsrfs_5 = Honeybee_createHBSrfs(geometry=brep_9, srfName="Adiabatic wall", EPBC="Adiabatic")  # -> out, simplify(HBSurface); plug-in component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
createhbzones = Honeybee_createHBZones(
    name="Daylight",
    HBSurfaces=flatten([createhbsrfs.HBSurface, createhbsrfs_2.HBSurface, createhbsrfs_5.HBSurface, createhbsrfs_3.HBSurface, createhbsrfs_4.HBSurface]),
    isConditioned=True)  # -> out, HBZone; plug-in component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
addhbglz = Honeybee_addHBGlz(HBObj=createhbsrfs_3.HBSurface, childSurfaces=flatten(move.Geometry))  # -> HBObjWGLZ; plug-in component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
addhbglz_2 = Honeybee_addHBGlz(HBObj=createhbsrfs_4.HBSurface, childSurfaces=flatten(move_2.Geometry))  # -> HBObjWGLZ; plug-in component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
split2floors = Honeybee_SplitBuildingMass2Floors(bldgMasses=createhbzones.HBZone, bldgsFlr2FlrHeights=["1@3.55", "2@3.15", "1@3.525"], runIt=Toggle(True))  # -> out, flatten(splitBldgFloors); plug-in component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
createhbzones_2 = Honeybee_createHBZones(
    name="Energy_Building",
    HBSurfaces=flatten([createhbsrfs.HBSurface, createhbsrfs_2.HBSurface, createhbsrfs_5.HBSurface, addhbglz, addhbglz_2]),
    isConditioned=True)  # -> out, HBZone; plug-in component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
panel_13 = Panel("""Zone 1
Zone 2
Zone 3
Zone 4
Zone 5""")
mass2zone = Honeybee_Masses2Zones(zoneMasses=flatten(split2floors.splitBldgFloors), zoneNames=panel_13, maxRoofAngle=30, createHBZones=Toggle(True))  # -> out, HBZones; plug-in component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
addhbglz_3 = Honeybee_addHBGlz(HBObj=mass2zone.HBZones, childSurfaces=flatten([move.Geometry, move_2.Geometry]))  # -> HBObjWGLZ; plug-in component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

# ----
# Radiance parameters
# EP CONSTRUCTION
# WALL
# ROOF
# WINDOW
# Boundary conditions check
callfromepconstrlibrary = Honeybee_CallFromEPConstructionLibrary()  # -> ThermMaterials, EPMaterials, EPWindowMaterials, EPConstructions; plug-in component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
searchepconstruction = Honeybee_SearchEPConstruction(EPConstrList=callfromepconstrlibrary.EPConstructions, standard="2", surfaceType="1", keywords="SEMIHEATED")  # -> EPSelectedConstr; plug-in component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
searchepconstruction_2 = Honeybee_SearchEPConstruction(EPConstrList=callfromepconstrlibrary.EPConstructions, standard="2", climateZone="8", surfaceType="0", keywords="MASS")  # -> EPSelectedConstr; plug-in component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
searchepconstruction_3 = Honeybee_SearchEPConstruction(
    EPConstrList=callfromepconstrlibrary.EPConstructions,
    standard="2",
    climateZone="8",
    surfaceType="4",
    keywords="NONMETAL")  # -> EPSelectedConstr; plug-in component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
list_item_6 = ListItem(List=searchepconstruction, Index=Slider(4, range=0..10), Wrap=True)
list_item_7 = ListItem(List=searchepconstruction_2, Index=Slider(0, range=0..10), Wrap=True)
setepzonecnstr = Honeybee_SetEPZoneConstruction(
    HBZones=flatten(createhbzones_2.HBZone),
    wallEPConstruction=list_item_7,
    windowEPConstruction=searchepconstruction_3,
    roofEPConstruction=list_item_6)  # -> simplify(modifiedHBZones); plug-in component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
decomposeepconstruction = Honeybee_DecomposeEPConstruction(cnstrName=searchepconstruction_3)  # -> materials, comments, UValue_SI, UValue_IP, RValue_SI, RValue_IP; plug-in component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
honeybee_bldgprograms = Honeybee_bldgPrograms({"Office": 0, "Retail": 1, "MidriseApartment": 2, "PrimarySchool": 3, "SecondarySchool": 4, "SmallHotel": 5, "LargeHotel": 6, "Hospital": 7, "Outpatient": 8, "Warehouse": 9, "SuperMarket": 10, "FullServiceRestaurant": 11, "QuickServiceRestaurant": 12}, selected="Office")
decomposeepmaterial = Honeybee_DecomposeEPMaterial(materialName=simplify(decomposeepconstruction.materials))  # -> names, values, comments, UValue_SI, UValue_IP, RValue_SI, RValue_IP; plug-in component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
epwindowmat = Honeybee_EnergyPlusWindowMaterial(name="GlazingBT", U_Value=Slider(2, range=0..10), SHGC=Slider(0.45, range=0..1), VT=Slider(0.25, range=0..1))  # -> EPMaterial; plug-in component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
listzoneprograms = Honeybee_ListZonePrograms(bldgProgram=honeybee_bldgprograms)  # -> OfficeZonePrograms; plug-in component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
panel_14 = Panel([decomposeepmaterial.comments, decomposeepmaterial.values])
decomposeepmaterial_2 = Honeybee_DecomposeEPMaterial(materialName=simplify(epwindowmat))  # -> names, values, comments, UValue_SI, UValue_IP, RValue_SI, RValue_IP; plug-in component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
epconstruction = Honeybee_EnergyPlusConstruction(name="WindowMAterial:SimpleGlazingSystem", layer_1=epwindowmat)  # -> EPConstruction; plug-in component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
boolean_toggle_2 = BooleanToggle(False)
division = Division(A=Slider(5, range=0..10), B=Slider(12, range=0..100))
item_selector = ItemSelector(
    listzoneprograms,
    {"Office::BreakRoom", "Office::Storage", "Office::Vending", "Office::OpenOffice", "Office::ClosedOffice", "Office::Conference", "Office::PrintRoom", "Office::Restroom", "Office::Elec/MechRoom", "Office::IT_Room", "Office::Stair", "Office::Corridor", "Office::Lobby"}, selected="Office::OpenOffice")
decomposeepconstruction_2 = Honeybee_DecomposeEPConstruction(cnstrName=epconstruction)  # -> materials, comments, UValue_SI, UValue_IP, RValue_SI, RValue_IP; plug-in component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
addtoeplibrary = Honeybee_AddToEnergyPlusLibrary(EPObject=epconstruction)  # -> out; plug-in component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
setloadsandschedules = Honeybee_SetLoadsAndSchedules(HBZones=flatten(setepzonecnstr), zonePrograms=item_selector)  # -> currentSchedules, currentLoads, HBZones; plug-in component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
ach2m3_s_m2_calculator = Honeybee_infORventPerAreaCalculator(HBZones=flatten(setloadsandschedules.HBZones), airFlowRate=Slider(0.2, range=0..1), ACHorM3sM2=Toggle(True))  # -> out, infPerAreaFacade, ventPerAreaFloor, allExposed, allFloors; plug-in component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
setepzoneloads = Honeybee_SetEnergyPlusZoneLoads(
    HBZones=setloadsandschedules.HBZones,
    equipmentLoadPerArea=Slider(50, range=0..100),
    infilRatePerArea_Facade=ach2m3_s_m2_calculator.infPerAreaFacade,
    lightingDensityPerArea=Slider(50, range=0..100),
    numOfPeoplePerArea=division,
    ventilationPerArea=Slider(0, range=0..100),
    ventilationPerPerson=Slider(0.01, range=0..0.01))  # -> loads, HBZones; plug-in component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
panel_15 = Panel("Context_Material")  # disabled
radmaterialsinfo = Honeybee_RadianceMaterialsInfo(RADMaterial=panel_15)  # -> RADMaterialStr; disabled; plug-in component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
shadowpar = Honeybee_ShadowPar(maximumFigure=Slider(15000, range=0..100000))  # -> shadowPar; plug-in component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
panel_16 = Panel("""hourly
daily
monthly
annual""")
honeybee_zone_attribute_list = Honeybee_ZoneAttributeList({"Name": "name", "Zone Program": "zoneProgram", "Zone Floor Area": "zoneFloorArea", "Zone Volume": "zoneVolume", "Building Program": "bldgProgram", "Is Conditioned": "isConditioned", "HVAC System Type": "HVACSystem", "Occupancy Schedule": "occupancySchedule", "Occupancy Activity Schedule": "occupancyActivitySch", "Heating SetPoint Schedule": "heatingSetPtSchedule"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}, selected="Name")
boolean_toggle_3 = BooleanToggle(True)
item_selector_2 = ItemSelector(panel_16, {"hourly", "daily", "monthly", "annual"}, selected="annual")
panel_17 = Panel(setepzoneloads.loads)
hb_epcontextsrf = HoneybeeEPContextSurfaces(shdSurfaces=flatten(brep_6), RADMaterial=radmaterialsinfo)  # -> HBContext; inputs shdSurfaces: list of Brep, justBoundingBox: Boolean
# ---------- hb_epcontextsrf: Python ----------
"""
prepare shading/context geometries

    Args:
        northVectorOrRotation: A vector that shows North or a number that shows
                               the rotation of the North from the Y axis
        bldgMasses: List of closed Breps as thermal zones.
    Returns:
        report: ...
        thermalZones: Thermal zone's geometries for visualiza
"""

ghenv.Component.Name = 'Honeybee EP context Surfaces'
ghenv.Component.NickName = 'HB_EPContextSrf'
ghenv.Component.Message = 'VER 0.0.65\nJAN_01_2020'
ghenv.Component.IconDisplayMode = ghenv.Component.IconDisplayMode.application
ghenv.Component.Category = "Honeybee"
ghenv.Component.SubCategory = "10 | Energy | Energy"
#compatibleHBVersion = VER 0.0.57\nNOV_04_2016
#compatibleLBVersion = VER 0.0.59\nFEB_01_2015
ghenv.Component.AdditionalHelpFromDocStrings = "2"

import rhinoscriptsyntax as rs
import Rhino as rc
import scriptcontext as sc
import os
import System
import Grasshopper.Kernel as gh
import uuid

tolerance = sc.doc.ModelAbsoluteTolerance
import math


def main(shdSurfaces, EPTransSchedule, meshingSettings, justBoundingBox):
    
    # import the classes
    if sc.sticky.has_key('honeybee_release'):

        try:
            if not sc.sticky['honeybee_release'].isCompatible(ghenv.Component): return -1
            if sc.sticky['honeybee_release'].isInputMissing(ghenv.Component): return -1
        except:
            warning = "You need a newer version of Honeybee to use this compoent." + \
            " Use updateHoneybee component to update userObjects.\n" + \
            "If you have already updated userObjects drag Honeybee_Honeybee component " + \
            "into canvas and try again."
            w = gh.GH_RuntimeMessageLevel.Warning
            ghenv.Component.AddRuntimeMessage(w, warning)
            return -1
        
        # don't customize this part
        hb_EPSrf = sc.sticky["honeybee_EPSurface"]
        hb_EPSHDSurface = sc.sticky["honeybee_EPShdSurface"]
        hb_RADMaterialAUX = sc.sticky["honeybee_RADMaterialAUX"]
        hb_EPObjectsAux = sc.sticky["honeybee_EPObjectsAUX"]()
        HBScheduleList = sc.sticky["honeybee_ScheduleLib"].keys()

        ########################################################################
        #----------------------------------------------------------------------#
        shdBreps = []
        # create bounding box of shading geometries
        if justBoundingBox:
            for brep in shdSurfaces:
                if brep.Faces.Count>1 or not brep.Faces[0].IsPlanar(sc.doc.ModelAbsoluteTolerance):
                    shdBreps.append(brep.GetBoundingBox(True).ToBrep())
                else:
                    shdBreps.append(brep)
        else:
            shdBreps = shdSurfaces
        
        shadingClasses = []
        shadingMeshPreview = []
        
        if meshingSettings == None:
            mp = rc.Geometry.MeshingParameters.Minimal
            mp.SimplePlanes = True
        else:
            mp = meshingSettings
        
        def getRadMaterialName(radMaterial):
            nameStr = radMaterial.split(" ")[2]
            name =  nameStr.split("\n")[0]
            return name
        
        for brepCount, brep in enumerate(shdBreps):
            if brep != None:
                isPlanar = True
                # check planarity
                for face in brep.Faces:
                    if not face.IsPlanar(tolerance):
                        isPlanar = False
                        break
                
                shadingBreps = []
                if not isPlanar:
                    meshArray = rc.Geometry.Mesh.CreateFromBrep(brep, mp)
                    for mesh in meshArray:
                        for meshFace in range(mesh.Faces.Count):
                            vertices = list(mesh.Faces.GetFaceVertices(meshFace))[1:]
                            vertices = vertices + [sc.doc.ModelAbsoluteTolerance]
                            # create the brep from mesh
                            shdBrep = rc.Geometry.Brep.CreateFromCornerPoints(*vertices)
                            shadingBreps.append(shdBrep)
                else:
                    for face in brep.Faces:
                        shadingBreps.append(face.DuplicateFace(False))
                
                for faceCount, shdBrep in enumerate(shadingBreps):
                        thisShading = hb_EPSHDSurface(shdBrep, 1000*brepCount + faceCount, 'shdSrf_' + `brepCount` + '_' + `faceCount` + "_" + str(uuid.uuid4()))
                        
                        # add transmittance schedule if any
                        if EPTransSchedule!=None:
                            schedule= EPTransSchedule.upper()
                            if schedule!=None and not schedule.lower().endswith(".csv") and schedule not in HBScheduleList:
                                msg = "Cannot find " + schedule + " in Honeybee schedule library."
                                print msg
                                ghenv.Component.AddRuntimeMessage(gh.GH_RuntimeMessageLevel.Warning, msg)
                                return -1
                            elif schedule!=None and schedule.lower().endswith(".csv"):
                                # check if csv file is existed
                                if not os.path.isfile(schedule):
                                    msg = "Cannot find the shchedule file: " + schedule
                                    print msg
                                    ghenv.Component.AddRuntimeMessage(gh.GH_RuntimeMessageLevel.Warning, msg)
                                    return -1
                            
                            thisShading.TransmittanceSCH = schedule
                        
                        # add the Rad Material if any
                        if RADMaterial!=None:
                            # if it is just the name of the material make sure it is already defined
                            if len(RADMaterial.split(" ")) == 1:
                                # if the material is not in the library add it to the library
                                if not hb_RADMaterialAUX.isMatrialExistInLibrary(RADMaterial):
                                    warningMsg = "Can't find " + RADMaterial + " in RAD Material Library.\n" + \
                                                "Add the material to the library and try again."
                                    ghenv.Component.AddRuntimeMessage(gh.GH_RuntimeMessageLevel.Warning, warningMsg)
                                    return
                                
                                try:
                                    thisShading.setRADMaterial(RADMaterial)
                                except Exception, e:
                                    print e
                                    warningMsg = "You are using an old version of Honeybee_Honeybee! Update your files and try again."
                                    print warningMsg
                                    ghenv.Component.AddRuntimeMessage(gh.GH_RuntimeMessageLevel.Warning, warningMsg)
                                    return
                                
                                addedToLib = True
                            else:
                                
                                # try to add the material to the library
                                addedToLib, thisShading.RadMaterial = hb_RADMaterialAUX.analyseRadMaterials(RADMaterial, True)
                                
                            if addedToLib==False:
                                warningMsg = "Failed to add " + RADMaterial + " to the Library."
                                ghenv.Component.AddRuntimeMessage(gh.GH_RuntimeMessageLevel.Warning, warningMsg)
                                return
                        
                        # add shading to the list
                        shadingClasses.append(thisShading)
                
        # add to the hive
        hb_hive = sc.sticky["honeybee_Hive"]()
        HBContext  = hb_hive.addToHoneybeeHive(shadingClasses, ghenv.Component)
        return HBContext
        ################################################################################################
    else:
        print "You should first let Honeybee to fly..."
        w = gh.GH_RuntimeMessageLevel.Warning
        ghenv.Component.AddRuntimeMessage(w, "You should first let Honeybee to fly...")
        return -1
        

if _shdSurfaces and _shdSurfaces[0]!=None:
    # add cleaning function
    result= main(_shdSurfaces, EPTransSchedule_, meshingSettings_, justBoundingBox_)
    
    if result != -1: HBContext = result
# ---------- end hb_epcontextsrf ----------
energysimpar = Honeybee_EnergySimulationPar(timestep=Slider(4, range=0..10), shadowCalcPar=shadowpar, solarDistribution="4")  # -> energySimPar; plug-in component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
epoutput = Honeybee_GenerateEPOutput(
    zoneEnergyUse=boolean_toggle_3,
    zoneGainsAndLosses=boolean_toggle_3,
    zoneComfortMetrics="False",
    surfaceTempAnalysis="False",
    timestep=item_selector_2)  # -> out, flatten(simulationOutputs); plug-in component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
boolean_toggle_4 = BooleanToggle(False)
labelzones = Honeybee_LabelZones(HBZones=flatten(setloadsandschedules.HBZones), attribute=honeybee_zone_attribute_list, textHeight=Slider(1, range=0..10))  # -> zoneTxtLabels, labelBasePts, brepTxtLabels, zoneWireFrames; plug-in component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
honeybee_surface_attribute_list = Honeybee_SurfaceAttributeList({"Name": "name", "Radiance Material": "RadMaterial", "EnergyPlus Construction": "EPConstruction", "Surface Type": "type", "Boundary Condition": "BC", "BC Object": "BCObject", "Sun Exposure": "sunExposure", "Wind Exposure": "windExposure", "Has Child Surface": "hasChild", "Is Child Surface": "isChild", "Is Planar": "isPlanar", "Srf Type Set By User": "srfTypeByUser", "Boundary Condition Set By User": "srfBCByUser", "Shade Material Name": "shadeMaterialName", "Shading Control Name": "shadingControlName", "Shcading Schedule Name": "shadingSchName"}, selected="Radiance Material")
file_path = FilePath("C:\Users\BT\Desktop\GBR_London.epw")
panel_18 = Panel(energysimpar)
runenergysimulation = Honeybee_RunEnergySimulation(
    epwFile=file_path,
    energySimPar=energysimpar,
    HBZones=flatten(setepzoneloads.HBZones),
    HBContext=flatten(hb_epcontextsrf),
    simulationOutputs=flatten(epoutput.simulationOutputs),
    writeIdf=boolean_toggle_4,
    runEnergyPlus=boolean_toggle_4,
    idfFileName="EP")  # -> out, idfFileAddress, resultFileAddress, eioFileAddress, rddFileAddress, htmlReport, studyFolder; plug-in component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
labelsurfaces = Honeybee_LabelZoneSurfaces(HBObjects=flatten(hb_epcontextsrf), attribute=honeybee_surface_attribute_list, textHeight=Slider(2, range=0..2))  # -> surfaceTxtLabels, labelBasePts, brepTxtLabels, surfaceWireFrames; plug-in component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
decomposebybc = Honeybee_DecomposeBasedOnBoundaryCondition(HBZone=setepzoneloads.HBZones)  # -> outdoors, surface, adiabatic, ground; plug-in component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
decomposebytype = Honeybee_DecomposeBasedOnType(HBZone=setepzoneloads.HBZones)  # -> walls, interiorWalls, airWalls, windows, interiorWindows, skylights, roofs, ceilings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; plug-in component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
readepresult = Honeybee_ReadEPResult(resultFileAddress=runenergysimulation.resultFileAddress)  # -> totalThermalLoad, thermalLoadBalance, cooling, heating, electricLight, electricEquip, fanElectric, pumpElectric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; plug-in component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
custom_preview_2 = CustomPreview(Geometry=decomposebybc.adiabatic, Material=ColourSwatch(SwatchColor=RGB(46, 209, 179)))
strnum = Ladybug_SeparateData(inputList=flatten(readepresult.totalThermalLoad))  # -> numbers, strings; plug-in component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
strnum_2 = Ladybug_SeparateData(inputList=flatten(readepresult.cooling))  # -> numbers, strings; plug-in component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
strnum_3 = Ladybug_SeparateData(inputList=flatten(readepresult.heating))  # -> numbers, strings; plug-in component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
custom_preview_3 = CustomPreview(Geometry=decomposebytype.walls, Material=ColourSwatch(SwatchColor=RGB(134, 148, 156)))
custom_preview_4 = CustomPreview(Geometry=decomposebytype.interiorWalls, Material=ColourSwatch(SwatchColor=RGB(75, 83, 87)))
custom_preview_5 = CustomPreview(Geometry=decomposebytype.windows, Material=ColourSwatch(SwatchColor=RGB(36, 167, 242)))
custom_preview_6 = CustomPreview(Geometry=decomposebytype.roofs, Material=ColourSwatch(SwatchColor=RGB(209, 65, 106)))
custom_preview_7 = CustomPreview(Geometry=decomposebytype.floors, Material=ColourSwatch(SwatchColor=RGB(44, 97, 87)))
mass_addition_3 = MassAddition(Input=strnum.numbers)  # -> Result, PartialResults
quick_graph_3 = QuickGraph(strnum_2.numbers, SortOrder=0)
quick_graph_4 = QuickGraph(strnum_3.numbers, SortOrder=0)
round = Round(Number=mass_addition_3.Result)  # -> Nearest, Floor, Ceiling
round_2 = Round(Number=strnum_2.numbers)  # -> Nearest, Floor, Ceiling
round_3 = Round(Number=strnum_3.numbers)  # -> Nearest, Floor, Ceiling
total_energy = Panel(round.Nearest)

# ----
# HB zones for Daylighting
# Ensure normal vectors points outward
# RAD MATERIALS
# SW facade
number_slider = Slider(9, range=1..12)
number_slider_2 = Slider(15, range=1..31)
file_path_2 = FilePath("C:\Users\BT\Desktop\GBR_London.epw")
analysisperiod = Ladybug_AnalysisPeriod(fromMonth=Slider(6, range=1..12), fromDay=number_slider_2, toMonth=number_slider, toDay=number_slider_2)  # -> out, analysisPeriod; plug-in component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
gencumulativeskymtx = Ladybug_GenCumulativeSkyMtx(epwFile=file_path_2, skyDensity="1", useOldRes=True, runIt=Toggle(False))  # -> out, cumulativeSkyMtx; plug-in component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
selectskymtx = Ladybug_selectSkyMtx(
    cumulativeSkyMtx=gencumulativeskymtx.cumulativeSkyMtx,
    analysisPeriod=analysisperiod.analysisPeriod,
    removeDiffuse=False,
    removeDirect=False)  # -> out, selectedSkyMtx; plug-in component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
boolean_toggle_5 = BooleanToggle(False)
legendpar = Ladybug_LegendParameters(
    lowBound=Slider(50, range=0..100),
    highBound=Slider(150, range=0..1000),
    numSegments=Slider(11, range=0..20),
    legendScale=Slider(0.1, range=0..1),
    fontSize=Slider(0.5, range=0..1))  # -> legendPar; plug-in component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
honeybee_zone_attribute_list_2 = Honeybee_ZoneAttributeList({"Name": "name", "Zone Program": "zoneProgram", "Zone Floor Area": "zoneFloorArea", "Zone Volume": "zoneVolume", "Building Program": "bldgProgram", "Is Conditioned": "isConditioned", "HVAC System Type": "HVACSystem", "Occupancy Schedule": "occupancySchedule", "Occupancy Activity Schedule": "occupancyActivitySch", "Heating SetPoint Schedule": "heatingSetPtSchedule"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}, selected="Name")
brep_14 = Brep(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)
solveadjc = Honeybee_SolveAdjacencies(HBZones=flatten(addhbglz_3), removeCurrentAdjc=False, findAdjc=Toggle(True))  # -> out, HBZonesWADJ; plug-in component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
plane = Plane(brep_14)
radiationanalysis = Ladybug_RadiationAnalysis(
    geometry=flatten(brep_14),
    context=flatten(brep_7),
    gridSize=Slider(0.5, range=0..2),
    disFromBase=Slider(0.01, range=0..1),
    selectedSkyMtx=flatten(selectskymtx.selectedSkyMtx),
    legendPar=flatten(legendpar),
    parallel=boolean_toggle_5,
    runIt=boolean_toggle_5)  # -> out, contextMesh, analysisMesh, testPts, testVec, port, radiationResult, radiationMesh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; plug-in component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
vector_display_2 = VectorDisplay(Anchor=plane, Vector=plane)
labelzones_2 = Honeybee_LabelZones(HBZones=flatten(solveadjc.HBZonesWADJ), attribute=honeybee_zone_attribute_list_2, textHeight=Slider(1, range=0..10))  # -> zoneTxtLabels, labelBasePts, brepTxtLabels, zoneWireFrames; plug-in component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
radmaterialsinfo_2 = Honeybee_RadianceMaterialsInfo(RADMaterial="Interior_Wall")  # -> RADMaterialStr; plug-in component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
radmaterialsinfo_3 = Honeybee_RadianceMaterialsInfo(RADMaterial="Context_Material")  # -> RADMaterialStr; plug-in component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
radglassmaterial = Honeybee_RadianceGlassMaterial(materialName="g", RTransmittance="0.8", GTransmittance="0.8", BTransmittance="0.8", refractiveIndex="1.52")  # -> avrgTrans, RADMaterial; plug-in component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
radmaterialsinfo_4 = Honeybee_RadianceMaterialsInfo(RADMaterial="Interior_Floor")  # -> RADMaterialStr; plug-in component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
radmaterialsinfo_5 = Honeybee_RadianceMaterialsInfo(RADMaterial="Interior_Ceiling")  # -> RADMaterialStr; plug-in component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
decomposebytype_2 = Honeybee_DecomposeBasedOnType(HBZone=solveadjc.HBZonesWADJ)  # -> walls, interiorWalls, airWalls, windows, interiorWindows, skylights, roofs, ceilings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; plug-in component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
setradmaterials = Honeybee_SetRadianceMaterials(
    HBObject=solveadjc.HBZonesWADJ,
    wallRADMaterial=radmaterialsinfo_2,
    windowRADMaterial=radglassmaterial.RADMaterial,
    roofRADMaterial=radmaterialsinfo_3,
    floorRADMaterial=radmaterialsinfo_4,
    ceilingRADMaterial=radmaterialsinfo_5)  # -> simplify(modifiedHBObject); plug-in component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
brep_15 = Brep([decomposebytype_2.ceilings, decomposebytype_2.roofs])
custom_preview_8 = CustomPreview(Geometry=decomposebytype_2.walls, Material=ColourSwatch(SwatchColor=RGB(75, 83, 87)))
custom_preview_9 = CustomPreview(Geometry=decomposebytype_2.interiorWalls, Material=ColourSwatch(SwatchColor=RGB(75, 83, 87)))
custom_preview_10 = CustomPreview(Geometry=decomposebytype_2.windows, Material=ColourSwatch(SwatchColor=RGB(36, 167, 242)))
custom_preview_11 = CustomPreview(Geometry=decomposebytype_2.roofs, Material=ColourSwatch(SwatchColor=RGB(209, 65, 106)))
custom_preview_12 = CustomPreview(Geometry=decomposebytype_2.exposedFloors, Material=ColourSwatch(SwatchColor=RGB(8, 20, 18)))
custom_preview_13 = CustomPreview(Geometry=decomposebytype_2.floors, Material=ColourSwatch(SwatchColor=RGB(44, 97, 87)))
custom_preview_14 = CustomPreview(Geometry=decomposebytype_2.ceilings, Material=ColourSwatch(SwatchColor=RGB(46, 209, 179)))
radparameters = Honeybee_RADParameters(
    quality=0,
    ab=Slider(2, range=0..10),
    ad=Slider(1000, range=0..1000),
    as=Slider(20, range=0..1000),
    ar=Slider(300, range=0..1000),
    aa=Slider(0.1, range=0..0.1))  # -> out, radParameters; plug-in component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
radmaterialsinfo_6 = Honeybee_RadianceMaterialsInfo(RADMaterial="Context_Material")  # -> RADMaterialStr; plug-in component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
move_3 = Move(Geometry=brep_15, Motion="{0,0,-0.4}")  # -> Geometry, Transform
honeybee_surface_attribute_list_2 = Honeybee_SurfaceAttributeList({"Name": "name", "Radiance Material": "RadMaterial", "EnergyPlus Construction": "EPConstruction", "Surface Type": "type", "Boundary Condition": "BC", "BC Object": "BCObject", "Sun Exposure": "sunExposure", "Wind Exposure": "windExposure", "Has Child Surface": "hasChild", "Is Child Surface": "isChild", "Is Planar": "isPlanar", "Srf Type Set By User": "srfTypeByUser", "Boundary Condition Set By User": "srfBCByUser", "Shade Material Name": "shadeMaterialName", "Shading Control Name": "shadingControlName", "Shcading Schedule Name": "shadingSchName"}, selected="Name")
genhbzonetestpts = Honeybee_GenerateZoneTestPoints(HBZone=setradmaterials, gridSize=Slider(0.5, range=0..2), distBaseSrf=Slider(0.8, range=0..1), moveTestMesh=True)  # -> out, simplify(testPoints), simplify(ptsVectors), simplify(facesArea), simplify(mesh); plug-in component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
radmaterialsinfo_7 = Honeybee_RadianceMaterialsInfo(RADMaterial="Interior_Ceiling")  # -> RADMaterialStr; plug-in component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
item_selector_3 = ItemSelector(setradmaterials, {"Closed Brep", "Closed Brep", "Closed Brep", "Closed Brep", "Closed Brep"}, selected="Closed Brep")
createhbsrfs_6 = Honeybee_createHBSrfs(geometry=move_3.Geometry, srfName="Ceiling", RADMaterial=radmaterialsinfo_7)  # -> out, simplify(HBSurface); plug-in component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
hb_epcontextsrf_2 = HoneybeeEPContextSurfaces(shdSurfaces=flatten([brep_7, createhbsrfs_6.HBSurface]), RADMaterial=radmaterialsinfo_6)  # -> HBContext; inputs shdSurfaces: list of Brep, justBoundingBox: Boolean; same code as hb_epcontextsrf
daylighfactorsimulation = Honeybee_DaylightFactorSimulation(
    testPoints=genhbzonetestpts.testPoints,
    ptsVectors=genhbzonetestpts.ptsVectors,
    testMesh=genhbzonetestpts.mesh,
    uniformSky=False,
    radParameters=radparameters.radParameters)  # -> analysisRecipe; plug-in component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
labelsurfaces_2 = Honeybee_LabelZoneSurfaces(HBObjects=flatten(item_selector_3), attribute=honeybee_surface_attribute_list_2, windows=Toggle(False), textHeight="1")  # -> surfaceTxtLabels, labelBasePts, brepTxtLabels, surfaceWireFrames; disabled; plug-in component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
boolean_toggle_6 = BooleanToggle(False)
brep_16 = Brep([setradmaterials, hb_epcontextsrf_2, createhbsrfs_6.HBSurface])
custom_preview_15 = CustomPreview(Geometry=createhbsrfs_6.HBSurface, Material=ColourSwatch(SwatchColor=RGB(46, 209, 179)))
rundaylightanalysis = Honeybee_RunDaylightSimulation(
    HBObjects=flatten(brep_16),
    analysisRecipe=daylighfactorsimulation,
    writeRad=boolean_toggle_6,
    runRad=boolean_toggle_6,
    numOfCPUs=Slider(7, range=0..10),
    overwriteResults=True)  # -> out, analysisType, resultsUnit, results, testPts, resultFiles, radGeoFile, studyFolder, done; plug-in component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
point = Point(Point(81.13886995, 182.3423829, 0.6255793037))
legendpar_2 = Ladybug_LegendParameters(lowBound=Slider(0, range=0..100), highBound=Slider(20, range=0..100), legendLocation=point)  # -> legendPar; plug-in component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
number_3 = Number(Tree({0}: [8.57, 10.21, 13.25, 11.93, 6.83, 3.64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], {1}: [5.61, 1.68, 0.53, 0.3, 0.2, 0.15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], {2}: [6.75, 2.07, 0.88, 0.35, 0.21, 0.15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], {3}: [9.53, 3.64, 1.7, 0.97, 0.62, 0.39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], {4}: [11.01, 5.65, 2.59, 1.46, 0.98, 0.65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]))
number_4 = Number(rundaylightanalysis.results)
average = Average(Input=number_3)  # -> reverse(flatten(ArithmeticMean))
average_2 = Average(Input=number_4)  # -> reverse(flatten(ArithmeticMean))
recolormesh = Ladybug_RecolorMesh(
    analysisResult=rundaylightanalysis.results,
    inputMesh=genhbzonetestpts.mesh,
    legendPar=legendpar_2,
    analysisTitle=" ",
    legendTitle="Daylight factor")  # -> out, newMesh, newLegend, legendBasePt, meshColors, legendColors; plug-in component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
average_3 = Average(Input=average)  # -> reverse(flatten(ArithmeticMean))
panel_19 = Panel(average)
average_4 = Average(Input=average_2)  # -> reverse(flatten(ArithmeticMean))
subtraction_2 = Subtraction(A=average, B=average_2)
panel_20 = Panel(average_2)
quick_graph_5 = QuickGraph(panel_19, SortOrder=0)
quick_graph_6 = QuickGraph(panel_20, SortOrder=0)
panel_21 = Panel(average_3)
panel_22 = Panel(average_4)
ghpython_script_5 = GhPythonScript(x=average_4)  # -> out, a
# ---------- ghpython_script_5: Python ----------
__author__ = "BT"
__version__ = "2020.03.06"

import rhinoscriptsyntax as rs
a=round(x,4)
# ---------- end ghpython_script_5 ----------
ghpython_script_6 = GhPythonScript(x=average, y=average_2)  # -> out, a
# ---------- ghpython_script_6: Python ----------
__author__ = "BT"
__version__ = "2020.03.06"

import rhinoscriptsyntax as rs
a=round((x-y)/x*100,4)
# ---------- end ghpython_script_6 ----------
quick_graph_7 = QuickGraph(ghpython_script_6.a, SortOrder=0)

number_5 = Number(panel_21)
number_6 = Number(total_energy)
panel_23 = Panel([number_6, number_5])
