# Grasshopper definition CW section_3.1.gh (Grasshopper 1.0.7)
# plug-ins: Human, Octopus

honeybee = Honeybee_Honeybee()  # -> out; plug-in component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
ladybug = Ladybug_Ladybug()  # -> out; plug-in component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

# ----
# Variable panel count
# Shading Depth
# Window ratio x
# Center/Left/Right
# Window ratio y
i1_a = Slider(-0.2, range=-5..5)
i1_b = Slider(2, range=1..15)
i2_b = Slider(0.3, range=0.1..1.1)
i3_a = Slider(0.03, range=0..0.25)
i3_b = Slider(0.2, range=0.1..1.1)
i2_b_2 = Slider(0.2, range=0.1..1.1)
i2_a = Slider(0.2, range=-0.4..0.4)
i2_a_2 = Slider(0.2, range=-0.4..0.4)
clr_012 = Slider(0, range=0..2)

panel = Panel("""4
3
2
1
0""")
number = Number(panel)
number_2 = Number("14")
ghpython_script = GhPythonScript(a=i1_a, b=i1_b, max=number_2, x=number)  # -> out, y
# ---------- ghpython_script: Python ----------
__author__ = "BT"
__version__ = "2020.03.08"

import rhinoscriptsyntax as rs
c=abs(a*x+b)
if c>max:
    y=max
elif c<1:
    y=1
else:
    y=round(c,0)
# ---------- end ghpython_script ----------
ghpython_script_2 = GhPythonScript(a=i2_a, b=i2_b, x=number)  # -> out, y
# ---------- ghpython_script_2: Python ----------
__author__ = "BT"
__version__ = "2020.03.08"

import rhinoscriptsyntax as rs
y=abs(a*x+b)
if y>=1.0:
    y=0.99
elif y<=0.1:
    y=0.1
# ---------- end ghpython_script_2 ----------
ghpython_script_3 = GhPythonScript(a=i3_a, b=i3_b, x=number)  # -> out, y
# ---------- ghpython_script_3: Python ----------
__author__ = "BT"
__version__ = "2020.03.08"

import rhinoscriptsyntax as rs
y=a*x+b
if y>1.0:
    y=1
# ---------- end ghpython_script_3 ----------
ghpython_script_4 = GhPythonScript(a=i2_a_2, b=i2_b_2, x=number)  # -> out, y; same code as ghpython_script_2
panel_2 = Panel(ghpython_script.y)
# Inputs to grasshoppers geometry nodes
series = Series(Start=Slider(1, range=0..100), Step=Slider(0, range=0..1), Count=panel_2)

# ----
# Input 1
# Variable panel count
# Input 3
# Shading Depth
# Input 2
# Window ratio x
# Input 4
# Center/Left/Right
# Input 5
# Window ratio y
panel_3 = Panel(clr_012)
panel_4 = Panel(ghpython_script_2.y)
panel_5 = Panel(ghpython_script_4.y)
panel_6 = Panel(ghpython_script_3.y)
panel_7 = Panel(series)

# ----
# 100% Glazing to optimize
brep = Brep([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])

# ----
# Param 1 & 5 - Variable panel count on each floor with variable width for each panel
mass_addition = MassAddition(Input=panel_7)  # -> Result, PartialResults
deconstruct_domain² = DeconstructDomain²(Domain=brep)  # -> UComponent, graft(VComponent)
construct_domain = ConstructDomain(DomainStart=0, DomainEnd=mass_addition.Result)
remap_numbers = RemapNumbers(Value=mass_addition.PartialResults, Source=construct_domain, Target=deconstruct_domain².UComponent)  # -> Mapped, flatten(Clipped)
deconstruct_domain = DeconstructDomain(Domain=deconstruct_domain².UComponent)  # -> graft(Start), graft(End)
cull_index = CullIndex(List=remap_numbers.Mapped, Indices="-1", Wrap=True)
insert_items = InsertItems(List=cull_index, Item=deconstruct_domain.Start, Indices="0", Wrap=True)
construct_domain_2 = ConstructDomain(DomainStart=insert_items, DomainEnd=remap_numbers.Mapped)
construct_domain² = ConstructDomain²(DomainU=construct_domain_2, DomainV=deconstruct_domain².VComponent)
# Panels
isotrim = Isotrim(Surface=brep, Domain=graft(construct_domain²))  # -> simplify(Surface)

panel_8 = Panel(insert_items)
boolean_toggle = BooleanToggle(True)
clean_tree = CleanTree(RemoveNulls=boolean_toggle, RemoveInvalid=True, RemoveEmpty=boolean_toggle, Tree=isotrim)
trim_tree = TrimTree(Tree=clean_tree, Depth=1)

deconstruct_brep = DeconstructBrep(Brep=trim_tree)  # -> Faces, Edges, Vertices
trim_tree_2 = TrimTree(Tree=deconstruct_brep.Faces, Depth=1)
vector = Vector(trim_tree_2)
list_item = ListItem(List=vector, Index=0, Wrap=True)
# Param 3 - Variable overhang and fins depth on each floor
trim_tree_3 = TrimTree(Tree=deconstruct_brep.Edges, Depth=1)
multiplication = Multiplication(A=list_item, B=graft(panel_6))
vector_display = VectorDisplay(Anchor=deconstruct_brep.Vertices, Vector=multiplication)
line = Line(trim_tree_3)
deconstruct_vector = DeconstructVector(Vector=multiplication)  # -> XComponent, YComponent, ZComponent
vector_xyz = VectorXYZ(XComponent=deconstruct_vector.XComponent, YComponent=deconstruct_vector.YComponent, ZComponent=0)  # -> Vector, simplify(flatten(Length))
# Shading
extrude = Extrude(Base=line, Direction=vector_xyz.Vector)
panel_9 = Panel(vector_xyz.Length)

list_item_2 = ListItem(List=deconstruct_brep.Edges, Index=Slider(1, range=0..3), Wrap=True)
list_item_3 = ListItem(List=deconstruct_brep.Edges, Index=Slider(3, range=0..3), Wrap=True)
# Left
end_points = EndPoints(Curve=list_item_2)  # -> Start, End
# Right
end_points_2 = EndPoints(Curve=list_item_3)  # -> Start, End
trim_tree_4 = TrimTree(Tree=end_points.Start, Depth=1)
trim_tree_5 = TrimTree(Tree=end_points_2.End, Depth=1)
number_3 = Number(graft(panel_4))
# Placeholder
brep_2 = Brep(Tree({0;0}: [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], {0;1}: [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], {0;2}: [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], {0;3}: [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], {0;4}: [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]))
custom_preview = CustomPreview(Geometry=extrude, Material=ColourSwatch(SwatchColor=RGB(66, 69, 63)))
brep_3 = Brep([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])
# Adiabatic wall
brep_4 = Brep(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)
# Adiabatic floor
brep_5 = Brep(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)
# Roof
brep_6 = Brep(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)
# Wall with fixed glazing
brep_7 = Brep(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)
brep_8 = Brep([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])
brep_9 = Brep([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])
brep_10 = Brep([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])

# ----
# EP Simplified Context
# Surrounding buildings
# + ground plane
brep_11 = Brep([brep_9, extrude])

# ----
# Daylight Original Context
# Surrounding buildings
# + ground plane
brep_12 = Brep([brep_10, extrude])

createhbsrfs = Honeybee_createHBSrfs(geometry=brep_8, srfName="Wall_FR")  # -> out, simplify(flatten(HBSurface)); plug-in component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
createhbsrfs_2 = Honeybee_createHBSrfs(geometry=brep_5, srfName="Floor", EPBC="Adiabatic")  # -> out, simplify(HBSurface); plug-in component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
createhbsrfs_3 = Honeybee_createHBSrfs(geometry=brep_6, srfName="Roof", EPBC="Outdoors")  # -> out, simplify(HBSurface); plug-in component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
createhbsrfs_4 = Honeybee_createHBSrfs(geometry=brep_7, srfName="Wall_L")  # -> out, simplify(HBSurface); plug-in component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
createhbsrfs_5 = Honeybee_createHBSrfs(geometry=brep_4, srfName="Adiabatic wall", EPBC="Adiabatic")  # -> out, simplify(HBSurface); plug-in component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
# Fixed Glazing
move = Move(Geometry=brep_3, Motion="{0,0,0.01}")  # -> Geometry, Transform
# E+ HB zone
createhbzones = Honeybee_createHBZones(
    name="HB building",
    HBSurfaces=flatten([createhbsrfs_5.HBSurface, createhbsrfs_2.HBSurface, createhbsrfs_3.HBSurface, createhbsrfs_4.HBSurface, createhbsrfs.HBSurface]),
    isConditioned=True)  # -> out, HBZone; plug-in component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
# Split BREP by floors
split2floors = Honeybee_SplitBuildingMass2Floors(bldgMasses=createhbzones.HBZone, bldgsFlr2FlrHeights=["1@3.55", "2@3.15", "1@3.525"], runIt=Toggle(True))  # -> out, flatten(splitBldgFloors); plug-in component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
panel_10 = Panel("""Zone 1
Zone 2
Zone 3
Zone 4
Zone 5""")
# Create HB zones with names
mass2zone = Honeybee_Masses2Zones(zoneMasses=flatten(split2floors.splitBldgFloors), zoneNames=panel_10, maxRoofAngle=30, createHBZones=Toggle(True))  # -> out, HBZones; plug-in component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
honeybee_bldgprograms = Honeybee_bldgPrograms({"Office": 0, "Retail": 1, "MidriseApartment": 2, "PrimarySchool": 3, "SecondarySchool": 4, "SmallHotel": 5, "LargeHotel": 6, "Hospital": 7, "Outpatient": 8, "Warehouse": 9, "SuperMarket": 10, "FullServiceRestaurant": 11, "QuickServiceRestaurant": 12}, selected="Office")
honeybee_surface_attribute_list = Honeybee_SurfaceAttributeList({"Name": "name", "Radiance Material": "RadMaterial", "EnergyPlus Construction": "EPConstruction", "Surface Type": "type", "Boundary Condition": "BC", "BC Object": "BCObject", "Sun Exposure": "sunExposure", "Wind Exposure": "windExposure", "Has Child Surface": "hasChild", "Is Child Surface": "isChild", "Is Planar": "isPlanar", "Srf Type Set By User": "srfTypeByUser", "Boundary Condition Set By User": "srfBCByUser", "Shade Material Name": "shadeMaterialName", "Shading Control Name": "shadingControlName", "Shcading Schedule Name": "shadingSchName"}, selected="EnergyPlus Construction")
listzoneprograms = Honeybee_ListZonePrograms(bldgProgram=honeybee_bldgprograms)  # -> OfficeZonePrograms; plug-in component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
item_selector = ItemSelector(
    listzoneprograms,
    {"Office::BreakRoom", "Office::Storage", "Office::Vending", "Office::OpenOffice", "Office::ClosedOffice", "Office::Conference", "Office::PrintRoom", "Office::Restroom", "Office::Elec/MechRoom", "Office::IT_Room", "Office::Stair", "Office::Corridor", "Office::Lobby"}, selected="Office::OpenOffice")
division = Division(A=Slider(5, range=0..10), B=Slider(12, range=0..100))
# RAD MATERIALS
panel_11 = Panel("Interior_Ceiling")
radmaterialsinfo = Honeybee_RadianceMaterialsInfo(RADMaterial="Interior_Wall")  # -> RADMaterialStr; plug-in component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
radmaterialsinfo_2 = Honeybee_RadianceMaterialsInfo(RADMaterial="Context_Material")  # -> RADMaterialStr; plug-in component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
radglassmaterial = Honeybee_RadianceGlassMaterial(materialName="g", RTransmittance="0.8", GTransmittance="0.8", BTransmittance="0.8", refractiveIndex="1.52")  # -> avrgTrans, RADMaterial; plug-in component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
radmaterialsinfo_3 = Honeybee_RadianceMaterialsInfo(RADMaterial="Interior_Floor")  # -> RADMaterialStr; plug-in component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
radmaterialsinfo_4 = Honeybee_RadianceMaterialsInfo(RADMaterial=panel_11)  # -> RADMaterialStr; plug-in component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
shadowpar = Honeybee_ShadowPar(frequency=Slider(40, range=0..100), maximumFigure=Slider(1000, range=0..100000))  # -> shadowPar; plug-in component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
boolean_toggle_2 = BooleanToggle(True)
item_selector_2 = ItemSelector({"hourly", "daily", "monthly", "annual"}, selected="hourly")
hb_epcontextsrf = HoneybeeEPContextSurfaces(shdSurfaces=flatten(brep_11))  # -> HBContext; inputs shdSurfaces: list of Brep, justBoundingBox: Boolean
# ---------- hb_epcontextsrf: Python ----------
"""
prepare shading/context geometries

    Args:
        northVectorOrRotation: A vector that shows North or a number that shows
                               the rotation of the North from the Y axis
        bldgMasses: List of closed Breps as thermal zones.
    Returns:
        report: ...
        thermalZones: Thermal zone's geometries for visualiza
"""

ghenv.Component.Name = 'Honeybee EP context Surfaces'
ghenv.Component.NickName = 'HB_EPContextSrf'
ghenv.Component.Message = 'VER 0.0.65\nJAN_01_2020'
ghenv.Component.IconDisplayMode = ghenv.Component.IconDisplayMode.application
ghenv.Component.Category = "Honeybee"
ghenv.Component.SubCategory = "10 | Energy | Energy"
#compatibleHBVersion = VER 0.0.57\nNOV_04_2016
#compatibleLBVersion = VER 0.0.59\nFEB_01_2015
ghenv.Component.AdditionalHelpFromDocStrings = "2"

import rhinoscriptsyntax as rs
import Rhino as rc
import scriptcontext as sc
import os
import System
import Grasshopper.Kernel as gh
import uuid

tolerance = sc.doc.ModelAbsoluteTolerance
import math


def main(shdSurfaces, EPTransSchedule, meshingSettings, justBoundingBox):
    
    # import the classes
    if sc.sticky.has_key('honeybee_release'):

        try:
            if not sc.sticky['honeybee_release'].isCompatible(ghenv.Component): return -1
            if sc.sticky['honeybee_release'].isInputMissing(ghenv.Component): return -1
        except:
            warning = "You need a newer version of Honeybee to use this compoent." + \
            " Use updateHoneybee component to update userObjects.\n" + \
            "If you have already updated userObjects drag Honeybee_Honeybee component " + \
            "into canvas and try again."
            w = gh.GH_RuntimeMessageLevel.Warning
            ghenv.Component.AddRuntimeMessage(w, warning)
            return -1
        
        # don't customize this part
        hb_EPSrf = sc.sticky["honeybee_EPSurface"]
        hb_EPSHDSurface = sc.sticky["honeybee_EPShdSurface"]
        hb_RADMaterialAUX = sc.sticky["honeybee_RADMaterialAUX"]
        hb_EPObjectsAux = sc.sticky["honeybee_EPObjectsAUX"]()
        HBScheduleList = sc.sticky["honeybee_ScheduleLib"].keys()

        ########################################################################
        #----------------------------------------------------------------------#
        shdBreps = []
        # create bounding box of shading geometries
        if justBoundingBox:
            for brep in shdSurfaces:
                if brep.Faces.Count>1 or not brep.Faces[0].IsPlanar(sc.doc.ModelAbsoluteTolerance):
                    shdBreps.append(brep.GetBoundingBox(True).ToBrep())
                else:
                    shdBreps.append(brep)
        else:
            shdBreps = shdSurfaces
        
        shadingClasses = []
        shadingMeshPreview = []
        
        if meshingSettings == None:
            mp = rc.Geometry.MeshingParameters.Minimal
            mp.SimplePlanes = True
        else:
            mp = meshingSettings
        
        def getRadMaterialName(radMaterial):
            nameStr = radMaterial.split(" ")[2]
            name =  nameStr.split("\n")[0]
            return name
        
        for brepCount, brep in enumerate(shdBreps):
            if brep != None:
                isPlanar = True
                # check planarity
                for face in brep.Faces:
                    if not face.IsPlanar(tolerance):
                        isPlanar = False
                        break
                
                shadingBreps = []
                if not isPlanar:
                    meshArray = rc.Geometry.Mesh.CreateFromBrep(brep, mp)
                    for mesh in meshArray:
                        for meshFace in range(mesh.Faces.Count):
                            vertices = list(mesh.Faces.GetFaceVertices(meshFace))[1:]
                            vertices = vertices + [sc.doc.ModelAbsoluteTolerance]
                            # create the brep from mesh
                            shdBrep = rc.Geometry.Brep.CreateFromCornerPoints(*vertices)
                            shadingBreps.append(shdBrep)
                else:
                    for face in brep.Faces:
                        shadingBreps.append(face.DuplicateFace(False))
                
                for faceCount, shdBrep in enumerate(shadingBreps):
                        thisShading = hb_EPSHDSurface(shdBrep, 1000*brepCount + faceCount, 'shdSrf_' + `brepCount` + '_' + `faceCount` + "_" + str(uuid.uuid4()))
                        
                        # add transmittance schedule if any
                        if EPTransSchedule!=None:
                            schedule= EPTransSchedule.upper()
                            if schedule!=None and not schedule.lower().endswith(".csv") and schedule not in HBScheduleList:
                                msg = "Cannot find " + schedule + " in Honeybee schedule library."
                                print msg
                                ghenv.Component.AddRuntimeMessage(gh.GH_RuntimeMessageLevel.Warning, msg)
                                return -1
                            elif schedule!=None and schedule.lower().endswith(".csv"):
                                # check if csv file is existed
                                if not os.path.isfile(schedule):
                                    msg = "Cannot find the shchedule file: " + schedule
                                    print msg
                                    ghenv.Component.AddRuntimeMessage(gh.GH_RuntimeMessageLevel.Warning, msg)
                                    return -1
                            
                            thisShading.TransmittanceSCH = schedule
                        
                        # add the Rad Material if any
                        if RADMaterial!=None:
                            # if it is just the name of the material make sure it is already defined
                            if len(RADMaterial.split(" ")) == 1:
                                # if the material is not in the library add it to the library
                                if not hb_RADMaterialAUX.isMatrialExistInLibrary(RADMaterial):
                                    warningMsg = "Can't find " + RADMaterial + " in RAD Material Library.\n" + \
                                                "Add the material to the library and try again."
                                    ghenv.Component.AddRuntimeMessage(gh.GH_RuntimeMessageLevel.Warning, warningMsg)
                                    return
                                
                                try:
                                    thisShading.setRADMaterial(RADMaterial)
                                except Exception, e:
                                    print e
                                    warningMsg = "You are using an old version of Honeybee_Honeybee! Update your files and try again."
                                    print warningMsg
                                    ghenv.Component.AddRuntimeMessage(gh.GH_RuntimeMessageLevel.Warning, warningMsg)
                                    return
                                
                                addedToLib = True
                            else:
                                
                                # try to add the material to the library
                                addedToLib, thisShading.RadMaterial = hb_RADMaterialAUX.analyseRadMaterials(RADMaterial, True)
                                
                            if addedToLib==False:
                                warningMsg = "Failed to add " + RADMaterial + " to the Library."
                                ghenv.Component.AddRuntimeMessage(gh.GH_RuntimeMessageLevel.Warning, warningMsg)
                                return
                        
                        # add shading to the list
                        shadingClasses.append(thisShading)
                
        # add to the hive
        hb_hive = sc.sticky["honeybee_Hive"]()
        HBContext  = hb_hive.addToHoneybeeHive(shadingClasses, ghenv.Component)
        return HBContext
        ################################################################################################
    else:
        print "You should first let Honeybee to fly..."
        w = gh.GH_RuntimeMessageLevel.Warning
        ghenv.Component.AddRuntimeMessage(w, "You should first let Honeybee to fly...")
        return -1
        

if _shdSurfaces and _shdSurfaces[0]!=None:
    # add cleaning function
    result= main(_shdSurfaces, EPTransSchedule_, meshingSettings_, justBoundingBox_)
    
    if result != -1: HBContext = result
# ---------- end hb_epcontextsrf ----------
energysimpar = Honeybee_EnergySimulationPar(timestep=Slider(2, range=0..10), shadowCalcPar=shadowpar, solarDistribution=Slider(1, range=0..10))  # -> energySimPar; plug-in component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
searchepschlibrary = Honeybee_SearchEPScheduleLibrary()  # -> selSchedules; plug-in component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
epoutput = Honeybee_GenerateEPOutput(
    zoneEnergyUse=boolean_toggle_2,
    zoneGainsAndLosses=boolean_toggle_2,
    zoneComfortMetrics=boolean_toggle_2,
    surfaceTempAnalysis="False",
    timestep=item_selector_2)  # -> out, flatten(simulationOutputs); plug-in component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
radparameters = Honeybee_RADParameters(
    quality=0,
    ab=Slider(2, range=0..10),
    ad=Slider(650, range=0..1000),
    as=Slider(50, range=0..1000),
    ar=Slider(180, range=0..1000),
    aa=Slider(0.1, range=0..0.1))  # -> out, radParameters; plug-in component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
boolean_toggle_3 = BooleanToggle(True)
radmaterialsinfo_5 = Honeybee_RadianceMaterialsInfo(RADMaterial="Context_Material")  # -> RADMaterialStr; plug-in component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
radmaterialsinfo_6 = Honeybee_RadianceMaterialsInfo(RADMaterial="Interior_Ceiling")  # -> RADMaterialStr; plug-in component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
file_path = FilePath("C:\Users\BT\Desktop\GBR_London.epw")
point = Point(Point(81.13886995, 182.3423829, 0.6255793037))
grid_size_and_df_simulation_times = Panel("""0.3 44sek
0.4 33sek
0.5 24sek
0.6 18sek""")
legendpar = Ladybug_LegendParameters(lowBound=Slider(3, range=0..100), highBound=Slider(20, range=0..100), legendLocation=point)  # -> legendPar; plug-in component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
panel_12 = Panel("""1
2
3
4
5""")
octopus = Octopus(
    OctopusData_gene=[i2_b_2, clr_012, i2_a_2, i3_b, i3_a, i1_b, i1_a, i2_a, i2_b],
    OctopusData_obj=[total_energy, df_above_3])
_0_5_grid_size = Number([34.501689, 25.168919, 20.565878, 17.208615, 14.84375, 13.048986, 11.402027, 9.987331, 8.762669, 7.77027])  # disabled
_0_6_grid_size = Number([34.641119, 25.395377, 20.13382, 17.244526, 15.206813, 13.108273, 11.192214, 9.671533, 8.941606, 8.059611])  # disabled
panel_13 = Panel(_0_6_grid_size)  # disabled
_0_4_grid_size = Number([34.613846, 25.170068, 20.181406, 17.060157, 14.872616, 12.698413, 11.244498, 9.910631, 8.776844, 7.736428])  # disabled
_0_3_grid_size = Number([34.456752, 24.840914, 19.813025, 16.576322, 14.235211, 12.153351, 10.582135, 9.301595, 8.083903, 7.039045])  # disabled
entwine = Entwine(Branch00=_0_3_grid_size, Branch01=_0_4_grid_size, Branch02=_0_5_grid_size, Branch03=_0_6_grid_size, FlattenInputs=True)  # disabled
panel_14 = Panel(panel_12)
flip_matrix = FlipMatrix(Data=entwine)  # disabled
number_slider = Slider(100, range=0..100)  # disabled
number_slider_2 = Slider(100, range=0..100)  # disabled
subtraction = Subtraction(A=_0_5_grid_size, B=_0_6_grid_size)  # disabled
subtraction_2 = Subtraction(A=_0_4_grid_size, B=_0_6_grid_size)  # disabled
minimum = Minimum(A=_0_4_grid_size, B=_0_6_grid_size)  # disabled
panel_15 = Panel(flip_matrix)  # disabled
division_2 = Division(A=subtraction_2, B=minimum)  # disabled
multiplication_2 = Multiplication(A=number_slider_2, B=division_2)  # -> flatten(Result); disabled

# ----
# Param 2 - Variable window ratio on each floor
# Windows
surface = Surface(trim_tree)
panel_16 = Panel(panel_5)
# Center
area = Area(Geometry=surface)  # -> Area, Centroid
construct_domain_3 = ConstructDomain(DomainStart=0, DomainEnd=area.Area)
remap_numbers_2 = RemapNumbers(Value=graft(panel_16), Source=construct_domain_3, Target=construct_domain_3)  # -> Mapped, Clipped

stream_filter = StreamFilter(Gate=panel_3, Stream0=area.Centroid, Stream1=trim_tree_4, Stream2=trim_tree_5)

plane_normal = PlaneNormal(Origin=stream_filter, ZAxis=vector)
scale_nu = ScaleNU(Geometry=surface, Plane=plane_normal, ScaleX=remap_numbers_2.Mapped, ScaleY=number_3, ScaleZ=1)  # -> Geometry, Transform

# ----
# Parametric glazing
brep_13 = Brep(scale_nu.Geometry)

deconstruct_brep_2 = DeconstructBrep(Brep=brep_13)  # -> Faces, Edges, Vertices
is_planar = IsPlanar(Surface=deconstruct_brep_2.Faces, Interior=True)  # -> Planar, Plane
# Front and right wall
scale_nu_2 = ScaleNU(Geometry=deconstruct_brep_2.Faces, Plane=is_planar.Plane, ScaleX=1, ScaleY=Slider(1, range=0.1..1), ScaleZ=1)  # -> Geometry, Transform
# Parametric glazing
move_2 = Move(Geometry=flatten(scale_nu_2.Geometry), Motion="{0,0,0.01}")  # -> Geometry, Transform
# add glazing to HB zone
addhbglz = Honeybee_addHBGlz(HBObj=createhbzones.HBZone, childSurfaces=flatten([move_2.Geometry, move.Geometry]))  # -> HBObjWGLZ; plug-in component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
# Add both Fixed Glazing
# and surface with variable glazing
addhbglz_2 = Honeybee_addHBGlz(HBObj=mass2zone.HBZones, childSurfaces=flatten([move.Geometry, move_2.Geometry]))  # -> HBObjWGLZ; plug-in component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
# HB zones for Daylighting
solveadjc = Honeybee_SolveAdjacencies(HBZones=flatten(addhbglz_2), removeCurrentAdjc=False, findAdjc=Toggle(True))  # -> out, HBZonesWADJ; plug-in component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
decomposebytype = Honeybee_DecomposeBasedOnType(HBZone=solveadjc.HBZonesWADJ)  # -> walls, interiorWalls, airWalls, windows, interiorWindows, skylights, roofs, ceilings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; plug-in component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
setradmaterials = Honeybee_SetRadianceMaterials(
    HBObject=solveadjc.HBZonesWADJ,
    wallRADMaterial=radmaterialsinfo,
    windowRADMaterial=radglassmaterial.RADMaterial,
    roofRADMaterial=radmaterialsinfo_2,
    floorRADMaterial=radmaterialsinfo_3,
    ceilingRADMaterial=radmaterialsinfo_4)  # -> simplify(modifiedHBObject); plug-in component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
brep_14 = Brep([decomposebytype.ceilings, decomposebytype.roofs])
custom_preview_2 = CustomPreview(Geometry=decomposebytype.walls, Material=ColourSwatch(SwatchColor=RGB(75, 83, 87)))
custom_preview_3 = CustomPreview(Geometry=decomposebytype.interiorWalls, Material=ColourSwatch(SwatchColor=RGB(75, 83, 87)))
custom_preview_4 = CustomPreview(Geometry=decomposebytype.windows, Material=ColourSwatch(SwatchColor=RGB(36, 167, 242)))
custom_preview_5 = CustomPreview(Geometry=decomposebytype.roofs, Material=ColourSwatch(SwatchColor=RGB(209, 65, 106)))
custom_preview_6 = CustomPreview(Geometry=decomposebytype.floors, Material=ColourSwatch(SwatchColor=RGB(44, 97, 87)))
custom_preview_7 = CustomPreview(Geometry=decomposebytype.ceilings, Material=ColourSwatch(SwatchColor=RGB(46, 209, 179)))
custom_preview_8 = CustomPreview(Geometry=decomposebytype.exposedFloors, Material=ColourSwatch(SwatchColor=RGB(8, 20, 18)))
move_3 = Move(Geometry=brep_14, Motion="{0,0,-0.4}")  # -> Geometry, Transform
genhbzonetestpts = Honeybee_GenerateZoneTestPoints(HBZone=setradmaterials, gridSize=Slider(0.5, range=0..2), distBaseSrf=Slider(0.8, range=0..1), moveTestMesh=True)  # -> out, simplify(testPoints), simplify(ptsVectors), simplify(facesArea), simplify(mesh); plug-in component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
createhbsrfs_6 = Honeybee_createHBSrfs(geometry=move_3.Geometry, srfName="Ceiling", RADMaterial=radmaterialsinfo_6)  # -> out, simplify(HBSurface); plug-in component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
hb_epcontextsrf_2 = HoneybeeEPContextSurfaces(shdSurfaces=flatten([brep_12, createhbsrfs_6.HBSurface]), RADMaterial=radmaterialsinfo_5)  # -> HBContext; inputs shdSurfaces: list of Brep, justBoundingBox: Boolean; same code as hb_epcontextsrf
daylighfactorsimulation = Honeybee_DaylightFactorSimulation(
    testPoints=genhbzonetestpts.testPoints,
    ptsVectors=genhbzonetestpts.ptsVectors,
    testMesh=genhbzonetestpts.mesh,
    uniformSky=False,
    radParameters=radparameters.radParameters)  # -> analysisRecipe; plug-in component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
brep_15 = Brep([setradmaterials, hb_epcontextsrf_2, createhbsrfs_6.HBSurface])
rundaylightanalysis = Honeybee_RunDaylightSimulation(
    HBObjects=flatten(brep_15),
    analysisRecipe=daylighfactorsimulation,
    writeRad=Toggle(True),
    runRad=Slider(2, range=0..10),
    numOfCPUs=Slider(8, range=0..10),
    overwriteResults=True)  # -> out, analysisType, resultsUnit, DF_values, testPts, DF_files, radGeoFile, studyFolder, done; plug-in component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
number_4 = Number(rundaylightanalysis.DF_values)  # disabled
average = Average(Input=number_4)  # -> reverse(flatten(ArithmeticMean)); disabled
larger_than = LargerThan(FirstNumber=flatten(rundaylightanalysis.DF_values), SecondNumber=graft(panel_12))  # -> LargerThan, OrEqualTo
recolormesh = Ladybug_RecolorMesh(
    analysisResult=rundaylightanalysis.DF_values,
    inputMesh=genhbzonetestpts.mesh,
    legendPar=legendpar,
    analysisTitle=" ",
    legendTitle="Daylight factor [%]")  # -> out, newMesh, newLegend, legendBasePt, meshColors, legendColors; plug-in component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
average_2 = Average(Input=average)  # -> reverse(flatten(ArithmeticMean)); disabled
mass_addition_2 = MassAddition(Input=larger_than.LargerThan)  # -> Result, PartialResults
quick_graph = QuickGraph(larger_than.LargerThan, SortOrder=0)  # disabled
negative = Negative(Value=average_2)
list_length = ListLength(List=mass_addition_2.PartialResults)
average_df = Number(negative)
division_3 = Division(A=mass_addition_2.Result, B=list_length)
multiplication_3 = Multiplication(A=Slider(100, range=0..100), B=division_3)  # -> flatten(Result)
negative_2 = Negative(Value=multiplication_3)
explode_tree = ExplodeTree(Data=graft(negative_2))  # -> Branch0, Branch1, Branch2, Branch3, Branch4
df_above = Number(negative_2)
df_above_1 = Number(explode_tree.Branch0)
df_above_2 = Number(explode_tree.Branch1)
df_above_4 = Number(explode_tree.Branch3)
df_above_5 = Number(explode_tree.Branch4)
df_above_3 = Number(explode_tree.Branch2)
panel_17 = Panel(multiplication_3)  # disabled
panel_18 = Panel(df_above)
panel_19 = Panel(df_above_3)
quick_graph_2 = QuickGraph([_0_4_grid_size, _0_5_grid_size, _0_6_grid_size, _0_3_grid_size, panel_17], SortOrder=0)  # disabled
minimum_2 = Minimum(A=panel_17, B=_0_6_grid_size)  # disabled
division_4 = Division(A=subtraction, B=minimum_2)  # disabled
multiplication_4 = Multiplication(A=number_slider, B=division_4)  # -> flatten(Result); disabled
quick_graph_3 = QuickGraph([multiplication_4, multiplication_2], SortOrder=0)  # disabled

# ----
# WALL
# ROOF
# WINDOW
callfromepconstrlibrary = Honeybee_CallFromEPConstructionLibrary()  # -> ThermMaterials, EPMaterials, EPWindowMaterials, EPConstructions; plug-in component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
searchepconstruction = Honeybee_SearchEPConstruction(EPConstrList=callfromepconstrlibrary.EPConstructions, standard="2", surfaceType="4")  # -> EPSelectedConstr; plug-in component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
searchepconstruction_2 = Honeybee_SearchEPConstruction(EPConstrList=callfromepconstrlibrary.EPConstructions, standard="2", surfaceType="1", keywords="SEMIHEATED")  # -> EPSelectedConstr; plug-in component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
# EP CONSTRUCTION
searchepconstruction_3 = Honeybee_SearchEPConstruction(EPConstrList=callfromepconstrlibrary.EPConstructions, standard="2", climateZone="8", surfaceType="0", keywords="MASS")  # -> EPSelectedConstr; plug-in component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
list_item_4 = ListItem(List=searchepconstruction_2, Index=Slider(4, range=0..10), Wrap=True)
list_item_5 = ListItem(List=searchepconstruction_3, Index=Slider(0, range=0..10), Wrap=True)

item_selector_3 = ItemSelector(
    searchepconstruction,
    {"ASHRAE 90.1-2010 EXTWINDOW METAL CLIMATEZONE 1", "ASHRAE 90.1-2010 EXTWINDOW METAL CLIMATEZONE 1-5 SEMIHEATED", "ASHRAE 90.1-2010 EXTWINDOW METAL CLIMATEZONE 2", "ASHRAE 90.1-2010 EXTWINDOW METAL CLIMATEZONE 3", "ASHRAE 90.1-2010 EXTWINDOW METAL CLIMATEZONE 4-6", "ASHRAE 90.1-2010 EXTWINDOW METAL CLIMATEZONE 6-8 SEMIHEATED", "ASHRAE 90.1-2010 EXTWINDOW METAL CLIMATEZONE 7-8", "ASHRAE 90.1-2010 EXTWINDOW NONMETAL CLIMATEZONE 1", "ASHRAE 90.1-2010 EXTWINDOW NONMETAL CLIMATEZONE 1-5 SEMIHEATED", "ASHRAE 90.1-2010 EXTWINDOW NONMETAL CLIMATEZONE 2", "ASHRAE 90.1-2010 EXTWINDOW NONMETAL CLIMATEZONE 3", "ASHRAE 90.1-2010 EXTWINDOW NONMETAL CLIMATEZONE 4", "ASHRAE 90.1-2010 EXTWINDOW NONMETAL CLIMATEZONE 5-6", "ASHRAE 90.1-2010 EXTWINDOW NONMETAL CLIMATEZONE 6-8 SEMIHEATED", "ASHRAE 90.1-2010 EXTWINDOW NONMETAL CLIMATEZONE 7-8"}, selected="ASHRAE 90.1-2010 EXTWINDOW NONMETAL CLIMATEZONE 7-8")

setepzonecnstr = Honeybee_SetEPZoneConstruction(
    HBZones=flatten(addhbglz),
    wallEPConstruction=list_item_5,
    windowEPConstruction=item_selector_3,
    roofEPConstruction=list_item_4)  # -> simplify(modifiedHBZones); plug-in component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

labelsurfaces = Honeybee_LabelZoneSurfaces(
    HBObjects=flatten(setepzonecnstr),
    attribute=honeybee_surface_attribute_list,
    windows=Toggle(True),
    textHeight=Slider(0.1, range=0..10))  # -> surfaceTxtLabels, labelBasePts, brepTxtLabels, surfaceWireFrames; disabled; plug-in component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
setloadsandschedules = Honeybee_SetLoadsAndSchedules(HBZones=flatten(setepzonecnstr), zonePrograms=item_selector)  # -> currentSchedules, currentLoads, HBZones; plug-in component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
ach2m3_s_m2_calculator = Honeybee_infORventPerAreaCalculator(HBZones=flatten(setloadsandschedules.HBZones), airFlowRate=Slider(0.2, range=0..1), ACHorM3sM2=Toggle(True))  # -> out, infPerAreaFacade, ventPerAreaFloor, allExposed, allFloors; plug-in component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
panel_20 = Panel(setloadsandschedules.currentSchedules)
setepzoneloads = Honeybee_SetEnergyPlusZoneLoads(
    HBZones=setloadsandschedules.HBZones,
    equipmentLoadPerArea=Slider(50, range=0..100),
    infilRatePerArea_Facade=ach2m3_s_m2_calculator.infPerAreaFacade,
    lightingDensityPerArea=Slider(50, range=0..100),
    numOfPeoplePerArea=division,
    ventilationPerArea=Slider(0, range=0..100),
    ventilationPerPerson=Slider(0.01, range=0..0.01))  # -> loads, HBZones; plug-in component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
runenergysimulation = Honeybee_RunEnergySimulation(
    epwFile=file_path,
    energySimPar=energysimpar,
    HBZones=flatten(setepzoneloads.HBZones),
    HBContext=flatten(hb_epcontextsrf),
    simulationOutputs=flatten(epoutput.simulationOutputs),
    writeIdf=boolean_toggle_3,
    runEnergyPlus=boolean_toggle_3,
    idfFileName="EP")  # -> out, idfFileAddress, resultFileAddress, eioFileAddress, rddFileAddress, htmlReport, studyFolder; plug-in component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
decomposebytype_2 = Honeybee_DecomposeBasedOnType(HBZone=setepzoneloads.HBZones)  # -> walls, interiorWalls, airWalls, windows, interiorWindows, skylights, roofs, ceilings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; plug-in component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
readepresult = Honeybee_ReadEPResult(resultFileAddress=runenergysimulation.resultFileAddress)  # -> totalThermalLoad, thermalLoadBalance, cooling, heating, electricLight, electricEquip, port, port_2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; plug-in component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
strnum = Ladybug_SeparateData(inputList=flatten(readepresult.totalThermalLoad))  # -> numbers, strings; plug-in component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
strnum_2 = Ladybug_SeparateData(inputList=flatten(readepresult.cooling))  # -> numbers, strings; disabled; plug-in component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
strnum_3 = Ladybug_SeparateData(inputList=flatten(readepresult.heating))  # -> numbers, strings; disabled; plug-in component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
strnum_4 = Ladybug_SeparateData(inputList=flatten(readepresult.totalSolarGain))  # -> numbers, strings; disabled; plug-in component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
custom_preview_9 = CustomPreview(Geometry=decomposebytype_2.walls, Material=ColourSwatch(SwatchColor=RGB(134, 148, 156)))
custom_preview_10 = CustomPreview(Geometry=decomposebytype_2.interiorWalls, Material=ColourSwatch(SwatchColor=RGB(75, 83, 87)))
custom_preview_11 = CustomPreview(Geometry=decomposebytype_2.windows, Material=ColourSwatch(SwatchColor=RGB(36, 167, 242)))
custom_preview_12 = CustomPreview(Geometry=decomposebytype_2.roofs, Material=ColourSwatch(SwatchColor=RGB(209, 65, 106)))
custom_preview_13 = CustomPreview(Geometry=decomposebytype_2.floors, Material=ColourSwatch(SwatchColor=RGB(44, 97, 87)))
mass_addition_3 = MassAddition(Input=strnum.numbers)  # -> Result, PartialResults
mass_addition_4 = MassAddition(Input=strnum_2.numbers)  # -> Result, PartialResults; disabled
mass_addition_5 = MassAddition(Input=strnum_3.numbers)  # -> Result, PartialResults; disabled
quick_graph_4 = QuickGraph(strnum_4.numbers, SortOrder=0)  # disabled
round = Round(Number=mass_addition_3.Result)  # -> Nearest, Floor, Ceiling
round_2 = Round(Number=mass_addition_4.Result)  # -> Nearest, Floor, Ceiling; disabled
round_3 = Round(Number=mass_addition_5.Result)  # -> Nearest, Floor, Ceiling; disabled
quick_graph_5 = QuickGraph([strnum_3.numbers, strnum_2.numbers], SortOrder=0)  # disabled
total_energy = Number(round.Nearest)
total_energy_2 = Number(round_2.Nearest)
total_energy_3 = Number(round_3.Nearest)
pmvcomfortcalculator = Ladybug_PMVComfortCalculator(
    dryBulbTemperature=readepresult.airTemperature,
    meanRadiantTemperature=readepresult.meanRadTemperature,
    windSpeed="0.15",
    relativeHumidity=readepresult.relativeHumidity,
    metabolicRate="1.2",
    clothingLevel="0.5",
    calcBalanceTemperature=False,
    runIt=Toggle(True))  # -> readMe, port, predictedMeanVote, percentPeopleDissatisfied, standardEffectiveTemperature, port_2, comfortableOrNot, percentOfTimeComfortable, port_3, balanceTemperature; plug-in component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
panel_21 = Panel([total_energy, total_energy_2, total_energy_3, df_above_3])
strnum_5 = Ladybug_SeparateData(inputList=flatten(pmvcomfortcalculator.predictedMeanVote))  # -> numbers, strings; plug-in component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
quick_graph_6 = QuickGraph(strnum_5.numbers, SortOrder=0)
