# Grasshopper definition BENV0088 - Compare EP vs HB.gh (Grasshopper 1.0.7)
# plug-ins: Human, FalseStartToggle, Ironbug, TT Toolbox

ladybug = Ladybug_Ladybug()  # -> out; plug-in component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
honeybee = Honeybee_Honeybee()  # -> out; plug-in component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

# ----
# Import Process
boolean_toggle = BooleanToggle(True)
honeybee_surface_attribute_list = Honeybee_SurfaceAttributeList({"Name": "name", "Radiance Material": "RadMaterial", "EnergyPlus Construction": "EPConstruction", "Surface Type": "type", "Boundary Condition": "BC", "BC Object": "BCObject", "Sun Exposure": "sunExposure", "Wind Exposure": "windExposure", "Has Child Surface": "hasChild", "Is Child Surface": "isChild", "Is Planar": "isPlanar", "Srf Type Set By User": "srfTypeByUser", "Boundary Condition Set By User": "srfBCByUser", "Shade Material Name": "shadeMaterialName", "Shading Control Name": "shadingControlName", "Shcading Schedule Name": "shadingSchName"}, selected="Name")
file_path = FilePath("C:\ladybug\BENV0088_CW\ExistingBulding_HeatSurface.idf")
importidf = Honeybee_ImportIdf(idfFile=file_path, importEPObjects=boolean_toggle)  # -> out, HBZones, shadings; plug-in component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
idf_from_moodle = Panel(file_path)
labelsurfaces = Honeybee_LabelZoneSurfaces(HBObjects=flatten(importidf.HBZones), attribute=honeybee_surface_attribute_list, windows=Toggle(True))  # -> surfaceTxtLabels, labelBasePts, brepTxtLabels, surfaceWireFrames; plug-in component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
remglz = Honeybee_RemoveGlazing(HBZones=flatten(importidf.HBZones), windowName=labelsurfaces.surfaceTxtLabels)  # -> out, HBZones; plug-in component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
flip_matrix = FlipMatrix(Data=labelsurfaces.surfaceWireFrames)
boolean_toggle_2 = BooleanToggle(True)
panel = Panel("""EastZone
Attic
Reception
WestZone
SouthZone""")
panel_2 = Panel("""True
False
True
True
True""")
explode_tree = ExplodeTree(Data=flip_matrix)  # -> Branch0, Branch1, Branch2, Branch3
mass2zone = Honeybee_Masses2Zones(
    zoneMasses=flatten(remglz.HBZones),
    zoneNames=panel,
    isConditioned=panel_2,
    maxRoofAngle="70",
    createHBZones=boolean_toggle_2)  # -> out, HBZones; plug-in component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
edge_surface = EdgeSurface(CurveA=explode_tree.Branch0, CurveB=explode_tree.Branch1, CurveC=explode_tree.Branch2, CurveD=explode_tree.Branch3)
solveadjc = Honeybee_SolveAdjacencies(HBZones=flatten(mass2zone.HBZones), removeCurrentAdjc=False, findAdjc=boolean_toggle_2)  # -> out, HBZonesWADJ; plug-in component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
addhbglz = Honeybee_addHBGlz(
    HBObj=solveadjc.HBZonesWADJ,
    childSurfaces=flatten(edge_surface),
    childSurfacesName=flatten(labelsurfaces.surfaceTxtLabels))  # -> flatten(HBObjWGLZ); plug-in component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

# ----
# Schedules
# SummerDesignDay
# Weekday
# WinterDesignDay
# Weekend
# SummerDesignDay
# Weekday
# Weekend
# Holiday
# SummerDesignDay
# WinterDesignDay
# Weekday
schedules_type_limits = Panel("""ActivityLevel
ActivityLevel
Fractional
Fractional
Fractional""")
constant_schedule_names = Panel("""Activity_Office
Activity_Circulation
Air Velocity
Infiltration
Always_ON""")
constant_values = Panel("""125
145
0.137
1
1""")
constantschedule = Honeybee_ConstantSchedule(value=graft(constant_values), scheduleName=graft(constant_schedule_names), schedTypeLimits=graft(schedules_type_limits))  # -> out, flatten(schedule), weekSched, schedIDFText; plug-in component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
file_path_2 = FilePath("C:\Users\BT\OneDrive - University College London\2.Integrated Building Systems Simulation\Hourly_Schedules.csv")
read_excel_sheet = ReadExcelSheet(Run=Toggle(True), FilePath=file_path_2, Worksheet="1", Listen=False)  # -> UserMessages, Columns, Rows
panel_3 = Panel(constantschedule.schedule)
series = Series(Start=Slider(49, range=0..10000), Step=1, Count="8760")
explode_tree_2 = ExplodeTree(Data=read_excel_sheet.Columns)  # -> Branch0, Branch1, Branch2, Branch3, Branch4, Branch5, Branch6, Branch7
variable_schedules = Panel("Clothing")
merge = Merge(Data1=explode_tree_2.Branch1, Data2=explode_tree_2.Branch2, Data3=explode_tree_2.Branch4)
series_2 = Series(Start=Slider(25, range=0..10000), Step=1, Count=Slider(24, range=0..2200))
list_item = ListItem(List=explode_tree_2.Branch3, Index=series, Wrap=True)
merge_2 = Merge(Data1=explode_tree_2.Branch6, Data2=explode_tree_2.Branch7)
series_3 = Series(Start=Slider(25, range=0..10000), Step=1, Count=Slider(24, range=0..2200))
variable_schedules_2 = Panel("""HeatingSP_Office
HeatingSP_Reception""")
panel_4 = Panel("""Temperature
Temperature""")
csvschedule = Honeybee_CreateCSVSchedule(values=list_item, scheduleName=variable_schedules, writeFile=Toggle(True))  # -> out, csvSchedule; plug-in component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
panel_5 = Panel("""12
12""")
list_item_2 = ListItem(List=merge_2, Index=series_2, Wrap=True)
list_item_3 = ListItem(List=explode_tree_2.Branch5, Index=series_3, Wrap=True)
series_4 = Series(Start=Slider(1, range=0..10000), Step=1, Count=Slider(24, range=0..2200))
duplicate_data = DuplicateData(Data=graft(panel_5), Number=2, Order=True)
series_5 = Series(Start=Slider(25, range=0..10000), Step=1, Count=Slider(24, range=0..2200))
variable_schedules_3 = Panel("""People_Office
People_Reception
Lighting""")
quick_graph = QuickGraph(list_item_3, SortOrder=0)
duplicate_data_2 = DuplicateData(Data=graft("0.05"), Number="24", Order=True)
duplicate_data_3 = DuplicateData(Data=graft("0"), Number="24", Order=True)
list_item_4 = ListItem(List=merge, Index=series_4, Wrap=True)
panel_6 = Panel("""0
0
0""")
list_item_5 = ListItem(List=merge, Index=series_5, Wrap=True)
quick_graph_2 = QuickGraph(list_item_2, SortOrder=0)
quick_graph_3 = QuickGraph(duplicate_data, SortOrder=0)
duplicate_data_4 = DuplicateData(Data=graft(panel_6), Number=2, Order=True)
annualschedule = Honeybee_AnnualSchedule(
    sun=duplicate_data,
    mon=list_item_2,
    tue=list_item_2,
    wed=list_item_2,
    thu=list_item_2,
    fri=list_item_2,
    sat=duplicate_data,
    holiday=duplicate_data,
    coolDesignDay=list_item_2,
    heatDesignDay=list_item_2,
    scheduleName=graft(variable_schedules_2),
    schedTypeLimits=graft(panel_4),
    runIt=Toggle(True))  # -> out, port, schedule, port_2, weekSched, schedIDFText; plug-in component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
quick_graph_4 = QuickGraph(list_item_5, SortOrder=0)
quick_graph_5 = QuickGraph(list_item_4, SortOrder=0)
annualschedule_2 = Honeybee_AnnualSchedule(
    sun=duplicate_data_2,
    mon=list_item_3,
    tue=list_item_3,
    wed=list_item_3,
    thu=list_item_3,
    fri=list_item_3,
    sat=duplicate_data_2,
    holiday=duplicate_data_2,
    coolDesignDay=list_item_3,
    heatDesignDay=duplicate_data_3,
    scheduleName="Equipment",
    schedTypeLimits="Fractional",
    runIt=Toggle(True))  # -> out, port, schedule, port_2, weekSched, schedIDFText; plug-in component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
annualschedule_3 = Honeybee_AnnualSchedule(
    sun=list_item_4,
    mon=list_item_5,
    tue=list_item_5,
    wed=list_item_5,
    thu=list_item_5,
    fri=list_item_5,
    sat=list_item_4,
    holiday=duplicate_data_4,
    coolDesignDay=list_item_5,
    heatDesignDay=list_item_4,
    scheduleName=graft(variable_schedules_3),
    runIt=Toggle(True))  # -> out, port, schedule, port_2, weekSched, schedIDFText; plug-in component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
panel_7 = Panel(annualschedule.schedule)
panel_8 = Panel(annualschedule_3.schedule)
panel_9 = Panel(annualschedule_2.schedule)

# ---- group: Materials
# Material/Construction
panel_10 = Panel("""Cavity Wall
Internal partition
Internal ceiling
Singe glazing
Solid ground floor
Pitched roof""")
callfromepconstrlibrary = Honeybee_CallFromEPConstructionLibrary(keywords=panel_10)  # -> ThermMaterials, EPMaterials, EPWindowMaterials, EPConstructions; plug-in component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
panel_11 = Panel(callfromepconstrlibrary.EPConstructions)
explode_tree_3 = ExplodeTree(Data=graft(callfromepconstrlibrary.EPConstructions))  # -> Branch0, Branch1, Branch2, Branch3, Branch4, Branch5
setepzonecnstr = Honeybee_SetEPZoneConstruction(
    HBZones=flatten(addhbglz),
    wallEPConstruction=explode_tree_3.Branch0,
    windowEPConstruction=explode_tree_3.Branch4,
    roofEPConstruction=explode_tree_3.Branch3,
    floorEPConstruction=explode_tree_3.Branch5)  # -> simplify(modifiedHBZones); plug-in component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
setepzoneintcnstr = Honeybee_SetEPZoneInteriorConstruction(
    HBZones=setepzonecnstr,
    intWallEPConstruction=explode_tree_3.Branch2,
    intFloorEPConstruction=explode_tree_3.Branch1,
    intCeilingEPConstruction=explode_tree_3.Branch1)  # -> simplify(modifiedHBZones); plug-in component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

# ----
separatezonesbyfloor = Honeybee_SeparateZonesByFloor(HBZones=flatten(setepzoneintcnstr))  # -> floorHeights, HBZones; plug-in component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
explode_tree_4 = ExplodeTree(Data=separatezonesbyfloor.HBZones)  # -> Branch0, Branch1
separatezonesbyorientation = Honeybee_SeparateZonesByOrientation(HBZones=flatten(explode_tree_4.Branch0))  # -> orientations, HBZones; plug-in component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
explode_tree_5 = ExplodeTree(Data=separatezonesbyorientation.HBZones)  # -> Branch0, Branch1, Branch2, Branch3
panel_12 = Panel("""16
0.7
12
8
0""")
panel_13 = Panel("""2
0.7
3
12
0""")
explode_tree_6 = ExplodeTree(Data=graft(panel_12))  # -> Branch0, Branch1, Branch2, Branch3, Branch4
explode_tree_7 = ExplodeTree(Data=graft(panel_13))  # -> Branch0, Branch1, Branch2, Branch3, Branch4
one_over_x = OneOverX(Value=explode_tree_6.Branch3)
one_over_x_2 = OneOverX(Value=explode_tree_7.Branch3)
panel_14 = Panel("""People_Reception
People_Office
Activity_Office
Activity_Circulation
Lighting
Equipment
Infiltration
HeatingSP_Office
HeatingSP_Reception""")
explode_tree_8 = ExplodeTree(Data=graft(panel_14))  # -> Branch0, Branch1, Branch2, Branch3, Branch4, Branch5, Branch6, Branch7, Branch8

# ---- group: Attic
# Offices
# Attic
data = Data(explode_tree_4.Branch1)
panel_15 = Panel("""0.7
0""")
explode_tree_9 = ExplodeTree(Data=graft(panel_15))  # -> Branch0, Branch1
ach2m3_s_m2_calculator = Honeybee_infORventPerAreaCalculator(HBZones=flatten(data), airFlowRate=explode_tree_9.Branch0)  # -> out, infPerAreaFacade, ventPerAreaFloor, allExposed, allFloors; plug-in component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
setepzoneloads = Honeybee_SetEnergyPlusZoneLoads(
    HBZones=data,
    equipmentLoadPerArea=explode_tree_9.Branch1,
    infilRatePerArea_Facade=ach2m3_s_m2_calculator.infPerAreaFacade,
    lightingDensityPerArea=explode_tree_9.Branch1,
    numOfPeoplePerArea=explode_tree_9.Branch1,
    ventilationPerArea=explode_tree_9.Branch1,
    ventilationPerPerson=explode_tree_9.Branch1,
    recirculatedAirPerArea=explode_tree_9.Branch1)  # -> loads, HBZones; plug-in component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
setepzoneschedules = Honeybee_SetEnergyPlusZoneSchedules(HBZones=setepzoneloads.HBZones, infiltrationSchedules=explode_tree_8.Branch6)  # -> schedules, simplify(HBZones); plug-in component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

# ----
panel_16 = Panel("0.01")
negative = Negative(Value=Slider(3, range=0..100))
vector_xyz = VectorXYZ(XComponent=negative, YComponent=0, ZComponent=0)  # -> Vector, Length
panel_17 = Panel("""1
3
4
2""")
point = Point(Point(0.1396903593, 21.24943144, 0))
screen_oriented_text = ScreenOrientedText(
    Text="Zone Name_Percentage of Comfortable Time [%]",
    Justification=7,
    Location=point,
    SizeFactor=Slider(16, range=0..100),
    Depth=0,
    Absolute=False)

# ---- group: Offcies
# Reception
data_2 = Data(flatten([explode_tree_5.Branch3, explode_tree_5.Branch1, explode_tree_5.Branch2]))

# ----
ach2m3_s_m2_calculator_2 = Honeybee_infORventPerAreaCalculator(HBZones=flatten(data_2), airFlowRate=explode_tree_6.Branch1)  # -> out, infPerAreaFacade, ventPerAreaFloor, allExposed, allFloors; plug-in component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

# ---- group: Offcies (continued)
setepzoneloads_2 = Honeybee_SetEnergyPlusZoneLoads(
    HBZones=data_2,
    equipmentLoadPerArea=explode_tree_6.Branch0,
    infilRatePerArea_Facade=ach2m3_s_m2_calculator_2.infPerAreaFacade,
    lightingDensityPerArea=explode_tree_6.Branch2,
    numOfPeoplePerArea=one_over_x,
    ventilationPerArea=explode_tree_6.Branch4,
    ventilationPerPerson=explode_tree_6.Branch4,
    recirculatedAirPerArea=explode_tree_6.Branch4)  # -> loads, HBZones; plug-in component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
setepzoneschedules_2 = Honeybee_SetEnergyPlusZoneSchedules(
    HBZones=setepzoneloads_2.HBZones,
    occupancySchedules=explode_tree_8.Branch1,
    occupancyActivitySchs=explode_tree_8.Branch2,
    heatingSetPtSchedules=explode_tree_8.Branch7,
    lightingSchedules=explode_tree_8.Branch4,
    equipmentSchedules=explode_tree_8.Branch5,
    infiltrationSchedules=explode_tree_8.Branch6)  # -> schedules, simplify(HBZones); plug-in component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
setepzonethresholds = Honeybee_SetEnergyPlusZoneThresholds(HBZones=setepzoneschedules_2.HBZones)  # -> out, HBZones; plug-in component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

# ---- group: Reception
data_3 = Data(explode_tree_5.Branch0)

# ----
ach2m3_s_m2_calculator_3 = Honeybee_infORventPerAreaCalculator(HBZones=flatten(data_3), airFlowRate=explode_tree_7.Branch1)  # -> out, infPerAreaFacade, ventPerAreaFloor, allExposed, allFloors; plug-in component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

# ---- group: Reception (continued)
setepzoneloads_3 = Honeybee_SetEnergyPlusZoneLoads(
    HBZones=data_3,
    equipmentLoadPerArea=explode_tree_7.Branch0,
    infilRatePerArea_Facade=ach2m3_s_m2_calculator_3.infPerAreaFacade,
    lightingDensityPerArea=explode_tree_7.Branch2,
    numOfPeoplePerArea=one_over_x_2,
    ventilationPerArea=explode_tree_7.Branch4,
    ventilationPerPerson=explode_tree_7.Branch4,
    recirculatedAirPerArea=explode_tree_7.Branch4)  # -> loads, HBZones; plug-in component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
setepzoneschedules_3 = Honeybee_SetEnergyPlusZoneSchedules(
    HBZones=setepzoneloads_3.HBZones,
    occupancySchedules=explode_tree_8.Branch0,
    occupancyActivitySchs=explode_tree_8.Branch3,
    heatingSetPtSchedules=explode_tree_8.Branch8,
    lightingSchedules=explode_tree_8.Branch4,
    equipmentSchedules=explode_tree_8.Branch5,
    infiltrationSchedules=explode_tree_8.Branch6)  # -> schedules, simplify(HBZones); plug-in component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
setepzonethresholds_2 = Honeybee_SetEnergyPlusZoneThresholds(HBZones=setepzoneschedules_3.HBZones)  # -> out, HBZones; plug-in component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

# ---- group: HB Zones
office_and_reception = Data([setepzonethresholds_2.HBZones, setepzonethresholds.HBZones])
attic = Data(setepzoneschedules.HBZones)
all_zones = Data(flatten([attic, office_and_reception]))

# ---- group: Ironbug
# HVAC
panel_18 = Panel("SupplyAirTemperature")  # disabled
panel_19 = Panel("DesignDay")  # disabled
objparams = Ironbug_ObjParams(MaximumValueofx="1", MinimumValueofx="0", DataFieldSetType="Ironbug.HVAC.Curves.IB_CurveQuadratic_FieldSet")
objparams_2 = Ironbug_ObjParams(
    CoolingDesignAirFlowMethod=panel_19,
    HeatingDesignAirFlowMethod=panel_19,
    ZoneCoolingDesignSupplyAirTemperatureInputMethod=panel_18,
    ZoneHeatingDesignSupplyAirTemperatureInputMethod=panel_18,
    DataFieldSetType="Ironbug.HVAC.IB_SizingZone_FieldSet")  # disabled
objparams_3 = Ironbug_ObjParams(
    ConvergenceTolerance="0.001",
    FractionofAutosizedHeatingDesignCapacity="1",
    HeatingDesignCapacityMethod="HeatingDesignCapacity",
    DataFieldSetType="Ironbug.HVAC.IB_CoilHeatingWaterBaseboard_FieldSet")
panel_20 = Panel("""0.97
0.0633
-0.0333""")
ironbug_curvequadratic = Ironbug_CurveQuadratic(Coefficients=panel_20, Parameters_=objparams, dupNum=False)
ironbug_schedulerule = Ironbug_ScheduleRule(Values=Slider(1, range=0..1), dupNum=False)
ironbug_coilheatingwaterbaseboard = Ironbug_CoilHeatingWaterBaseboard(Parameters_=objparams_3, dupNum=False)  # -> CoilHeatingWaterBaseboard, graft(WaterSide_CoilHeatingWater)
ironbug_sizingzone = Ironbug_SizingZone(Parameters_=objparams_2, dupNum=False)  # disabled
objparams_4 = Ironbug_ObjParams(
    MotorEfficiency="0.9",
    PumpControlType="Intermittent",
    RatedPumpHead="180000",
    DataFieldSetType="Ironbug.HVAC.IB_PumpConstantSpeed_FieldSet")
objparams_5 = Ironbug_ObjParams(
    DesignWaterOutletTemperature="81",
    EfficiencyCurveTemperatureEvaluationVariable="LeavingBoiler",
    FuelType="NaturalGas",
    MaximumPartLoadRatio=Slider(1.1, range=0..10),
    MinimumPartLoadRatio=Slider(0.2, range=0..1),
    Name="HW_Boiler",
    NominalThermalEfficiency="0.65",
    NormalizedBoilerEfficiencyCurve=ironbug_curvequadratic,
    SizingFactor=Slider(1, range=0.4..1.4),
    DataFieldSetType="Ironbug.HVAC.IB_BoilerHotWater_FieldSet")
ironbug_schedule = Ironbug_Schedule(ValuesOrRules=ironbug_schedulerule)
heated_zones = Panel("4")
ironbug_duplicate = Ironbug_Duplicate(Reference=ironbug_coilheatingwaterbaseboard.CoilHeatingWaterBaseboard, Amount=heated_zones)  # -> Objects, graft(WaterSide_CoilHeatingWater)
objparams_6 = Ironbug_ObjParams(
    AvailabilitySchedule=ironbug_schedule,
    Name="Baseboard",
    DataFieldSetType="Ironbug.HVAC.IB_ZoneHVACBaseboardConvectiveWater_FieldSet")
dt = Slider(10, range=2..20)
ironbug_boilerhotwater = Ironbug_BoilerHotWater(Parameters_=objparams_5, dupNum=False)
ironbug_zonehvacbaseboardconvectivewater = Ironbug_ZoneHVACBaseboardConvectiveWater(CoilHeatingWaterBaseboard=ironbug_duplicate.Objects, Parameters_=graft(objparams_6), dupNum=False)
ironbug_setpointmanagerscheduled = Ironbug_SetpointManagerScheduled(Temperature="80", dupNum=False)
objparams_7 = Ironbug_ObjParams(
    DesignLoopExitTemperature="80",
    LoopDesignTemperatureDifference=dt,
    DataFieldSetType="Ironbug.HVAC.IB_SizingPlant_FieldSet")
ironbug_pumpconstantspeed = Ironbug_PumpConstantSpeed(Parameters_=objparams_4, dupNum=False)
plantbranches = PlantBranches(Branch1=ironbug_duplicate.WaterSide_CoilHeatingWater, mapBranchToLoop=False)
plantbranches_2 = PlantBranches(B1=ironbug_boilerhotwater, mapBranchToLoop=False)
ironbug_sizingplant = Ironbug_SizingPlant(Parameters_=objparams_7, dupNum=False)
ironbug_thermalzone = Ironbug_ThermalZone(
    HoneybeeZonesOrOsZones=office_and_reception,
    ZoneEquipment=ironbug_zonehvacbaseboardconvectivewater,
    IsAirTerminalPriorToZoneEquipments=True,
    dupNum=False)
ironbug_hotwaterplantloop = Ironbug_HotWaterPlantLoop(
    Supply=[ironbug_pumpconstantspeed, plantbranches_2, ironbug_setpointmanagerscheduled],
    Demand=flatten(plantbranches),
    SizingLoop=ironbug_sizingplant,
    dupNum=False)
ironbug_noairloop = Ironbug_NoAirLoop(OSZones=ironbug_thermalzone)
ironbug_hvacsystem = Ironbug_HVACSystem(AirLoops=flatten(ironbug_noairloop), PlantLoops=flatten(ironbug_hotwaterplantloop))

# ----
brep = Brep(all_zones)

# ----
# Simulation
conv_alg = Panel("TARP")
panel_21 = Panel("C:\Users\BT\OneDrive - University College London\2.Integrated Building Systems Simulation\Grasshopper\edit_fraction_radiant")
duplicate_data_5 = DuplicateData(Data=conv_alg, Number="5", Order=True)
people = Slider(0.5, range=0..1)
lights = Slider(0.37, range=0..1)
equipment = Slider(0.2, range=0..1)
panel_22 = Panel("""timestep
hourly
daily
monthly
annual""")
shadowpar = Honeybee_ShadowPar(frequency="20")  # -> shadowPar; plug-in component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
duplicate_data_6 = DuplicateData(Data="14", Number="12", Order=True)
gatwick_weather_file = Panel("https://www.energyplus.net/weather-download/europe_wmo_region_6/GBR//GBR_London.Gatwick.037760_IWEC/all")
boolean_toggle_3 = BooleanToggle(True)
item_selector = ItemSelector(panel_22, {"timestep", "hourly", "daily", "monthly", "annual"}, selected="hourly")
setzoneprop = Honeybee_SetZoneProperties(HBZones=all_zones, inConvAlg=duplicate_data_5, outConvAlg=duplicate_data_5)  # -> HBZones; plug-in component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
edit_fraction_radiant = EditFractionRadiantOfLightingAndEquipment(port=panel_21, Lights_Fraction_Radiant=lights, Equipment_Fraction_Radiant=equipment, People_Fraction_Radiant=people)  # -> out, OSMeasure; plug-in component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
sizing = Panel("1")
fullexterior = Panel("1")
timestep = Panel("6")
epoutput = Honeybee_GenerateEPOutput(
    zoneEnergyUse=boolean_toggle_3,
    zoneGainsAndLosses="False",
    zoneComfortMetrics=boolean_toggle_3,
    surfaceTempAnalysis="False",
    timestep=item_selector)  # -> out, flatten(simulationOutputs); plug-in component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
energysimpar = Honeybee_EnergySimulationPar(
    timestep=timestep,
    shadowCalcPar=shadowpar,
    solarDistribution=fullexterior,
    heatingSizingFactor=sizing,
    coolingSizingFactor=sizing,
    terrain="Suburbs",
    monthlyGrndTemps=duplicate_data_6)  # -> energySimPar; plug-in component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
epw_stat = Ladybug_OpenEPWAndSTATWeatherFiles(weatherFileURL=gatwick_weather_file)  # -> epwFile, statFile; plug-in component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
false_start_toggle = FalseStartToggle(True)
exporttoopenstudio = Honeybee_ExportToOpenStudio(
    epwWeatherFile=epw_stat.epwFile,
    energySimPar=energysimpar,
    HBZones=flatten(setzoneprop),
    HVACSystem=flatten(ironbug_hvacsystem),
    simulationOutputs=flatten(epoutput.simulationOutputs),
    OSMeasures=flatten(edit_fraction_radiant.OSMeasure),
    writeOSM=false_start_toggle,
    runSimulation=false_start_toggle,
    fileName="Ladybug",
    workingDir="C:\ladybug\BENV0088_CW")  # -> out, osmFileAddress, idfFileAddress, resultFileAddress, eioFileAddress, rddFileAddress, htmlReport, studyFolder, model; plug-in component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

# ---- group: Results
readepresult = Honeybee_ReadEPResult(resultFileAddress=exporttoopenstudio.resultFileAddress)  # -> port, port_2, port_3, heating, electricLight, electricEquip, port_4, pumpElectric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; plug-in component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
panel_23 = Panel(exporttoopenstudio.out)

# ----
strnum = Ladybug_SeparateData(inputList=flatten(readepresult.electricLight))  # -> numbers, strings; plug-in component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
strnum_2 = Ladybug_SeparateData(inputList=flatten(readepresult.electricEquip))  # -> numbers, strings; plug-in component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
strnum_3 = Ladybug_SeparateData(inputList=flatten(readepresult.port_4))  # -> numbers, strings; plug-in component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
strnum_4 = Ladybug_SeparateData(inputList=flatten(readepresult.port_3))  # -> numbers, strings; plug-in component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
strnum_5 = Ladybug_SeparateData(inputList=flatten(readepresult.heating))  # -> numbers, strings; plug-in component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
strnum_6 = Ladybug_SeparateData(inputList=flatten(readepresult.pumpElectric))  # -> numbers, strings; plug-in component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
mass_addition = MassAddition(Input=flatten(strnum.numbers))  # -> Result, PartialResults
mass_addition_2 = MassAddition(Input=flatten(strnum_2.numbers))  # -> Result, PartialResults
mass_addition_3 = MassAddition(Input=flatten(strnum_3.numbers))  # -> Result, PartialResults
mass_addition_4 = MassAddition(Input=flatten(strnum_6.numbers))  # -> Result, PartialResults
mass_addition_5 = MassAddition(Input=strnum_4.numbers)  # -> Result, PartialResults
mass_addition_6 = MassAddition(Input=strnum_5.numbers)  # -> Result, PartialResults
heating = Panel(mass_addition_6.Result)
cooling = Panel(mass_addition_5.Result)
light = Panel(mass_addition.Result)
equip = Panel(mass_addition_2.Result)
pump = Panel(mass_addition_4.Result)
fan = Panel(mass_addition_3.Result)

# ----
# Objective 1
# Minimize  CO2
panel_24 = Panel("2")
list_item_6 = ListItem(List=strnum_5.strings, Index=panel_24, Wrap=True)
panel_25 = Panel("""boiler
gas""")
match_text = MatchText(Text=list_item_6, RegEx=panel_25, Case=Toggle(False))
list_item_7 = ListItem(List=match_text, Index="0", Wrap=True)
list_item_8 = ListItem(List=match_text, Index="1", Wrap=True)
gate_or = GateOr(A=list_item_7, B=list_item_8)
ghpython_script = GhPythonScript(x=gate_or, y=heating)  # -> out, flatten(fossil), flatten(electricity)
# ---------- ghpython_script: Python ----------
__author__ = "BT"
__version__ = "2020.04.23"

import rhinoscriptsyntax as rs
fossil=0
electricity=0
if x == True:
    fossil=y
    electricity=0
else:
    electricity=y
    fossil=0
# ---------- end ghpython_script ----------
mass_addition_7 = MassAddition(Input=ghpython_script.fossil)  # -> Result, PartialResults
mass_addition_8 = MassAddition(Input=[light, equip, fan, pump, cooling, ghpython_script.electricity])  # -> Result, PartialResults
kwh_to_kgco2 = Panel("0.55")
kwh_to_kgco2_2 = Panel("0.19")
electricity = Panel(mass_addition_8.Result)
fossil = Panel(mass_addition_7.Result)
multiplication = Multiplication(A=kwh_to_kgco2_2, B=mass_addition_7.Result)
multiplication_2 = Multiplication(A=mass_addition_8.Result, B=kwh_to_kgco2)
mass_addition_9 = MassAddition(Input=flatten([multiplication_2, multiplication]))  # -> Result, PartialResults
kgco2 = Panel(multiplication)
kgco2_2 = Panel(multiplication_2)
round = Round(Number=mass_addition_9.Result)  # -> Nearest, Floor, Ceiling
# Operative
kgco2_3 = Panel(round.Nearest)

honeybee_zone_attribute_list = Honeybee_ZoneAttributeList({"Name": "name", "Zone Program": "zoneProgram", "Zone Floor Area": "zoneFloorArea", "Zone Volume": "zoneVolume", "Building Program": "bldgProgram", "Is Conditioned": "isConditioned", "HVAC System Type": "HVACSystem", "Occupancy Schedule": "occupancySchedule", "Occupancy Activity Schedule": "occupancyActivitySch", "Heating SetPoint Schedule": "heatingSetPtSchedule"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}, selected="Name")
labelzones = Honeybee_LabelZones(HBZones=flatten(all_zones), attribute=honeybee_zone_attribute_list)  # -> zoneTxtLabels, labelBasePts, brepTxtLabels, zoneWireFrames; plug-in component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

cull_index = CullIndex(List=labelzones.labelBasePts, Indices="0", Wrap=True)
move = Move(Geometry=cull_index, Motion=vector_xyz.Vector)  # -> Geometry, Transform

# ----
# Objective 2
# Minimize  -min(zones PPD < 10%)
remove_attic = Panel("""1
2
3
4""")
tree_branch = TreeBranch(Tree=readepresult.meanRadTemperature, Path=remove_attic, MaintainPaths=True)
tree_branch_2 = TreeBranch(Tree=readepresult.relativeHumidity, Path=remove_attic, MaintainPaths=True)
tree_branch_3 = TreeBranch(Tree=readepresult.airTemperature, Path=remove_attic, MaintainPaths=True)
strnum_7 = Ladybug_SeparateData(inputList=flatten(tree_branch))  # -> numbers, strings; plug-in component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
strnum_8 = Ladybug_SeparateData(inputList=flatten(tree_branch_2))  # -> numbers, strings; plug-in component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
strnum_9 = Ladybug_SeparateData(inputList=flatten(tree_branch_3))  # -> numbers, strings; plug-in component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
boolean_occupancy = Data([False, False, False, False, False, False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])
convertepschvalues = Honeybee_ConvertEnergyPlusScheduleToValues(schName="ClothingS")  # -> values, holidays; plug-in component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
strnum_10 = Ladybug_SeparateData(inputList=flatten(convertepschvalues.values))  # -> numbers, strings; plug-in component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
cull_pattern = CullPattern(List=strnum_7.numbers, CullPattern=boolean_occupancy)
cull_pattern_2 = CullPattern(List=strnum_8.numbers, CullPattern=boolean_occupancy)
cull_pattern_3 = CullPattern(List=strnum_9.numbers, CullPattern=boolean_occupancy)
cull_pattern_4 = CullPattern(List=strnum_10.numbers, CullPattern=boolean_occupancy)
list_item_9 = ListItem(List=strnum_7.strings, Index="2", Wrap=True)
met = Panel("""1.2
1.4
1.2
1.2""")
false_start_toggle_2 = FalseStartToggle(True)
wind_speed_m_s = Panel("0.137")
pmvcomfortcalculator = Ladybug_PMVComfortCalculator(
    dryBulbTemperature=cull_pattern_3,
    meanRadiantTemperature=cull_pattern,
    windSpeed=wind_speed_m_s,
    relativeHumidity=cull_pattern_2,
    metabolicRate=graft(met),
    clothingLevel=cull_pattern_4,
    calcBalanceTemperature=False,
    runIt=false_start_toggle_2)  # -> readMe, port, predictedMeanVote, percentPeopleDissatisfied, standardEffectiveTemperature, port_2, comfortableOrNot, percentOfTimeComfortable, port_3, balanceTemperature; plug-in component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
text_fragment = TextFragment(Text=list_item_9, Start=Slider(24, range=10..40))
ghpython_script_2 = GhPythonScript(x=pmvcomfortcalculator.percentOfTimeComfortable, y=text_fragment)  # -> out, flatten(a)
# ---------- ghpython_script_2: Python ----------
__author__ = "BT"
__version__ = "2020.04.30"

import rhinoscriptsyntax as rs
a=y+"_"+str(round(x,1))+"% "
# ---------- end ghpython_script_2 ----------
sort_list = SortList(Keys=flatten(pmvcomfortcalculator.percentOfTimeComfortable))  # -> Keys, ValuesValuesA
list_item_10 = ListItem(List=sort_list.Keys, Index="0", Wrap=True)
negative_2 = Negative(Value=list_item_10)
comf_time = Number(negative_2)

tree_branch_4 = TreeBranch(Tree=readepresult.operativeTemperature, Path=remove_attic, MaintainPaths=True)
strnum_11 = Ladybug_SeparateData(inputList=flatten(tree_branch_4))  # -> numbers, strings; plug-in component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
cull_pattern_5 = CullPattern(List=strnum_11.numbers, CullPattern=boolean_occupancy)
quick_graph_6 = QuickGraph(cull_pattern, SortOrder=0)
quick_graph_7 = QuickGraph(cull_pattern_3, SortOrder=0)
quick_graph_8 = QuickGraph(cull_pattern_5, SortOrder=0)
quick_graph_9 = QuickGraph(cull_pattern_2, SortOrder=0)
sort_list_2 = SortList(Keys=flatten(pmvcomfortcalculator.percentOfTimeComfortable), ValuesValuesA=flatten(ghpython_script_2.a))  # -> Keys, ValuesValuesA
list_item_11 = ListItem(List=ghpython_script_2.a, Index=panel_17, Wrap=True)
screen_oriented_text_2 = ScreenOrientedText(Text=list_item_11, Justification=7, Location=move.Geometry, SizeFactor=Slider(14, range=0..100), Depth=0, Absolute=False)
panel_26 = Panel(sort_list_2.ValuesValuesA)
ghpython_script_3 = GhPythonScript(x=list_item_10)  # -> out, flatten(a)
# ---------- ghpython_script_3: Python ----------
__author__ = "BT"
__version__ = "2020.04.30"

import rhinoscriptsyntax as rs
a=round(x,2)
# ---------- end ghpython_script_3 ----------

panel_27 = Panel(ghpython_script_3.a)

comf_time_2 = Number(ghpython_script_3.a)
# Dry-bulb
# Radiant
# Humidity
quick_graph_10 = QuickGraph(pmvcomfortcalculator.percentPeopleDissatisfied, SortOrder=0)
