# Grasshopper definition BENV0088 - Sensitivity Analysis.gh (Grasshopper 1.0.7)
# plug-ins: Human, FalseStartToggle, TT Toolbox

honeybee = Honeybee_Honeybee()  # -> out; plug-in component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
ladybug = Ladybug_Ladybug()  # -> out; plug-in component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
# Lower bound
lb_schedule = GenePool(Decimals=0, Maximum=10, Minimum=0, Value=[1, 1, 1, 0, 1, 0, 0, 0, 0, 0, 0, 0, 0])
# Upper bound
lb_schedule_2 = GenePool(Decimals=0, Maximum=10, Minimum=0, Value=[3.333333333, 5.555555556, 6, 4, 7, 5, 5, 5, 5, 3, 3, 3, 5])
construct_domain = ConstructDomain(DomainStart=lb_schedule, DomainEnd=lb_schedule_2)
series = Series(Start=0, Step=1, Count="13")
number_slider = Slider(1, range=1..100)

# ----
# Fly - Generate IDFs
boolean_toggle = BooleanToggle(False)
fly = Ladybug_fly(inputSliders=number_slider, fly=boolean_toggle)  # -> Vviiiiiiiiiizzz; plug-in component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

random = Random(Range=construct_domain, Number="150", Seed=series)  # -> simplify(Random)
list_item = ListItem(List=random, Index=number_slider, Wrap=True)  # -> flatten(Item)
round = Round(Number=list_item)  # -> simplify(graft(Nearest)), Floor, Ceiling
round_2 = Round(Number=list_item)  # -> Nearest, Floor, Ceiling

insulation_lamda = Slider(4, range=0..4)
insulation_thickness = Slider(1, range=1..6)

flip_matrix = FlipMatrix(Data=round_2.Nearest)
panel = Panel(round.Nearest)

# ----
# Window U
# Window SHGC
# Ins Th
# Ins Lambda
# Infiltration
# CoolingSetBack
# CoolingSP_Rec
# CoolingSP_Offi
# HeatingSetBack
# HeatingSP_Rec
# HeatingSP_Offi
# ShadeDepth
# NumOfShades
explode_tree = ExplodeTree(Data=round.Nearest)  # -> Branch0, Branch1, Branch2, Branch3, Branch4, Branch5, Branch6, Branch7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

# ----
# Import Process
boolean_toggle_2 = BooleanToggle(True)
honeybee_surface_attribute_list = Honeybee_SurfaceAttributeList({"Name": "name", "Radiance Material": "RadMaterial", "EnergyPlus Construction": "EPConstruction", "Surface Type": "type", "Boundary Condition": "BC", "BC Object": "BCObject", "Sun Exposure": "sunExposure", "Wind Exposure": "windExposure", "Has Child Surface": "hasChild", "Is Child Surface": "isChild", "Is Planar": "isPlanar", "Srf Type Set By User": "srfTypeByUser", "Boundary Condition Set By User": "srfBCByUser", "Shade Material Name": "shadeMaterialName", "Shading Control Name": "shadingControlName", "Shcading Schedule Name": "shadingSchName"}, selected="Name")
file_path = FilePath("C:\Users\amd\Desktop\[BENV0088]_[FBXX7]_[05052020]\1.Compare EP vs HB\ExistingBuilding after changes\ExistingBulding_HeatSurface.idf")
importidf = Honeybee_ImportIdf(idfFile=file_path, importEPObjects=boolean_toggle_2)  # -> out, HBZones, shadings; plug-in component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
labelsurfaces = Honeybee_LabelZoneSurfaces(HBObjects=flatten(importidf.HBZones), attribute=honeybee_surface_attribute_list, windows=Toggle(True))  # -> surfaceTxtLabels, labelBasePts, brepTxtLabels, surfaceWireFrames; plug-in component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
remglz = Honeybee_RemoveGlazing(HBZones=flatten(importidf.HBZones), windowName=labelsurfaces.surfaceTxtLabels)  # -> out, HBZones; plug-in component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
flip_matrix_2 = FlipMatrix(Data=labelsurfaces.surfaceWireFrames)
boolean_toggle_3 = BooleanToggle(True)
panel_2 = Panel("""EastZone
Attic
Reception
WestZone
SouthZone""")
panel_3 = Panel("""True
False
True
True
True""")
explode_tree_2 = ExplodeTree(Data=flip_matrix_2)  # -> Branch0, Branch1, Branch2, Branch3
mass2zone = Honeybee_Masses2Zones(
    zoneMasses=flatten(remglz.HBZones),
    zoneNames=panel_2,
    isConditioned=panel_3,
    maxRoofAngle="70",
    createHBZones=boolean_toggle_3)  # -> out, HBZones; plug-in component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
edge_surface = EdgeSurface(
    CurveA=explode_tree_2.Branch0,
    CurveB=explode_tree_2.Branch1,
    CurveC=explode_tree_2.Branch2,
    CurveD=explode_tree_2.Branch3)
solveadjc = Honeybee_SolveAdjacencies(HBZones=flatten(mass2zone.HBZones), removeCurrentAdjc=False, findAdjc=boolean_toggle_3)  # -> out, HBZonesWADJ; plug-in component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
addhbglz = Honeybee_addHBGlz(
    HBObj=solveadjc.HBZonesWADJ,
    childSurfaces=flatten(edge_surface),
    childSurfacesName=flatten(labelsurfaces.surfaceTxtLabels))  # -> flatten(HBObjWGLZ); plug-in component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

shgc = Slider(1, range=1..6)
wu = Slider(4, range=1..4)

number = Number(explode_tree.Branch3)
number_2 = Number(insulation_thickness)
multiplication = Multiplication(A=number, B="0.005")
multiplication_2 = Multiplication(A=number_2, B="5")
idf_from_moodle = Panel(file_path)
addition = Addition(A="0.020", B=multiplication)
division = Division(A=multiplication_2, B="100")
number_3 = Number(explode_tree.Branch1)
number_4 = Number(explode_tree.Branch0)

coolingsp_reception = Slider(5, range=0..5)
coolingsp_office = Slider(5, range=0..5)
coolingsetback = Slider(5, range=0..5)
heatingsp_reception = Slider(3, range=0..3)
heatingsp_office = Slider(3, range=0..3)
heatingsetback = Slider(5, range=0..5)

number_5 = Number(explode_tree.Branch7)
number_6 = Number(explode_tree.Branch5)
number_7 = Number(explode_tree.Branch6)
number_8 = Number(explode_tree.Branch8)
number_9 = Number(explode_tree.Branch10)
number_10 = Number(explode_tree.Branch9)
addition_2 = Addition(A=number_6, B="30")
addition_3 = Addition(A=number_7, B="23")
addition_4 = Addition(A=number_5, B="23")
addition_5 = Addition(A=number_8, B="12")
addition_6 = Addition(A=number_10, B="18")
addition_7 = Addition(A=number_8, B="18")

# ----
# Weekend
# Holiday
# Schedules
# SummerDesignDay
# WinterDesignDay
# Weekday
# Weekend
# Holiday
# SummerDesignDay
# WinterDesignDay
# Weekday
# SummerDesignDay
# Weekday
# Schedules
# WinterDesignDay
# Weekend
# SummerDesignDay
# Weekday
# Weekend
# Holiday
# SummerDesignDay
# WinterDesignDay
# Weekday
# Summer
schedules_type_limits = Panel("""ActivityLevel
ActivityLevel
Fractional
Fractional
Fractional""")
constant_schedule_names = Panel("""Activity_Office
Activity_Circulation
Air Velocity
Infiltration
Always_ON""")
constant_values = Panel("""125
145
0.137
1
1""")
panel_4 = Panel("""12
12
12
12
12
12
21
21
21
21
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""")
constantschedule = Honeybee_ConstantSchedule(value=graft(constant_values), scheduleName=graft(constant_schedule_names), schedTypeLimits=graft(schedules_type_limits))  # -> out, flatten(schedule), weekSched, schedIDFText; plug-in component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
constantschedule_2 = Honeybee_ConstantSchedule(value=Slider(1, range=0..1), scheduleName="CloWinter")  # -> out, schedule, weekSched, schedIDFText; plug-in component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
constantschedule_3 = Honeybee_ConstantSchedule(value=Slider(0.5, range=0..1), scheduleName="CloSummer")  # -> out, schedule, weekSched, schedIDFText; plug-in component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
file_path_2 = FilePath("C:\Users\amd\Desktop\[BENV0088]_[FBXX7]_[05052020]\1.Compare EP vs HB\Hourly_Schedules.csv")
analysisperiod = Ladybug_AnalysisPeriod(
    fromMonth=Slider(4, range=1..12),
    fromDay=Slider(2, range=1..31),
    fromHour=Slider(1, range=0..1),
    toMonth=Slider(9, range=1..12),
    toDay=Slider(30, range=1..31),
    toHour=Slider(24, range=1..24))  # -> out, analysisPeriod; plug-in component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
replace = Panel(addition_2)
find = Panel("18")
replace_2 = Panel(addition_3)
find_2 = Panel("21")
replace_3 = Panel(addition_4)
find_3 = Panel("12")
read_excel_sheet = ReadExcelSheet(Run=Toggle(True), FilePath=file_path_2, Worksheet="1", Listen=False)  # -> UserMessages, Columns, Rows
find_4 = Panel("18")
find_5 = Panel("21")
replace_4 = Panel(addition_5)
replace_5 = Panel(addition_6)
replace_6 = Panel(addition_7)
find_6 = Panel("12")
panel_5 = Panel(constantschedule.schedule)
replace_text = ReplaceText(Text=panel_4, Find=find_3, Replace=replace, RecursiveReplace=False)
replace_text_2 = ReplaceText(Text=panel_4, Find=find_6, Replace=replace_4, RecursiveReplace=False)
explode_tree_3 = ExplodeTree(Data=read_excel_sheet.Columns)  # -> Branch0, Branch1, Branch2, Branch3, Branch4, Branch5, Branch6, Branch7
replace_text_3 = ReplaceText(Text=replace_text, Find=find, Replace=replace_2, RecursiveReplace=False)
honeybee_seasonalschedule = Honeybee_SeasonalSchedule(
    scheduleName="ClothingS",
    baseWeekSched=constantschedule_2.schedule,
    seasonWeekSched1=constantschedule_3.schedule,
    analysisPeriod1=analysisperiod.analysisPeriod)  # -> out, schedule, schedIDFText; plug-in component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
replace_text_4 = ReplaceText(Text=replace_text_2, Find=find_4, Replace=replace_5, RecursiveReplace=False)
replace_text_5 = ReplaceText(Text=replace_text_3, Find=find_2, Replace=replace_3, RecursiveReplace=False)
replace_text_6 = ReplaceText(Text=replace_text_4, Find=find_5, Replace=replace_6, RecursiveReplace=False)
merge = Merge(Data1=explode_tree_3.Branch1, Data2=explode_tree_3.Branch2, Data3=explode_tree_3.Branch4)
series_2 = Series(Start=Slider(25, range=0..10000), Step=1, Count=Slider(24, range=0..2200))
merge_2 = Merge(Data1=explode_tree_3.Branch6, Data2=explode_tree_3.Branch7)
partition_list = PartitionList(List=replace_text_5, Size="24")
series_3 = Series(Start=Slider(25, range=0..10000), Step=1, Count=Slider(24, range=0..2200))
partition_list_2 = PartitionList(List=replace_text_6, Size="24")
variable_schedules = Panel("""HeatingSP_Office
HeatingSP_Reception""")
panel_6 = Panel("""Temperature
Temperature""")
variable_schedules_2 = Panel("""CoolingSP_Office_{0}_{1}
CoolingSP_Reception_{2}_{1}""")
list_item_2 = ListItem(List=merge_2, Index=series_2, Wrap=True)
panel_7 = Panel("""12
12""")
variable_schedules_3 = Panel("""HeatingSP_Office_{0}_{1}
HeatingSP_Reception_{2}_{1}""")
list_item_3 = ListItem(List=explode_tree_3.Branch5, Index=series_3, Wrap=True)
series_4 = Series(Start=Slider(1, range=0..10000), Step=1, Count=Slider(24, range=0..2200))
duplicate_data = DuplicateData(Data=graft(panel_7), Number="24", Order=True)
series_5 = Series(Start=Slider(25, range=0..10000), Step=1, Count=Slider(24, range=0..2200))
variable_schedules_4 = Panel("""People_Office
People_Reception
Lighting""")
quick_graph = QuickGraph(list_item_3, SortOrder=0)
duplicate_data_2 = DuplicateData(Data=graft("0.05"), Number="24", Order=True)
duplicate_data_3 = DuplicateData(Data=graft("0"), Number="24", Order=True)
list_item_4 = ListItem(List=merge, Index=series_4, Wrap=True)
duplicate_data_4 = DuplicateData(Data=graft(replace), Number=2, Order=True)
format = Format(Format=variable_schedules_2, Culture=127, Data0=replace_3, Data1=replace, Data2=replace_2)
format_2 = Format(Format="{0}_{2}_{1}", Culture=127, Data0=replace_3, Data1=replace, Data2=replace_2)
duplicate_data_5 = DuplicateData(Data=graft(replace_4), Number=2, Order=True)
format_3 = Format(Format=variable_schedules_3, Culture=127, Data0=replace_6, Data1=replace_4, Data2=replace_5)
format_4 = Format(Format="{0}_{2}_{1}", Culture=127, Data0=replace_6, Data1=replace_4, Data2=replace_5)
list_item_5 = ListItem(List=merge, Index=series_5, Wrap=True)
panel_8 = Panel("""0
0
0""")
quick_graph_2 = QuickGraph(list_item_2, SortOrder=0)
quick_graph_3 = QuickGraph(duplicate_data, SortOrder=0)
duplicate_data_6 = DuplicateData(Data=graft(panel_8), Number="24", Order=True)
annualschedule = Honeybee_AnnualSchedule(
    sun=duplicate_data,
    mon=list_item_2,
    tue=list_item_2,
    wed=list_item_2,
    thu=list_item_2,
    fri=list_item_2,
    sat=duplicate_data,
    holiday=duplicate_data,
    coolDesignDay=list_item_2,
    heatDesignDay=list_item_2,
    scheduleName=graft(variable_schedules),
    schedTypeLimits=graft(panel_6),
    runIt=Toggle(True))  # -> out, port, schedule, port_2, weekSched, schedIDFText; plug-in component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
panel_9 = Panel("""Temperature
Temperature""")
panel_10 = Panel("""Temperature
Temperature""")
quick_graph_4 = QuickGraph(partition_list, SortOrder=0)
quick_graph_5 = QuickGraph(list_item_5, SortOrder=0)
annualschedule_2 = Honeybee_AnnualSchedule(
    sun=duplicate_data_2,
    mon=list_item_3,
    tue=list_item_3,
    wed=list_item_3,
    thu=list_item_3,
    fri=list_item_3,
    sat=duplicate_data_2,
    holiday=duplicate_data_2,
    coolDesignDay=list_item_3,
    heatDesignDay=duplicate_data_3,
    scheduleName="Equipment",
    schedTypeLimits="Fractional",
    runIt=Toggle(True))  # -> out, port, schedule, port_2, weekSched, schedIDFText; plug-in component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
quick_graph_6 = QuickGraph(list_item_4, SortOrder=0)
quick_graph_7 = QuickGraph(duplicate_data_4, SortOrder=0)
quick_graph_8 = QuickGraph(partition_list_2, SortOrder=0)
quick_graph_9 = QuickGraph(duplicate_data_5, SortOrder=0)
annualschedule_3 = Honeybee_AnnualSchedule(
    sun=duplicate_data_4,
    mon=partition_list,
    tue=partition_list,
    wed=partition_list,
    thu=partition_list,
    fri=partition_list,
    sat=duplicate_data_4,
    holiday=duplicate_data_4,
    coolDesignDay=partition_list,
    heatDesignDay=partition_list,
    scheduleName=graft(format),
    schedTypeLimits=graft(panel_9),
    runIt=Toggle(True))  # -> out, port, schedule, port_2, weekSched, schedIDFText; plug-in component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
annualschedule_4 = Honeybee_AnnualSchedule(
    sun=list_item_4,
    mon=list_item_5,
    tue=list_item_5,
    wed=list_item_5,
    thu=list_item_5,
    fri=list_item_5,
    sat=list_item_4,
    holiday=duplicate_data_6,
    coolDesignDay=list_item_5,
    heatDesignDay=list_item_4,
    scheduleName=graft(variable_schedules_4),
    runIt=Toggle(True))  # -> out, port, flatten(schedule), port_2, weekSched, schedIDFText; plug-in component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
annualschedule_5 = Honeybee_AnnualSchedule(
    sun=duplicate_data_5,
    mon=partition_list_2,
    tue=partition_list_2,
    wed=partition_list_2,
    thu=partition_list_2,
    fri=partition_list_2,
    sat=duplicate_data_5,
    holiday=duplicate_data_5,
    coolDesignDay=partition_list_2,
    heatDesignDay=partition_list_2,
    scheduleName=graft(format_3),
    schedTypeLimits=graft(panel_10),
    runIt=Toggle(True))  # -> out, port, schedule, port_2, weekSched, schedIDFText; plug-in component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
panel_11 = Panel(annualschedule.schedule)
panel_12 = Panel(annualschedule_2.schedule)
panel_13 = Panel(annualschedule_3.schedule)
panel_14 = Panel(annualschedule_4.schedule)
panel_15 = Panel(annualschedule_5.schedule)

panel_16 = Panel(file_path_2)
infiltration = Slider(7, range=1..7)
number_11 = Number(explode_tree.Branch4)
division_2 = Division(A=number_11, B="10")
panel_17 = Panel(division_2)
panel_18 = Panel("""16
0.7
3
8
0""")
panel_19 = Panel("""2
0.7
3
3
0""")
explode_tree_4 = ExplodeTree(Data=graft(panel_18))  # -> Branch0, Branch1, Branch2, Branch3, Branch4
explode_tree_5 = ExplodeTree(Data=graft(panel_19))  # -> Branch0, Branch1, Branch2, Branch3, Branch4
one_over_x = OneOverX(Value=explode_tree_4.Branch3)
one_over_x_2 = OneOverX(Value=explode_tree_5.Branch3)
panel_20 = Panel("0.0125")
panel_21 = Panel("""People_Reception
People_Office
Activity_Office
Activity_Circulation
Lighting
Equipment
Infiltration
HeatingSP_Office
HeatingSP_Reception""")
explode_tree_6 = ExplodeTree(Data=simplify(panel_15))  # -> Branch0, Branch1
explode_tree_7 = ExplodeTree(Data=simplify(panel_13))  # -> Branch0, Branch1
explode_tree_8 = ExplodeTree(Data=graft(panel_21))  # -> Branch0, Branch1, Branch2, Branch3, Branch4, Branch5, Branch6, Branch7, Branch8

shadedepth = Slider(3, range=0..3)
numofshades = Slider(5, range=0..5)

number_12 = Number(explode_tree.Branch11)
number_13 = Number(explode_tree.Branch12)
division_3 = Division(A=number_12, B="10")
data = Data([Toggle(False), Toggle(False), Toggle(True), Toggle(False)])
system = Slider(14, range=0..14)
series_6 = Series(Start="1", Step="1", Count="17")
panel_22 = Panel("""13
14""")
cull_index = CullIndex(List=series_6, Indices=panel_22, Wrap=True)
honeybee_hvacsystemslist = Honeybee_HVACSystemsList({"-1. Thermostat Only": -1, "0. Ideal Air Loads": 0, "1. PTAC | Residential": 1, "2. PTHP | Residential": 2, "3. Packaged Single Zone - AC": 3, "4. Packaged Single Zone - HP": 4, "5. Packaged VAV w/ Reheat": 5, "6. Packaged VAV w/ PFP Boxes": 6, "7. VAV w/ Reheat": 7, "8. VAV w/ PFP Boxes": 8, "9. Warm Air Furnace - Gas Fired": 9, "10.Warm Air Furnace - Electric": 10, "11.Fan Coil Units + DOAS": 11, "12.Active Chilled Beams + DOAS": 12, "13.Radiant Floors + DOAS": 13, "14.Custom Rad Surfaces + DOAS": 14, "15.Heated Surfaces + VAV Cooling": 15, "16.VRF + DOAS": 16, "17.WSHP + DOAS": 17}, selected="4. Packaged Single Zone - HP")
panel_23 = Panel(cull_index)
list_item_6 = ListItem(List=cull_index, Index=system, Wrap=True)
panel_24 = Panel(list_item_6)
panel_25 = Panel("{0}_{1}_{2}_{3}_{4}_{5}_{6}_{7}_{8}_{9}_{10}_{11}_{12}_{13}")
sun = Panel("0")
format_5 = Format(
    Format=panel_25,
    Culture=127,
    Data0=explode_tree.Branch0,
    Data1=explode_tree.Branch1,
    Data2=explode_tree.Branch2,
    Data3=explode_tree.Branch3,
    Data4=explode_tree.Branch4,
    Data5=explode_tree.Branch5,
    Data6=explode_tree.Branch6,
    Data7=explode_tree.Branch7,
    Data8=explode_tree.Branch8,
    Data9=explode_tree.Branch9,
    Data10=explode_tree.Branch10,
    Data11=explode_tree.Branch11,
    Data12=explode_tree.Branch12,
    Data13=panel_24)
panel_26 = Panel(format_5)

# ---- group: Materials
# Material/Construction
panel_27 = Panel("""Cavity Wall
Internal partition
Internal ceiling
Singe glazing
Solid ground floor
Pitched roof""")
format_6 = Format(Format="{0}_{1:0.000}", Culture=127, Data0=division, Data1=addition)
division_4 = Division(A=number_3, B="10")
callfromepconstrlibrary = Honeybee_CallFromEPConstructionLibrary(keywords=panel_27)  # -> ThermMaterials, EPMaterials, EPWindowMaterials, EPConstructions; plug-in component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
subtraction = Subtraction(A="1", B=division_4)
panel_28 = Panel(format_6)
panel_29 = Panel(addition)
epopaquemat = Honeybee_EnergyPlusOpaqueMaterial(name=panel_28, roughness="Rough", thickness=division, conductivity=panel_29, density="30", specificHeat="1000")  # -> EPMaterial; plug-in component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
panel_30 = Panel(callfromepconstrlibrary.EPConstructions)
explode_tree_9 = ExplodeTree(Data=graft(callfromepconstrlibrary.EPConstructions))  # -> Branch0, Branch1, Branch2, Branch3, Branch4, Branch5
decomposeepconstruction = Honeybee_DecomposeEPConstruction(cnstrName=explode_tree_9.Branch1)  # -> materials, comments, UValue_SI, UValue_IP, RValue_SI, RValue_IP; plug-in component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
concatenate = Concatenate(FragmentA="Ceil_", FragmentB=panel_28)
concatenate_2 = Concatenate(FragmentA="Floor_", FragmentB=panel_28)
epconstruction = Honeybee_EnergyPlusConstruction(name=concatenate, layer_1=decomposeepconstruction.materials, layer_2=epopaquemat)  # -> EPConstruction; plug-in component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
epconstruction_2 = Honeybee_EnergyPlusConstruction(name=concatenate_2, layer_1=epopaquemat, layer_2=decomposeepconstruction.materials)  # -> EPConstruction; plug-in component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
decomposeepconstruction_2 = Honeybee_DecomposeEPConstruction(cnstrName=explode_tree_9.Branch4)  # -> materials, comments, UValue_SI, UValue_IP, RValue_SI, RValue_IP; plug-in component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
panel_31 = Panel(decomposeepconstruction_2.materials)
setepzonecnstr = Honeybee_SetEPZoneConstruction(
    HBZones=flatten(addhbglz),
    wallEPConstruction=explode_tree_9.Branch0,
    windowEPConstruction=explode_tree_9.Branch4,
    roofEPConstruction=explode_tree_9.Branch3,
    floorEPConstruction=explode_tree_9.Branch5)  # -> simplify(modifiedHBZones); plug-in component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
setepzoneintcnstr = Honeybee_SetEPZoneInteriorConstruction(
    HBZones=setepzonecnstr,
    intWallEPConstruction=explode_tree_9.Branch2,
    intFloorEPConstruction=epconstruction_2,
    intCeilingEPConstruction=epconstruction)  # -> simplify(modifiedHBZones); plug-in component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

# ----
format_7 = Format(Format="{0:0.0}_{1:0.0}", Culture=127, Data0=number_4, Data1=subtraction)
concatenate_3 = Concatenate(FragmentA="Glazing_", FragmentB=format_7)

# ---- group: Materials (continued)
epwindowmat = Honeybee_EnergyPlusWindowMaterial(name=concatenate_3, U_Value=number_4, SHGC=subtraction, VT=subtraction)  # -> EPMaterial; plug-in component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
epconstruction_3 = Honeybee_EnergyPlusConstruction(name=concatenate_3, layer_1=epwindowmat)  # -> EPConstruction; plug-in component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

# ----
panel_32 = Panel(epwindowmat)
separatezonesbyfloor = Honeybee_SeparateZonesByFloor(HBZones=flatten(setepzoneintcnstr))  # -> floorHeights, HBZones; plug-in component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
explode_tree_10 = ExplodeTree(Data=separatezonesbyfloor.HBZones)  # -> Branch0, Branch1
separatezonesbyorientation = Honeybee_SeparateZonesByOrientation(HBZones=flatten(explode_tree_10.Branch0))  # -> orientations, HBZones; plug-in component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
explode_tree_11 = ExplodeTree(Data=separatezonesbyorientation.HBZones)  # -> Branch0, Branch1, Branch2, Branch3

# ---- group: Attic
# Offices
# Attic
data_2 = Data(explode_tree_10.Branch1)
ach2m3_s_m2_calculator = Honeybee_infORventPerAreaCalculator(HBZones=flatten(data_2), airFlowRate=division_2)  # -> out, infPerAreaFacade, ventPerAreaFloor, allExposed, allFloors; plug-in component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
setepzoneloads = Honeybee_SetEnergyPlusZoneLoads(
    HBZones=data_2,
    equipmentLoadPerArea="0",
    infilRatePerArea_Facade=ach2m3_s_m2_calculator.infPerAreaFacade,
    lightingDensityPerArea="0",
    numOfPeoplePerArea="0",
    ventilationPerArea="0",
    ventilationPerPerson="0",
    recirculatedAirPerArea="0")  # -> loads, HBZones; plug-in component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
setepzoneschedules = Honeybee_SetEnergyPlusZoneSchedules(HBZones=setepzoneloads.HBZones, infiltrationSchedules=explode_tree_8.Branch6)  # -> schedules, simplify(HBZones); plug-in component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

# ---- group: Offcies
# Reception
data_3 = Data(flatten([explode_tree_11.Branch3, explode_tree_11.Branch1, explode_tree_11.Branch2]))

# ----
ach2m3_s_m2_calculator_2 = Honeybee_infORventPerAreaCalculator(HBZones=flatten(data_3), airFlowRate=division_2)  # -> out, infPerAreaFacade, ventPerAreaFloor, allExposed, allFloors; plug-in component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

# ---- group: Offcies (continued)
setepzoneloads_2 = Honeybee_SetEnergyPlusZoneLoads(
    HBZones=data_3,
    equipmentLoadPerArea=explode_tree_4.Branch0,
    infilRatePerArea_Facade=ach2m3_s_m2_calculator_2.infPerAreaFacade,
    lightingDensityPerArea=explode_tree_4.Branch2,
    numOfPeoplePerArea=one_over_x,
    ventilationPerArea=explode_tree_4.Branch4,
    ventilationPerPerson=panel_20,
    recirculatedAirPerArea=explode_tree_4.Branch4)  # -> loads, HBZones; plug-in component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
setepzoneschedules_2 = Honeybee_SetEnergyPlusZoneSchedules(
    HBZones=setepzoneloads_2.HBZones,
    occupancySchedules=explode_tree_8.Branch1,
    occupancyActivitySchs=explode_tree_8.Branch2,
    heatingSetPtSchedules=explode_tree_6.Branch0,
    coolingSetPtSchedules=explode_tree_7.Branch0,
    lightingSchedules=explode_tree_8.Branch4,
    equipmentSchedules=explode_tree_8.Branch5,
    infiltrationSchedules=explode_tree_8.Branch6)  # -> schedules, simplify(HBZones); plug-in component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
setepzonethresholds = Honeybee_SetEnergyPlusZoneThresholds(HBZones=setepzoneschedules_2.HBZones)  # -> out, HBZones; plug-in component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

# ----
epwindowshades = Honeybee_EnergyPlusWindowShadeGenerator(
    HBObjects=flatten(setepzonethresholds.HBZones),
    depth=division_3,
    numOfShds=number_13,
    horOrVertical=data,
    runIt=Toggle(True))  # -> readMe, port, HBObjWShades, port_2, windowBreps, shadeBreps, port_3, shadeMatName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; plug-in component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
hb_epcontextsrf = HoneybeeEPContextSurfaces(shdSurfaces=flatten(epwindowshades.shadeBreps))  # -> HBContext; inputs shdSurfaces: list of Brep, justBoundingBox: Boolean
# ---------- hb_epcontextsrf: Python ----------
"""
prepare shading/context geometries

    Args:
        northVectorOrRotation: A vector that shows North or a number that shows
                               the rotation of the North from the Y axis
        bldgMasses: List of closed Breps as thermal zones.
    Returns:
        report: ...
        thermalZones: Thermal zone's geometries for visualiza
"""

ghenv.Component.Name = 'Honeybee EP context Surfaces'
ghenv.Component.NickName = 'HB_EPContextSrf'
ghenv.Component.Message = 'VER 0.0.65\nJAN_01_2020'
ghenv.Component.IconDisplayMode = ghenv.Component.IconDisplayMode.application
ghenv.Component.Category = "Honeybee"
ghenv.Component.SubCategory = "10 | Energy | Energy"
#compatibleHBVersion = VER 0.0.57\nNOV_04_2016
#compatibleLBVersion = VER 0.0.59\nFEB_01_2015
ghenv.Component.AdditionalHelpFromDocStrings = "2"

import rhinoscriptsyntax as rs
import Rhino as rc
import scriptcontext as sc
import os
import System
import Grasshopper.Kernel as gh
import uuid

tolerance = sc.doc.ModelAbsoluteTolerance
import math


def main(shdSurfaces, EPTransSchedule, meshingSettings, justBoundingBox):
    
    # import the classes
    if sc.sticky.has_key('honeybee_release'):

        try:
            if not sc.sticky['honeybee_release'].isCompatible(ghenv.Component): return -1
            if sc.sticky['honeybee_release'].isInputMissing(ghenv.Component): return -1
        except:
            warning = "You need a newer version of Honeybee to use this compoent." + \
            " Use updateHoneybee component to update userObjects.\n" + \
            "If you have already updated userObjects drag Honeybee_Honeybee component " + \
            "into canvas and try again."
            w = gh.GH_RuntimeMessageLevel.Warning
            ghenv.Component.AddRuntimeMessage(w, warning)
            return -1
        
        # don't customize this part
        hb_EPSrf = sc.sticky["honeybee_EPSurface"]
        hb_EPSHDSurface = sc.sticky["honeybee_EPShdSurface"]
        hb_RADMaterialAUX = sc.sticky["honeybee_RADMaterialAUX"]
        hb_EPObjectsAux = sc.sticky["honeybee_EPObjectsAUX"]()
        HBScheduleList = sc.sticky["honeybee_ScheduleLib"].keys()

        ########################################################################
        #----------------------------------------------------------------------#
        shdBreps = []
        # create bounding box of shading geometries
        if justBoundingBox:
            for brep in shdSurfaces:
                if brep.Faces.Count>1 or not brep.Faces[0].IsPlanar(sc.doc.ModelAbsoluteTolerance):
                    shdBreps.append(brep.GetBoundingBox(True).ToBrep())
                else:
                    shdBreps.append(brep)
        else:
            shdBreps = shdSurfaces
        
        shadingClasses = []
        shadingMeshPreview = []
        
        if meshingSettings == None:
            mp = rc.Geometry.MeshingParameters.Minimal
            mp.SimplePlanes = True
        else:
            mp = meshingSettings
        
        def getRadMaterialName(radMaterial):
            nameStr = radMaterial.split(" ")[2]
            name =  nameStr.split("\n")[0]
            return name
        
        for brepCount, brep in enumerate(shdBreps):
            if brep != None:
                isPlanar = True
                # check planarity
                for face in brep.Faces:
                    if not face.IsPlanar(tolerance):
                        isPlanar = False
                        break
                
                shadingBreps = []
                if not isPlanar:
                    meshArray = rc.Geometry.Mesh.CreateFromBrep(brep, mp)
                    for mesh in meshArray:
                        for meshFace in range(mesh.Faces.Count):
                            vertices = list(mesh.Faces.GetFaceVertices(meshFace))[1:]
                            vertices = vertices + [sc.doc.ModelAbsoluteTolerance]
                            # create the brep from mesh
                            shdBrep = rc.Geometry.Brep.CreateFromCornerPoints(*vertices)
                            shadingBreps.append(shdBrep)
                else:
                    for face in brep.Faces:
                        shadingBreps.append(face.DuplicateFace(False))
                
                for faceCount, shdBrep in enumerate(shadingBreps):
                        thisShading = hb_EPSHDSurface(shdBrep, 1000*brepCount + faceCount, 'shdSrf_' + `brepCount` + '_' + `faceCount` + "_" + str(uuid.uuid4()))
                        
                        # add transmittance schedule if any
                        if EPTransSchedule!=None:
                            schedule= EPTransSchedule.upper()
                            if schedule!=None and not schedule.lower().endswith(".csv") and schedule not in HBScheduleList:
                                msg = "Cannot find " + schedule + " in Honeybee schedule library."
                                print msg
                                ghenv.Component.AddRuntimeMessage(gh.GH_RuntimeMessageLevel.Warning, msg)
                                return -1
                            elif schedule!=None and schedule.lower().endswith(".csv"):
                                # check if csv file is existed
                                if not os.path.isfile(schedule):
                                    msg = "Cannot find the shchedule file: " + schedule
                                    print msg
                                    ghenv.Component.AddRuntimeMessage(gh.GH_RuntimeMessageLevel.Warning, msg)
                                    return -1
                            
                            thisShading.TransmittanceSCH = schedule
                        
                        # add the Rad Material if any
                        if RADMaterial!=None:
                            # if it is just the name of the material make sure it is already defined
                            if len(RADMaterial.split(" ")) == 1:
                                # if the material is not in the library add it to the library
                                if not hb_RADMaterialAUX.isMatrialExistInLibrary(RADMaterial):
                                    warningMsg = "Can't find " + RADMaterial + " in RAD Material Library.\n" + \
                                                "Add the material to the library and try again."
                                    ghenv.Component.AddRuntimeMessage(gh.GH_RuntimeMessageLevel.Warning, warningMsg)
                                    return
                                
                                try:
                                    thisShading.setRADMaterial(RADMaterial)
                                except Exception, e:
                                    print e
                                    warningMsg = "You are using an old version of Honeybee_Honeybee! Update your files and try again."
                                    print warningMsg
                                    ghenv.Component.AddRuntimeMessage(gh.GH_RuntimeMessageLevel.Warning, warningMsg)
                                    return
                                
                                addedToLib = True
                            else:
                                
                                # try to add the material to the library
                                addedToLib, thisShading.RadMaterial = hb_RADMaterialAUX.analyseRadMaterials(RADMaterial, True)
                                
                            if addedToLib==False:
                                warningMsg = "Failed to add " + RADMaterial + " to the Library."
                                ghenv.Component.AddRuntimeMessage(gh.GH_RuntimeMessageLevel.Warning, warningMsg)
                                return
                        
                        # add shading to the list
                        shadingClasses.append(thisShading)
                
        # add to the hive
        hb_hive = sc.sticky["honeybee_Hive"]()
        HBContext  = hb_hive.addToHoneybeeHive(shadingClasses, ghenv.Component)
        return HBContext
        ################################################################################################
    else:
        print "You should first let Honeybee to fly..."
        w = gh.GH_RuntimeMessageLevel.Warning
        ghenv.Component.AddRuntimeMessage(w, "You should first let Honeybee to fly...")
        return -1
        

if _shdSurfaces and _shdSurfaces[0]!=None:
    # add cleaning function
    result= main(_shdSurfaces, EPTransSchedule_, meshingSettings_, justBoundingBox_)
    
    if result != -1: HBContext = result
# ---------- end hb_epcontextsrf ----------

# ---- group: Reception
data_4 = Data(explode_tree_11.Branch0)

# ----
ach2m3_s_m2_calculator_3 = Honeybee_infORventPerAreaCalculator(HBZones=flatten(data_4), airFlowRate=division_2)  # -> out, infPerAreaFacade, ventPerAreaFloor, allExposed, allFloors; plug-in component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

# ---- group: Reception (continued)
setepzoneloads_3 = Honeybee_SetEnergyPlusZoneLoads(
    HBZones=data_4,
    equipmentLoadPerArea=explode_tree_5.Branch0,
    infilRatePerArea_Facade=ach2m3_s_m2_calculator_3.infPerAreaFacade,
    lightingDensityPerArea=explode_tree_5.Branch2,
    numOfPeoplePerArea=one_over_x_2,
    ventilationPerArea=explode_tree_5.Branch4,
    ventilationPerPerson=panel_20,
    recirculatedAirPerArea=explode_tree_5.Branch4)  # -> loads, HBZones; plug-in component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
setepzoneschedules_3 = Honeybee_SetEnergyPlusZoneSchedules(
    HBZones=setepzoneloads_3.HBZones,
    occupancySchedules=explode_tree_8.Branch0,
    occupancyActivitySchs=explode_tree_8.Branch3,
    heatingSetPtSchedules=explode_tree_6.Branch1,
    coolingSetPtSchedules=explode_tree_7.Branch1,
    lightingSchedules=explode_tree_8.Branch4,
    equipmentSchedules=explode_tree_8.Branch5,
    infiltrationSchedules=explode_tree_8.Branch6)  # -> schedules, simplify(HBZones); plug-in component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
setepzonethresholds_2 = Honeybee_SetEnergyPlusZoneThresholds(HBZones=setepzoneschedules_3.HBZones)  # -> out, HBZones; plug-in component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

# ---- group: HB Zones
office_and_reception = Data([setepzonethresholds_2.HBZones, setepzonethresholds.HBZones])
attic = Data(setepzoneschedules.HBZones)
all_zones = Data(flatten([attic, office_and_reception]))

# ----
# Simulation
conv_alg = Panel("TARP")
duplicate_data_7 = DuplicateData(Data=conv_alg, Number="5", Order=True)
setzoneprop = Honeybee_SetZoneProperties(HBZones=all_zones, inConvAlg=duplicate_data_7, outConvAlg=duplicate_data_7)  # -> HBZones; plug-in component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
panel_33 = Panel("C:\Users\amd\Desktop\[BENV0088]_[FBXX7]_[05052020]\1.Compare EP vs HB\edit_fraction_radiant")
people = Slider(0.5, range=0..1)
lights = Slider(0.37, range=0..1)
equipment = Slider(0.2, range=0..1)
panel_34 = Panel("""timestep
hourly
daily
monthly
annual""")
shadowpar = Honeybee_ShadowPar(frequency="20")  # -> shadowPar; plug-in component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
duplicate_data_8 = DuplicateData(Data="14", Number="12", Order=True)
gatwick_weather_file = Panel("https://www.energyplus.net/weather-download/europe_wmo_region_6/GBR//GBR_London.Gatwick.037760_IWEC/all")
boolean_toggle_4 = BooleanToggle(True)
item_selector = ItemSelector(panel_34, {"timestep", "hourly", "daily", "monthly", "annual"}, selected="hourly")
edit_fraction_radiant = EditFractionRadiantOfLightingAndEquipment(port=panel_33, Lights_Fraction_Radiant=lights, Equipment_Fraction_Radiant=equipment, People_Fraction_Radiant=people)  # -> out, OSMeasure; plug-in component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
sizing = Panel("1")
fullexterior = Panel("1")
timestep = Panel("6")
epoutput = Honeybee_GenerateEPOutput(
    zoneEnergyUse=boolean_toggle_4,
    zoneGainsAndLosses="False",
    zoneComfortMetrics=boolean_toggle_4,
    surfaceTempAnalysis="False",
    timestep=item_selector)  # -> out, flatten(simulationOutputs); plug-in component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
energysimpar = Honeybee_EnergySimulationPar(
    timestep=timestep,
    shadowCalcPar=shadowpar,
    solarDistribution=fullexterior,
    startDayOfWeek=sun,
    heatingSizingFactor=sizing,
    coolingSizingFactor=sizing,
    terrain="Suburbs",
    monthlyGrndTemps=duplicate_data_8)  # -> energySimPar; plug-in component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
epw_stat = Ladybug_OpenEPWAndSTATWeatherFiles(weatherFileURL=gatwick_weather_file)  # -> epwFile, statFile; plug-in component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
false_start_toggle = FalseStartToggle(True)
panel_35 = Panel("Ladybug")

hvacsystem = Honeybee_AssignHVACSystem(HBZones=flatten(setzoneprop), HVACSystems=panel_24)  # -> readMe, HBZones; plug-in component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

exporttoopenstudio = Honeybee_ExportToOpenStudio(
    epwWeatherFile=epw_stat.epwFile,
    energySimPar=energysimpar,
    HBZones=flatten(hvacsystem.HBZones),
    HBContext=flatten(hb_epcontextsrf),
    simulationOutputs=flatten(epoutput.simulationOutputs),
    OSMeasures=flatten(edit_fraction_radiant.OSMeasure),
    writeOSM=false_start_toggle,
    runSimulation=Slider(3, range=0..3),
    fileName=format_5,
    workingDir="C:\ladybug\BENV0088_CW\SA16")  # -> out, osmFileAddress, idfFileAddress, resultFileAddress, eioFileAddress, rddFileAddress, htmlReport, studyFolder, model; plug-in component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

panel_36 = Panel(exporttoopenstudio.out)

# ----
# Batch parallel run
panel_37 = Panel("C:\ladybug\BENV0088_CW\SA16")
lookupfolder_energyplus = Honeybee_LookupEnergyPlusFolder(studyFolder=panel_37)  # -> out, idfFiles, osmFiles, resultFileAddress, scheduleCsvFiles, rddFiles, errFiles, eioFiles, esoFiles, sqlFiles; plug-in component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
false_start_toggle_2 = FalseStartToggle(True)
list_length = ListLength(List=lookupfolder_energyplus.idfFiles)
re_run_idf = Honeybee_ReRunIDF(
    idfFilePath=lookupfolder_energyplus.idfFiles,
    epwFileAddress=epw_stat.epwFile,
    parallel=false_start_toggle_2,
    runIt=false_start_toggle_2)  # -> out, resultFileAddress, eioFileAddress, rddFileAddress; plug-in component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
number_slider_2 = Slider(0, range=0..147)
false_start_toggle_3 = FalseStartToggle(False)
fly_2 = Ladybug_fly(inputSliders=number_slider_2, fly=false_start_toggle_3)  # -> Vviiiiiiiiiizzz; plug-in component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
list_length_2 = ListLength(List=re_run_idf.resultFileAddress)
list_item_7 = ListItem(List=re_run_idf.resultFileAddress, Index=number_slider_2, Wrap=True)

panel_38 = Panel(list_length)
panel_39 = Panel(list_length_2)
data_5 = Data(list_item_7)

# ---- group: Results
readepresult = Honeybee_ReadEPResult(resultFileAddress=data_5)  # -> port, port_2, cooling, heating, electricLight, electricEquip, fanElectric, pumpElectric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; plug-in component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
strnum = Ladybug_SeparateData(inputList=flatten(readepresult.electricLight))  # -> numbers, strings; plug-in component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
strnum_2 = Ladybug_SeparateData(inputList=flatten(readepresult.electricEquip))  # -> numbers, strings; plug-in component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
strnum_3 = Ladybug_SeparateData(inputList=flatten(readepresult.fanElectric))  # -> numbers, strings; plug-in component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
strnum_4 = Ladybug_SeparateData(inputList=flatten(readepresult.cooling))  # -> numbers, strings; plug-in component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
strnum_5 = Ladybug_SeparateData(inputList=flatten(readepresult.heating))  # -> numbers, strings; plug-in component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
strnum_6 = Ladybug_SeparateData(inputList=flatten(readepresult.pumpElectric))  # -> numbers, strings; plug-in component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
mass_addition = MassAddition(Input=flatten(strnum_4.numbers))  # -> Result, PartialResults
mass_addition_2 = MassAddition(Input=flatten(strnum.numbers))  # -> Result, PartialResults
mass_addition_3 = MassAddition(Input=flatten(strnum_2.numbers))  # -> Result, PartialResults
mass_addition_4 = MassAddition(Input=flatten(strnum_3.numbers))  # -> Result, PartialResults
mass_addition_5 = MassAddition(Input=flatten(strnum_6.numbers))  # -> Result, PartialResults
mass_addition_6 = MassAddition(Input=strnum_5.numbers)  # -> Result, PartialResults
heating = Panel(mass_addition_6.Result)
light = Panel(mass_addition_2.Result)
equip = Panel(mass_addition_3.Result)
fan = Panel(mass_addition_4.Result)
cooling = Panel(mass_addition.Result)
pump = Panel(mass_addition_5.Result)

# ----
# Input parameters
panel_40 = Panel("\")
text_split = TextSplit(Text=data_5, Separators=panel_40)  # -> simplify(Result)
flip_matrix_3 = FlipMatrix(Data=text_split)
tree_branch = TreeBranch(Tree=simplify(flip_matrix_3), Path=Slider(4, range=0..10), MaintainPaths=True)
text_split_2 = TextSplit(Text=tree_branch, Separators="_")
series_7 = Series(Start="0", Step=1, Count=Slider(14, range=0..20))
flip_matrix_4 = FlipMatrix(Data=text_split_2)
panel_41 = Panel(panel_25)
tree_branch_2 = TreeBranch(Tree=simplify(flip_matrix_4), Path=series_7, MaintainPaths=True)
number_14 = Number(tree_branch_2)
explode_tree_12 = ExplodeTree(Data=number_14)  # -> Branch0, Branch1, Branch2, Branch3, Branch4, Branch5, Branch6, Branch7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
format_8 = Format(
    Format=panel_41,
    Culture=127,
    Data0=explode_tree_12.Branch0,
    Data1=explode_tree_12.Branch1,
    Data2=explode_tree_12.Branch2,
    Data3=explode_tree_12.Branch3,
    Data4=explode_tree_12.Branch4,
    Data5=explode_tree_12.Branch5,
    Data6=explode_tree_12.Branch6,
    Data7=explode_tree_12.Branch7,
    Data8=explode_tree_12.Branch8,
    Data9=explode_tree_12.Branch9,
    Data10=explode_tree_12.Branch10,
    Data11=explode_tree_12.Branch11,
    Data12=explode_tree_12.Branch12,
    Data13=explode_tree_12.Branch13)
input = Panel(format_8)

format_9 = Format(Format="{0:0000}_", Culture=127, Data0=number_slider_2)
concatenate_4 = Concatenate(FragmentA=format_9, FragmentB=input)

# ----
# Objective 2
# Minimize  -min(zones PPD < 10%)
remove_attic = Panel("""1
2
3
4""")
tree_branch_3 = TreeBranch(Tree=readepresult.airTemperature, Path=remove_attic, MaintainPaths=True)
tree_branch_4 = TreeBranch(Tree=readepresult.meanRadTemperature, Path=remove_attic, MaintainPaths=True)
tree_branch_5 = TreeBranch(Tree=readepresult.relativeHumidity, Path=remove_attic, MaintainPaths=True)
strnum_7 = Ladybug_SeparateData(inputList=flatten(tree_branch_3))  # -> numbers, strings; plug-in component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
strnum_8 = Ladybug_SeparateData(inputList=flatten(tree_branch_4))  # -> numbers, strings; plug-in component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
boolean_occupancy = Data([False, False, False, False, False, False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])
convertepschvalues = Honeybee_ConvertEnergyPlusScheduleToValues(schName="ClothingS")  # -> values, holidays; plug-in component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
strnum_9 = Ladybug_SeparateData(inputList=flatten(convertepschvalues.values))  # -> numbers, strings; plug-in component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
cull_pattern = CullPattern(List=strnum_7.numbers, CullPattern=boolean_occupancy)
cull_pattern_2 = CullPattern(List=strnum_8.numbers, CullPattern=boolean_occupancy)
cull_pattern_3 = CullPattern(List=strnum_9.numbers, CullPattern=boolean_occupancy)
met = Panel("""1.2
1.4
1.2
1.2""")
false_start_toggle_4 = FalseStartToggle(False)
wind_speed_m_s = Panel("0.137")

strnum_10 = Ladybug_SeparateData(inputList=flatten(tree_branch_5))  # -> numbers, strings; plug-in component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
cull_pattern_4 = CullPattern(List=strnum_10.numbers, CullPattern=boolean_occupancy)

pmvcomfortcalculator = Ladybug_PMVComfortCalculator(
    dryBulbTemperature=cull_pattern,
    meanRadiantTemperature=cull_pattern_2,
    windSpeed=wind_speed_m_s,
    relativeHumidity=cull_pattern_4,
    metabolicRate=graft(met),
    clothingLevel=cull_pattern_3,
    calcBalanceTemperature=False,
    runIt=false_start_toggle_4)  # -> readMe, port, predictedMeanVote, percentPeopleDissatisfied, standardEffectiveTemperature, port_2, comfortableOrNot, percentOfTimeComfortable, port_3, balanceTemperature; plug-in component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
sort_list = SortList(Keys=flatten(pmvcomfortcalculator.percentOfTimeComfortable))  # -> Keys, ValuesValuesA
list_item_8 = ListItem(List=sort_list.Keys, Index="0", Wrap=True)
negative = Negative(Value=list_item_8)
panel_42 = Panel(negative)
ppd_20 = Number(negative)

concatenate_5 = Concatenate(FragmentA=format_9, FragmentB=ppd_20)

# ----
# Objective 1
# Minimize  CO2
panel_43 = Panel("2")
list_item_9 = ListItem(List=strnum_5.strings, Index=panel_43, Wrap=True)
panel_44 = Panel("""boiler
gas""")
match_text = MatchText(Text=list_item_9, RegEx=panel_44, Case=Toggle(False))
list_item_10 = ListItem(List=match_text, Index="0", Wrap=True)
list_item_11 = ListItem(List=match_text, Index="1", Wrap=True)
gate_or = GateOr(A=list_item_10, B=list_item_11)
ghpython_script = GhPythonScript(x=gate_or, y=heating)  # -> out, flatten(a), flatten(b)
# ---------- ghpython_script: Python ----------
__author__ = "BT"
__version__ = "2020.04.23"

import rhinoscriptsyntax as rs
a=0
b=0
if x == True:
    a=y
    b=0
else:
    b=y
    a=0
# ---------- end ghpython_script ----------
mass_addition_7 = MassAddition(Input=ghpython_script.a)  # -> Result, PartialResults
mass_addition_8 = MassAddition(Input=[light, equip, fan, pump, cooling, ghpython_script.b])  # -> Result, PartialResults
kwh_to_co2 = Panel("0.19")
kwh_to_co2_2 = Panel("0.55")
electricity = Panel(mass_addition_8.Result)
fossil = Panel(mass_addition_7.Result)
multiplication_3 = Multiplication(A=kwh_to_co2, B=mass_addition_7.Result)
multiplication_4 = Multiplication(A=mass_addition_8.Result, B=kwh_to_co2_2)
mass_addition_9 = MassAddition(Input=[multiplication_4, multiplication_3])  # -> Result, PartialResults
kgco2 = Panel(multiplication_3)
kgco2_2 = Panel(multiplication_4)

round_3 = Round(Number=mass_addition_9.Result)  # -> Nearest, Floor, Ceiling

kgco2_3 = Panel(round_3.Nearest)
co2 = Number(round_3.Nearest)

concatenate_6 = Concatenate(FragmentA=format_9, FragmentB=co2)
entwine = Entwine(Branch00=concatenate_4, Branch01=concatenate_6, Branch02=concatenate_5, FlattenInputs=True)  # -> simplify(Result)
data_recorder = DataRecorder(entwine, DataLimit=-10, RecordData=True)
quick_look = Panel(data_recorder)
tree_branch_6 = TreeBranch(Tree=data_recorder, Path="1", MaintainPaths=True)
tree_branch_7 = TreeBranch(Tree=data_recorder, Path="0", MaintainPaths=True)
tree_branch_8 = TreeBranch(Tree=data_recorder, Path="2", MaintainPaths=True)
format_10 = Format(Format="{0} {1} {2}", Culture=127, Data0=tree_branch_7, Data1=tree_branch_6, Data2=tree_branch_8)
copy_data_to_txt_file = Panel(format_10)
