# Grasshopper definition BENV0088 - S13_Colibri_Octopus.gh (Grasshopper 1.0.7)
# plug-ins: Human, FalseStartToggle, Octopus, Ironbug, Colibri, TT Toolbox

honeybee = Honeybee_Honeybee()  # -> out; plug-in component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
ladybug = Ladybug_Ladybug()  # -> out; plug-in component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
# Upper bound
lb_schedule = GenePool(Decimals=0, Maximum=10, Minimum=0, Value=[3.333333333, 5.555555556, 6, 4, 7, 5, 5, 5, 7, 3, 3, 3, 5])
# Lower bound
lb_schedule_2 = GenePool(Decimals=0, Maximum=10, Minimum=0, Value=[1, 1, 1, 0, 1, 0, 0, 0, 0, 0, 0, 0, 0])
number = Number()

shgc = Slider(9, range=6..10, expression="x/10")
wu = Slider(1, range=1..4)

# ----
# Window U
# Window SHGC
# Ins Th
# Ins Lambda
# CoolingSetBack
# CoolingSP_Rec
# CoolingSP_Offi
# HeatingSetBack
# HeatingSP_Rec
# HeatingSP_Offi
# ShadeDepth
# NumOfShades
panel = Panel(number)

insth = Slider(5, range=1..6)
insla = Slider(1, range=0..4)

# ----
# Import Process
boolean_toggle = BooleanToggle(True)
honeybee_surface_attribute_list = Honeybee_SurfaceAttributeList({"Name": "name", "Radiance Material": "RadMaterial", "EnergyPlus Construction": "EPConstruction", "Surface Type": "type", "Boundary Condition": "BC", "BC Object": "BCObject", "Sun Exposure": "sunExposure", "Wind Exposure": "windExposure", "Has Child Surface": "hasChild", "Is Child Surface": "isChild", "Is Planar": "isPlanar", "Srf Type Set By User": "srfTypeByUser", "Boundary Condition Set By User": "srfBCByUser", "Shade Material Name": "shadeMaterialName", "Shading Control Name": "shadingControlName", "Shcading Schedule Name": "shadingSchName"}, selected="Name")
file_path = FilePath("C:\ladybug\BENV0088_CW\ExistingBulding_HeatSurface.idf")
importidf = Honeybee_ImportIdf(idfFile=file_path, importEPObjects=boolean_toggle)  # -> out, HBZones, shadings; plug-in component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
idf_from_moodle = Panel(file_path)
labelsurfaces = Honeybee_LabelZoneSurfaces(HBObjects=flatten(importidf.HBZones), attribute=honeybee_surface_attribute_list, windows=Toggle(True))  # -> surfaceTxtLabels, labelBasePts, brepTxtLabels, surfaceWireFrames; plug-in component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
remglz = Honeybee_RemoveGlazing(HBZones=flatten(importidf.HBZones), windowName=labelsurfaces.surfaceTxtLabels)  # -> out, HBZones; plug-in component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
flip_matrix = FlipMatrix(Data=labelsurfaces.surfaceWireFrames)
boolean_toggle_2 = BooleanToggle(True)
panel_2 = Panel("""EastZone
Attic
Reception
WestZone
SouthZone""")
panel_3 = Panel("""True
False
True
True
True""")
explode_tree = ExplodeTree(Data=flip_matrix)  # -> Branch0, Branch1, Branch2, Branch3
mass2zone = Honeybee_Masses2Zones(
    zoneMasses=flatten(remglz.HBZones),
    zoneNames=panel_2,
    isConditioned=panel_3,
    maxRoofAngle="70",
    createHBZones=boolean_toggle_2)  # -> out, HBZones; plug-in component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
edge_surface = EdgeSurface(CurveA=explode_tree.Branch0, CurveB=explode_tree.Branch1, CurveC=explode_tree.Branch2, CurveD=explode_tree.Branch3)
solveadjc = Honeybee_SolveAdjacencies(HBZones=flatten(mass2zone.HBZones), removeCurrentAdjc=False, findAdjc=boolean_toggle_2)  # -> out, HBZonesWADJ; plug-in component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
addhbglz = Honeybee_addHBGlz(
    HBObj=solveadjc.HBZonesWADJ,
    childSurfaces=flatten(edge_surface),
    childSurfacesName=flatten(labelsurfaces.surfaceTxtLabels))  # -> flatten(HBObjWGLZ); plug-in component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

csp_r = Slider(5, range=0..5, expression="23+x")
csp_o = Slider(4, range=0..5, expression="23+x")
csb = Slider(2, range=0..5, expression="30+x")
hsp_r = Slider(0, range=0..3, expression="18+x")
hsp_o = Slider(1, range=0..3, expression="18+x")
hsb = Slider(4, range=0..5, expression="12+x")

number_2 = Number(wu)

# ----
# Weekend
# Holiday
# Schedules
# SummerDesignDay
# WinterDesignDay
# Weekday
# Weekend
# Holiday
# SummerDesignDay
# WinterDesignDay
# Weekday
# SummerDesignDay
# Weekday
# Schedules
# WinterDesignDay
# Weekend
# SummerDesignDay
# Weekday
# Weekend
# Holiday
# SummerDesignDay
# WinterDesignDay
# Weekday
# Summer
schedules_type_limits = Panel("""ActivityLevel
ActivityLevel
Fractional
Fractional
Fractional""")
constant_schedule_names = Panel("""Activity_Office
Activity_Circulation
Air Velocity
Infiltration
Always_ON""")
constant_values = Panel("""125
145
0.137
1
1""")
panel_4 = Panel("""12
12
12
12
12
12
21
21
21
21
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""")
constantschedule = Honeybee_ConstantSchedule(value=graft(constant_values), scheduleName=graft(constant_schedule_names), schedTypeLimits=graft(schedules_type_limits))  # -> out, flatten(schedule), weekSched, schedIDFText; plug-in component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
constantschedule_2 = Honeybee_ConstantSchedule(value=Slider(1, range=0..1), scheduleName="CloWinter")  # -> out, schedule, weekSched, schedIDFText; plug-in component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
constantschedule_3 = Honeybee_ConstantSchedule(value=Slider(0.5, range=0..1), scheduleName="CloSummer")  # -> out, schedule, weekSched, schedIDFText; plug-in component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
file_path_2 = FilePath("C:\Users\BT\OneDrive - University College London\2.Integrated Building Systems Simulation\Hourly_Schedules.csv")
analysisperiod = Ladybug_AnalysisPeriod(
    fromMonth=Slider(4, range=1..12),
    fromDay=Slider(2, range=1..31),
    fromHour=Slider(1, range=0..1),
    toMonth=Slider(9, range=1..12),
    toDay=Slider(30, range=1..31),
    toHour=Slider(24, range=1..24))  # -> out, analysisPeriod; plug-in component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
replace = Panel(csb)
find = Panel("18")
find_2 = Panel("21")
replace_2 = Panel(csp_r)
replace_3 = Panel(csp_o)
find_3 = Panel("12")
find_4 = Panel("18")
find_5 = Panel("21")
replace_4 = Panel(hsb)
replace_5 = Panel(hsp_r)
replace_6 = Panel(hsp_o)
find_6 = Panel("12")
read_excel_sheet = ReadExcelSheet(Run=Toggle(True), FilePath=file_path_2, Worksheet="1", Listen=False)  # -> UserMessages, Columns, Rows
replace_text = ReplaceText(Text=panel_4, Find=find_3, Replace=replace, RecursiveReplace=False)
panel_5 = Panel(constantschedule.schedule)
replace_text_2 = ReplaceText(Text=panel_4, Find=find_6, Replace=replace_4, RecursiveReplace=False)
replace_text_3 = ReplaceText(Text=replace_text, Find=find, Replace=replace_2, RecursiveReplace=False)
explode_tree_2 = ExplodeTree(Data=read_excel_sheet.Columns)  # -> Branch0, Branch1, Branch2, Branch3, Branch4, Branch5, Branch6, Branch7
replace_text_4 = ReplaceText(Text=replace_text_2, Find=find_4, Replace=replace_5, RecursiveReplace=False)
honeybee_seasonalschedule = Honeybee_SeasonalSchedule(
    scheduleName="ClothingS",
    baseWeekSched=constantschedule_2.schedule,
    seasonWeekSched1=constantschedule_3.schedule,
    analysisPeriod1=analysisperiod.analysisPeriod)  # -> out, schedule, schedIDFText; plug-in component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
replace_text_5 = ReplaceText(Text=replace_text_3, Find=find_2, Replace=replace_3, RecursiveReplace=False)
replace_text_6 = ReplaceText(Text=replace_text_4, Find=find_5, Replace=replace_6, RecursiveReplace=False)
merge = Merge(Data1=explode_tree_2.Branch1, Data2=explode_tree_2.Branch2, Data3=explode_tree_2.Branch4)
series = Series(Start=Slider(25, range=0..10000), Step=1, Count=Slider(24, range=0..2200))
partition_list = PartitionList(List=replace_text_5, Size="24")
merge_2 = Merge(Data1=explode_tree_2.Branch6, Data2=explode_tree_2.Branch7)
partition_list_2 = PartitionList(List=replace_text_6, Size="24")
series_2 = Series(Start=Slider(25, range=0..10000), Step=1, Count=Slider(24, range=0..2200))
variable_schedules = Panel("""HeatingSP_Office
HeatingSP_Reception""")
variable_schedules_2 = Panel("""CoolingSP_Office_{0}_{1}
CoolingSP_Reception_{2}_{1}""")
panel_6 = Panel("""Temperature
Temperature""")
variable_schedules_3 = Panel("""HeatingSP_Office_{0}_{1}
HeatingSP_Reception_{2}_{1}""")
list_item = ListItem(List=merge_2, Index=series, Wrap=True)
panel_7 = Panel("""12
12""")
list_item_2 = ListItem(List=explode_tree_2.Branch5, Index=series_2, Wrap=True)
series_3 = Series(Start=Slider(1, range=0..10000), Step=1, Count=Slider(24, range=0..2200))
duplicate_data = DuplicateData(Data=graft(panel_7), Number="24", Order=True)
series_4 = Series(Start=Slider(25, range=0..10000), Step=1, Count=Slider(24, range=0..2200))
variable_schedules_4 = Panel("""People_Office
People_Reception
Lighting""")
duplicate_data_2 = DuplicateData(Data=graft(replace), Number=2, Order=True)
format = Format(Format=variable_schedules_2, Culture=127, Data0=replace_3, Data1=replace, Data2=replace_2)
quick_graph = QuickGraph(list_item_2, SortOrder=0)
duplicate_data_3 = DuplicateData(Data=graft("0.05"), Number="24", Order=True)
duplicate_data_4 = DuplicateData(Data=graft("0"), Number="24", Order=True)
duplicate_data_5 = DuplicateData(Data=graft(replace_4), Number=2, Order=True)
list_item_3 = ListItem(List=merge, Index=series_3, Wrap=True)
format_2 = Format(Format=variable_schedules_3, Culture=127, Data0=replace_6, Data1=replace_4, Data2=replace_5)
list_item_4 = ListItem(List=merge, Index=series_4, Wrap=True)
panel_8 = Panel("""0
0
0""")
quick_graph_2 = QuickGraph(list_item, SortOrder=0)
quick_graph_3 = QuickGraph(duplicate_data, SortOrder=0)
duplicate_data_6 = DuplicateData(Data=graft(panel_8), Number="24", Order=True)
annualschedule = Honeybee_AnnualSchedule(
    sun=duplicate_data,
    mon=list_item,
    tue=list_item,
    wed=list_item,
    thu=list_item,
    fri=list_item,
    sat=duplicate_data,
    holiday=duplicate_data,
    coolDesignDay=list_item,
    heatDesignDay=list_item,
    scheduleName=graft(variable_schedules),
    schedTypeLimits=graft(panel_6),
    runIt=Toggle(True))  # -> out, port, schedule, port_2, weekSched, schedIDFText; plug-in component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
panel_9 = Panel("""Temperature
Temperature""")
panel_10 = Panel("""Temperature
Temperature""")
quick_graph_4 = QuickGraph(partition_list, SortOrder=0)
quick_graph_5 = QuickGraph(duplicate_data_2, SortOrder=0)
quick_graph_6 = QuickGraph(partition_list_2, SortOrder=0)
quick_graph_7 = QuickGraph(duplicate_data_5, SortOrder=0)
annualschedule_2 = Honeybee_AnnualSchedule(
    sun=duplicate_data_3,
    mon=list_item_2,
    tue=list_item_2,
    wed=list_item_2,
    thu=list_item_2,
    fri=list_item_2,
    sat=duplicate_data_3,
    holiday=duplicate_data_3,
    coolDesignDay=list_item_2,
    heatDesignDay=duplicate_data_4,
    scheduleName="Equipment",
    schedTypeLimits="Fractional",
    runIt=Toggle(True))  # -> out, port, schedule, port_2, weekSched, schedIDFText; plug-in component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
quick_graph_8 = QuickGraph(list_item_4, SortOrder=0)
quick_graph_9 = QuickGraph(list_item_3, SortOrder=0)
annualschedule_3 = Honeybee_AnnualSchedule(
    sun=duplicate_data_2,
    mon=partition_list,
    tue=partition_list,
    wed=partition_list,
    thu=partition_list,
    fri=partition_list,
    sat=duplicate_data_2,
    holiday=duplicate_data_2,
    coolDesignDay=partition_list,
    heatDesignDay=partition_list,
    scheduleName=graft(format),
    schedTypeLimits=graft(panel_10),
    runIt=Toggle(True))  # -> out, port, schedule, port_2, weekSched, schedIDFText; plug-in component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
annualschedule_4 = Honeybee_AnnualSchedule(
    sun=duplicate_data_5,
    mon=partition_list_2,
    tue=partition_list_2,
    wed=partition_list_2,
    thu=partition_list_2,
    fri=partition_list_2,
    sat=duplicate_data_5,
    holiday=duplicate_data_5,
    coolDesignDay=partition_list_2,
    heatDesignDay=partition_list_2,
    scheduleName=graft(format_2),
    schedTypeLimits=graft(panel_9),
    runIt=Toggle(True))  # -> out, port, schedule, port_2, weekSched, schedIDFText; plug-in component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
annualschedule_5 = Honeybee_AnnualSchedule(
    sun=list_item_3,
    mon=list_item_4,
    tue=list_item_4,
    wed=list_item_4,
    thu=list_item_4,
    fri=list_item_4,
    sat=list_item_3,
    holiday=duplicate_data_6,
    coolDesignDay=list_item_4,
    heatDesignDay=list_item_3,
    scheduleName=graft(variable_schedules_4),
    runIt=Toggle(True))  # -> out, port, flatten(schedule), port_2, weekSched, schedIDFText; plug-in component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
panel_11 = Panel(annualschedule.schedule)
panel_12 = Panel(annualschedule_3.schedule)
panel_13 = Panel(annualschedule_2.schedule)
panel_14 = Panel(annualschedule_4.schedule)

format_3 = Format(Format="{0:0.0}_{1:0.0}", Culture=127, Data0=number_2, Data1=shgc)
concatenate = Concatenate(FragmentA="Glazing_", FragmentB=format_3)
decomposeepconstruction = Honeybee_DecomposeEPConstruction(cnstrName="Solid ground floor")  # -> materials, comments, UValue_SI, UValue_IP, RValue_SI, RValue_IP; plug-in component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

# ---- group: Materials
epopaquemat = Honeybee_EnergyPlusOpaqueMaterial(
    name="RADIANT_METAL_SURFACE",
    roughness="Smooth",
    thickness="0.003",
    conductivity="30",
    density="7824",
    specificHeat="500")  # -> EPMaterial; plug-in component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

# ----
panel_15 = Panel(decomposeepconstruction.materials)

epopaquemat_2 = Honeybee_EnergyPlusOpaqueMaterial(
    name="Anhydrite_Screed",
    roughness="Rough",
    thickness="0.06",
    conductivity="2",
    density="2000",
    specificHeat="2000",
    thermAbsp="0.9",
    solAbsp="0.6")  # -> EPMaterial; plug-in component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

explode_tree_3 = ExplodeTree(Data=simplify(graft(decomposeepconstruction.materials)))  # -> Branch0, Branch1, Branch2, Branch3

# ---- group: Materials
# Radiant Floor
data = Data(epopaquemat)
panel_16 = Panel("RadiantFloor")
epconstruction = Honeybee_EnergyPlusConstruction(
    name=panel_16,
    layer_1=explode_tree_3.Branch0,
    layer_2=explode_tree_3.Branch1,
    layer_3=explode_tree_3.Branch2,
    layer_4="Internal Source",
    layer_5=data,
    layer_6=epopaquemat_2)  # -> EPConstruction; plug-in component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

# ----
infiltration = Slider(1, range=1..7)
number_3 = Number(infiltration)
division = Division(A=number_3, B="10")
panel_17 = Panel(division)
panel_18 = Panel("""16
0.7
3
8
0""")
panel_19 = Panel("""2
0.7
3
3
0""")
explode_tree_4 = ExplodeTree(Data=graft(panel_18))  # -> Branch0, Branch1, Branch2, Branch3, Branch4
explode_tree_5 = ExplodeTree(Data=graft(panel_19))  # -> Branch0, Branch1, Branch2, Branch3, Branch4
one_over_x = OneOverX(Value=explode_tree_4.Branch3)
one_over_x_2 = OneOverX(Value=explode_tree_5.Branch3)
panel_20 = Panel("0.0125")
panel_21 = Panel("""People_Reception
People_Office
Activity_Office
Activity_Circulation
Lighting
Equipment
Infiltration
HeatingSP_Office
HeatingSP_Reception""")
explode_tree_6 = ExplodeTree(Data=simplify(panel_14))  # -> Branch0, Branch1
explode_tree_7 = ExplodeTree(Data=simplify(panel_12))  # -> Branch0, Branch1
explode_tree_8 = ExplodeTree(Data=graft(panel_21))  # -> Branch0, Branch1, Branch2, Branch3, Branch4, Branch5, Branch6, Branch7, Branch8
number_slider = Slider(60, range=0..100)
number_slider_2 = Slider(40, range=0..100)

# ----
# EIR
panel_22 = Panel("40")
panel_23 = Panel("""0.92763489
-0.00667789
0.00022986
-0.00161427
0.000092
-0.0002995""")
objparams = Ironbug_ObjParams(
    MaximumValueofx="95",
    MaximumValueofy="46",
    MinimumValueofx="70",
    MinimumValueofy=panel_22,
    DataFieldSetType="Ironbug.HVAC.Curves.IB_CurveBiquadratic_FieldSet")
curvebiquadratic = Ironbug_CurveBiquadratic(Coefficients=panel_23, Parameters_=objparams, dupNum=False)

# ----
# Capacity
panel_24 = Panel("40")
panel_25 = Panel("""0.43949801
0.00056385
-0.00001518
0.01713529
0.00011668
-0.00009652""")
objparams_2 = Ironbug_ObjParams(
    MaximumValueofx="95",
    MaximumValueofy="46",
    MinimumValueofx="70",
    MinimumValueofy=panel_24,
    DataFieldSetType="Ironbug.HVAC.Curves.IB_CurveBiquadratic_FieldSet")
curvebiquadratic_2 = Ironbug_CurveBiquadratic(Coefficients=panel_25, Parameters_=objparams_2, dupNum=False)

radctrth = Slider(1, range=1..3)
radsurftype = Slider(0, range=0..3)
dtrad = Slider(6, range=3..6)
radcoillowt = Slider(1, range=0..5, expression="18+x")
sd = Slider(0, range=0..3, expression="x/10")
nofs = Slider(4, range=0..5)
doashc = Slider(0, range=0..10)
doas_sht = Slider(7, range=0..9, expression="21+x")
doas_slt = Slider(9, range=0..10, expression="10+x")

boolean_toggle_3 = BooleanToggle(True)
ironbug_outputparams = Ironbug_OutputParams(
    ChillerHeaterSystemHeatingElectricEnergy=boolean_toggle_3,
    ChillerHeaterSystemHeatingEnergy=boolean_toggle_3,
    outputFrequency=1)
objparams_3 = Ironbug_ObjParams(Name="HeatPump", DataFieldSetType="Ironbug.HVAC.IB_CentralHeatPumpSystem_FieldSet")

# ----
# Reference:
# https://github.com/NREL/EnergyPlus/blob/bee886ab567181a306a8c2e7c678d6a1063b0bb0/testfiles/CentralChillerHeaterSystem_Simultaneous_Cooling_Heating.idf
# HP&CHW
panel_26 = Panel("12500")
objparams_4 = Ironbug_ObjParams(
    CoolingModeCoolingCapacityFunctionOfTemperatureCurve=curvebiquadratic_2,
    CoolingModeElectricInputToCoolingOutputRatioFunctionOfTemperatureCurve=curvebiquadratic,
    HeatingModeCoolingCapacityFunctionOfTemperatureCurve=curvebiquadratic_2,
    HeatingModeElectricInputToCoolingOutputRatioFunctionOfTemperatureCurve=curvebiquadratic,
    ReferenceCoolingModeCOP="5.5",
    ReferenceCoolingModeEvaporatorCapacity=panel_26,
    DataFieldSetType="Ironbug.HVAC.IB_ChillerHeaterPerformanceElectricEIR_FieldSet")
objparams_5 = Ironbug_ObjParams(NumberofChillerHeaterModules="3", DataFieldSetType="Ironbug.HVAC.IB_CentralHeatPumpSystemModule_FieldSet")
chillerheater = Ironbug_ChillerHeaterPerformanceElectricEIR(Parameters_=objparams_4, dupNum=False)  # -> flatten(ChillerHeaters)
chillerheatermodule = Ironbug_CentralHeatPumpSystemModule(ChillerHeater=chillerheater, Parameters_=objparams_5, dupNum=False)
centralheatpumpsystem = Ironbug_CentralHeatPumpSystem(ChillerHeaters=chillerheatermodule, Parameters_=[ironbug_outputparams, objparams_3], dupNum=False)  # -> ToDW_Demand, ToCW_Supply, ToHW_Supply

# ----
# Reference DataSet:
# https://github.com/NREL/EnergyPlus/blob/e94c9babac891617b828ec1a5f6f44b33dac491b/datasets/GLHERefData.idf
# VERTICAL GROUND SOURCE
# HEAT EXCHANGER
panel_27 = Panel("""-14.583933,               !- G-Function Ln(T/Ts) Value 1
    -1.972435,                !- G-Function G Value 1
    -14.459771,               !- G-Function Ln(T/Ts) Value 2
    -1.918855,                !- G-Function G Value 2
    -14.335609,               !- G-Function Ln(T/Ts) Value 3
    -1.859847,                !- G-Function G Value 3
    -14.211447,               !- G-Function Ln(T/Ts) Value 4
    -1.795084,                !- G-Function G Value 4
    -14.087285,               !- G-Function Ln(T/Ts) Value 5
    -1.724279,                !- G-Function G Value 5
    -13.963123,               !- G-Function Ln(T/Ts) Value 6
    -1.647199,                !- G-Function G Value 6
    -13.838961,               !- G-Function Ln(T/Ts) Value 7
    -1.563689,                !- G-Function G Value 7
    -13.714800,               !- G-Function Ln(T/Ts) Value 8
    -1.473689,                !- G-Function G Value 8
    -13.590638,               !- G-Function Ln(T/Ts) Value 9
    -1.377264,                !- G-Function G Value 9
    -13.466476,               !- G-Function Ln(T/Ts) Value 10
    -1.274618,                !- G-Function G Value 10
    -13.342314,               !- G-Function Ln(T/Ts) Value 11
    -1.166121,                !- G-Function G Value 11
    -13.218152,               !- G-Function Ln(T/Ts) Value 12
    -1.052323,                !- G-Function G Value 12
    -13.093990,               !- G-Function Ln(T/Ts) Value 13
    -0.933960,                !- G-Function G Value 13
    -12.969828,               !- G-Function Ln(T/Ts) Value 14
    -0.811952,                !- G-Function G Value 14
    -12.845666,               !- G-Function Ln(T/Ts) Value 15
    -0.687385,                !- G-Function G Value 15
    -12.721504,               !- G-Function Ln(T/Ts) Value 16
    -0.561478,                !- G-Function G Value 16
    -12.597342,               !- G-Function Ln(T/Ts) Value 17
    -0.435532,                !- G-Function G Value 17
    -12.473181,               !- G-Function Ln(T/Ts) Value 18
    -0.310858,                !- G-Function G Value 18
    -12.349019,               !- G-Function Ln(T/Ts) Value 19
    -0.188706,                !- G-Function G Value 19
    -12.224857,               !- G-Function Ln(T/Ts) Value 20
    -0.070175,                !- G-Function G Value 20
    -12.100695,               !- G-Function Ln(T/Ts) Value 21
    0.043861,                 !- G-Function G Value 21
    -11.976533,               !- G-Function Ln(T/Ts) Value 22
    0.152817,                 !- G-Function G Value 22
    -11.852371,               !- G-Function Ln(T/Ts) Value 23
    0.256421,                 !- G-Function G Value 23
    -11.728209,               !- G-Function Ln(T/Ts) Value 24
    0.354716,                 !- G-Function G Value 24
    -11.604047,               !- G-Function Ln(T/Ts) Value 25
    0.448017,                 !- G-Function G Value 25
    -11.479885,               !- G-Function Ln(T/Ts) Value 26
    0.536839,                 !- G-Function G Value 26
    -11.355724,               !- G-Function Ln(T/Ts) Value 27
    0.621812,                 !- G-Function G Value 27
    -11.231562,               !- G-Function Ln(T/Ts) Value 28
    0.703595,                 !- G-Function G Value 28
    -11.107400,               !- G-Function Ln(T/Ts) Value 29
    0.782798,                 !- G-Function G Value 29
    -10.983238,               !- G-Function Ln(T/Ts) Value 30
    0.859943,                 !- G-Function G Value 30
    -10.859076,               !- G-Function Ln(T/Ts) Value 31
    0.935443,                 !- G-Function G Value 31
    -10.734914,               !- G-Function Ln(T/Ts) Value 32
    1.009606,                 !- G-Function G Value 32
    -10.610752,               !- G-Function Ln(T/Ts) Value 33
    1.082655,                 !- G-Function G Value 33
    -10.486590,               !- G-Function Ln(T/Ts) Value 34
    1.154746,                 !- G-Function G Value 34
    -10.362428,               !- G-Function Ln(T/Ts) Value 35
    1.225994,                 !- G-Function G Value 35
    -10.238267,               !- G-Function Ln(T/Ts) Value 36
    1.296483,                 !- G-Function G Value 36
    -10.114105,               !- G-Function Ln(T/Ts) Value 37
    1.366279,                 !- G-Function G Value 37
    -9.989943,                !- G-Function Ln(T/Ts) Value 38
    1.435438,                 !- G-Function G Value 38
    -9.865781,                !- G-Function Ln(T/Ts) Value 39
    1.504008,                 !- G-Function G Value 39
    -9.741619,                !- G-Function Ln(T/Ts) Value 40
    1.572032,                 !- G-Function G Value 40
    -9.617457,                !- G-Function Ln(T/Ts) Value 41
    1.639551,                 !- G-Function G Value 41
    -9.493295,                !- G-Function Ln(T/Ts) Value 42
    1.706601,                 !- G-Function G Value 42
    -9.369133,                !- G-Function Ln(T/Ts) Value 43
    1.773217,                 !- G-Function G Value 43
    -9.244971,                !- G-Function Ln(T/Ts) Value 44
    1.839433,                 !- G-Function G Value 44
    -9.120809,                !- G-Function Ln(T/Ts) Value 45
    1.905279,                 !- G-Function G Value 45
    -8.996648,                !- G-Function Ln(T/Ts) Value 46
    1.970785,                 !- G-Function G Value 46
    -8.872486,                !- G-Function Ln(T/Ts) Value 47
    2.035979,                 !- G-Function G Value 47
    -8.748324,                !- G-Function Ln(T/Ts) Value 48
    2.100886,                 !- G-Function G Value 48
    -8.624162,                !- G-Function Ln(T/Ts) Value 49
    2.165530,                 !- G-Function G Value 49
    -8.500000,                !- G-Function Ln(T/Ts) Value 50
    2.273322,                 !- G-Function G Value 50
    -7.800000,                !- G-Function Ln(T/Ts) Value 51
    2.617322,                 !- G-Function G Value 51
    -7.200000,                !- G-Function Ln(T/Ts) Value 52
    2.913796,                 !- G-Function G Value 52
    -6.500000,                !- G-Function Ln(T/Ts) Value 53
    3.270114,                 !- G-Function G Value 53
    -5.900000,                !- G-Function Ln(T/Ts) Value 54
    3.632967,                 !- G-Function G Value 54
    -5.200000,                !- G-Function Ln(T/Ts) Value 55
    4.270751,                 !- G-Function G Value 55
    -4.500000,                !- G-Function Ln(T/Ts) Value 56
    5.385970,                 !- G-Function G Value 56
    -3.963000,                !- G-Function Ln(T/Ts) Value 57
    6.614535,                 !- G-Function G Value 57
    -3.270000,                !- G-Function Ln(T/Ts) Value 58
    9.514729,                 !- G-Function G Value 58
    -2.864000,                !- G-Function Ln(T/Ts) Value 59
    11.884430,                !- G-Function G Value 59
    -2.577000,                !- G-Function Ln(T/Ts) Value 60
    13.917405,                !- G-Function G Value 60
    -2.171000,                !- G-Function Ln(T/Ts) Value 61
    17.276215,                !- G-Function G Value 61
    -1.884000,                !- G-Function Ln(T/Ts) Value 62
    19.987269,                !- G-Function G Value 62
    -1.191000,                !- G-Function Ln(T/Ts) Value 63
    27.202388,                !- G-Function G Value 63
    -0.497000,                !- G-Function Ln(T/Ts) Value 64
    34.744246,                !- G-Function G Value 64
    -0.274000,                !- G-Function Ln(T/Ts) Value 65
    36.928229,                !- G-Function G Value 65
    -0.051000,                !- G-Function Ln(T/Ts) Value 66
    38.950610,                !- G-Function G Value 66
    0.196000,                 !- G-Function Ln(T/Ts) Value 67
    40.938405,                !- G-Function G Value 67
    0.419000,                 !- G-Function Ln(T/Ts) Value 68
    42.516547,                !- G-Function G Value 68
    0.642000,                 !- G-Function Ln(T/Ts) Value 69
    43.874104,                !- G-Function G Value 69
    0.873000,                 !- G-Function Ln(T/Ts) Value 70
    45.060864,                !- G-Function G Value 70
    1.112000,                 !- G-Function Ln(T/Ts) Value 71
    46.062146,                !- G-Function G Value 71
    1.335000,                 !- G-Function Ln(T/Ts) Value 72
    46.806423,                !- G-Function G Value 72
    1.679000,                 !- G-Function Ln(T/Ts) Value 73
    47.649018,                !- G-Function G Value 73
    2.028000,                 !- G-Function Ln(T/Ts) Value 74
    48.218660,                !- G-Function G Value 74
    2.275000,                 !- G-Function Ln(T/Ts) Value 75
    48.496086,                !- G-Function G Value 75
    3.003000,                 !- G-Function Ln(T/Ts) Value 76
    48.956674;                !- G-Function G Value 76""")
int = Integer("64")
objparams_6 = Ironbug_ObjParams(
    BoreHoleLength="76.2",
    BoreHoleRadius="0.05715",
    DesignFlowRate="0.1143",
    GroundThermalConductivity="2.493",
    GroundThermalHeatCapacity="2.4957E+6",
    GroutThermalConductivity="1.4714",
    MaximumLengthofSimulation="1",
    NumberofBoreHoles=int,
    PipeOutDiameter="0.0267",
    PipeThermalConductivity="0.389",
    PipeThickness="0.00243",
    UTubeDistance="0.047",
    DataFieldSetType="Ironbug.HVAC.IB_GroundHeatExchangerVertical_FieldSet")
groundhxvertical = Ironbug_GroundHeatExchangerVertical(GFunctions=panel_27, Parameters_=objparams_6, dupNum=False)

addition = Addition(A=radcoillowt, B=dtrad)
number_4 = Number(nofs)
data_2 = Data([Toggle(False), Toggle(False), Toggle(True), Toggle(False)])
boolean_toggle_4 = BooleanToggle(True)
boolean_toggle_5 = BooleanToggle(False)
objparams_7 = Ironbug_ObjParams(
    ApplyFriday=boolean_toggle_4,
    ApplyMonday=boolean_toggle_4,
    ApplySaturday=boolean_toggle_5,
    ApplySunday=boolean_toggle_5,
    ApplyThursday=boolean_toggle_4,
    ApplyTuesday=boolean_toggle_4,
    ApplyWednesday=boolean_toggle_4,
    DataFieldSetType="Ironbug.HVAC.Schedules.IB_ScheduleRule_FieldSet")
_24h_avab_data = Panel("""0
0
0
0
0
0
0
1
1
1
1
1
1
1
1
1
1
1
1
0
0
0
0
0""")
pipeadiabatic = Ironbug_PipeAdiabatic(dupNum=False)
objparams_8 = Ironbug_ObjParams(
    Coefficient1OfthePartLoadPerformanceCurve="0",
    Coefficient2OfthePartLoadPerformanceCurve="0.0216",
    Coefficient3OfthePartLoadPerformanceCurve="-0.0325",
    Coefficient4OfthePartLoadPerformanceCurve="1.0095",
    Name="HP_HW_PUMP",
    DataFieldSetType="Ironbug.HVAC.IB_PumpVariableSpeed_FieldSet")
number_5 = Number(_24h_avab_data)
ironbug_scheduletypelimits = Ironbug_ScheduleTypeLimits(LowerLimitValue=0, UpperLimitValue=1, UnitType="Dimensionless", NumericType="Discrete")
ironbug_schedulerule = Ironbug_ScheduleRule(Values=number_5, Parameters_=objparams_7, dupNum=False)
ironbug_schedule = Ironbug_Schedule(ScheduleName="DOAS_Availability_Schedule", ValuesOrRules=ironbug_schedulerule, ScheduleType=ironbug_scheduletypelimits)
objparams_9 = Ironbug_ObjParams(DemandControlledVentilation=Toggle(True), DataFieldSetType="Ironbug.HVAC.IB_ControllerMechanicalVentilation_FieldSet")
objparams_10 = Ironbug_ObjParams(DataFieldSetType="Ironbug.HVAC.IB_ControllerOutdoorAir_FieldSet")
ironbug_controllermechanicalventilation = Ironbug_ControllerMechanicalVentilation(Parameters_=objparams_9, dupNum=False)
octopus = Octopus(
    OctopusData_gene=[nofs, sd, wu, shgc, insth, insla, csb, csp_r, csp_o, hsb, hsp_r, hsp_o, dtrad, radcoillowt, radsurftype, radctrth, doashc, doas_sht, doas_slt],
    OctopusData_obj=[kgco2_4, comf_time])
objparams_11 = Ironbug_ObjParams(
    HeatExchangerType="Rotary",
    Name="HeatExchanger",
    DataFieldSetType="Ironbug.HVAC.IB_HeatExchangerAirToAirSensibleAndLatent_FieldSet")
multiplication = Multiplication(A="500", B=doashc)
addition_2 = Addition(A="500", B=multiplication)
ironbug_setpointmanagerscheduleddualsetp = Ironbug_SetpointManagerScheduledDualSetpoint(HighTemperature=doas_sht, LowTemperature=doas_slt, dupNum=False)
objparams_12 = Ironbug_ObjParams(NominalCapacity=addition_2, DataFieldSetType="Ironbug.HVAC.IB_CoilHeatingElectric_FieldSet")
panel_28 = Panel(addition_2)
ironbug_coilheatingelectric = Ironbug_CoilHeatingElectric(Parameters_=objparams_12, dupNum=False)
colibri_iterator = ColibriIterator(
    WU=wu,
    SHGC=shgc,
    InsTh=insth,
    InsLa=insla,
    CSB=csb,
    CSP_R=csp_r,
    CSP_O=csp_o,
    HSB=hsb,
    HSP_R=hsp_r,
    HSP_O=hsp_o,
    SD=sd,
    NOfS=nofs,
    DOASHC=doashc,
    RadCoilLowT=radcoillowt,
    dTRad=dtrad,
    RadCtrTh=radctrth,
    RadSurfType=radsurftype,
    DOAS_SHT=doas_sht,
    DOAS_SLT=doas_slt,
    RemoteFly=False,
    ignoreAllWarningMsg=False)  # -> WU, SHGC, InsTh, InsLa, CSB, CSP_R, CSP_O, HSB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
panel_29 = Panel("{0}_{1}_{2}_{3}_{4}_{5}_{6}_{7}_{8}_{9}_{10}_{11}_{12}_{13}_{14}_{15}_{16}_{17}_{18}_{19}")
honeybee_hvacsystemslist = Honeybee_HVACSystemsList({"-1. Thermostat Only": -1, "0. Ideal Air Loads": 0, "1. PTAC | Residential": 1, "2. PTHP | Residential": 2, "3. Packaged Single Zone - AC": 3, "4. Packaged Single Zone - HP": 4, "5. Packaged VAV w/ Reheat": 5, "6. Packaged VAV w/ PFP Boxes": 6, "7. VAV w/ Reheat": 7, "8. VAV w/ PFP Boxes": 8, "9. Warm Air Furnace - Gas Fired": 9, "10.Warm Air Furnace - Electric": 10, "11.Fan Coil Units + DOAS": 11, "12.Active Chilled Beams + DOAS": 12, "13.Radiant Floors + DOAS": 13, "14.Custom Rad Surfaces + DOAS": 14, "15.Heated Surfaces + VAV Cooling": 15, "16.VRF + DOAS": 16, "17.WSHP + DOAS": 17}, selected="13.Radiant Floors + DOAS")
sun = Panel("0")
format_4 = Format(
    Format=panel_29,
    Culture=127,
    Data0=colibri_iterator.WU,
    Data1=colibri_iterator.SHGC,
    Data2=colibri_iterator.InsTh,
    Data3=colibri_iterator.InsLa,
    Data4=colibri_iterator.CSB,
    Data5=colibri_iterator.CSP_R,
    Data6=colibri_iterator.CSP_O,
    Data7=colibri_iterator.HSB,
    Data8=colibri_iterator.HSP_R,
    Data9=colibri_iterator.HSP_O,
    Data10=colibri_iterator.SD,
    Data11=colibri_iterator.NOfS,
    Data12=honeybee_hvacsystemslist,
    Data13=colibri_iterator.DOASHC,
    Data14=colibri_iterator.RadCoilLowT,
    Data15=colibri_iterator.dTRad,
    Data16=colibri_iterator.RadCtrTh,
    Data17=colibri_iterator.RadSurfType,
    Data18=colibri_iterator.DOAS_SHT,
    Data19=colibri_iterator.DOAS_SLT)
number_slider_3 = Slider(0.2, range=0..1)
panel_30 = Panel(format_4)
honeybee_hvacsystemslist_2 = Honeybee_HVACSystemsList({"-1. Thermostat Only": -1, "0. Ideal Air Loads": 0, "1. PTAC | Residential": 1, "2. PTHP | Residential": 2, "3. Packaged Single Zone - AC": 3, "4. Packaged Single Zone - HP": 4, "5. Packaged VAV w/ Reheat": 5, "6. Packaged VAV w/ PFP Boxes": 6, "7. VAV w/ Reheat": 7, "8. VAV w/ PFP Boxes": 8, "9. Warm Air Furnace - Gas Fired": 9, "10.Warm Air Furnace - Electric": 10, "11.Fan Coil Units + DOAS": 11, "12.Active Chilled Beams + DOAS": 12, "13.Radiant Floors + DOAS": 13, "14.Custom Rad Surfaces + DOAS": 14, "15.Heated Surfaces + VAV Cooling": 15, "16.VRF + DOAS": 16, "17.WSHP + DOAS": 17}, selected="13.Radiant Floors + DOAS")
heating = Panel("1")
cooling = Panel("0")
panel_31 = Panel("0.01")
negative = Negative(Value=Slider(3, range=0..100))
vector_xyz = VectorXYZ(XComponent=negative, YComponent=0, ZComponent=0)  # -> Vector, Length
panel_32 = Panel("""1
3
4
2""")
point = Point(Point(0.1396903593, 21.24943144, 0))
# Summer
analysisperiod_2 = Ladybug_AnalysisPeriod(
    fromMonth=Slider(7, range=1..12),
    fromDay=Slider(21, range=1..31),
    fromHour=Slider(14, range=0..24),
    toMonth=Slider(7, range=1..12),
    toDay=Slider(21, range=1..31),
    toHour=Slider(17, range=1..24))  # -> out, analysisPeriod; plug-in component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
screen_oriented_text = ScreenOrientedText(
    Text="Zone Name_Percentage of Comfortable Time [%]",
    Justification=7,
    Location=point,
    SizeFactor=Slider(16, range=0..100),
    Depth=0,
    Absolute=False)
series_5 = Series(Start="0", Step=1, Count=Slider(20, range=0..20))
remove_attic = Panel("""1
2
3
4""")
false_start_toggle = FalseStartToggle(False)
panel_33 = Panel(panel_29)
legendpar = Ladybug_LegendParameters(lowBound=Slider(20, range=0..100), highBound=Slider(28, range=0..100), numSegments="9")  # -> legendPar; plug-in component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
panel_34 = Panel("""DesignExplorer
https://bit.ly/2Ylj9SV""")

# ---- group: Materials
# Material/Construction
# Object Description: Start with outside layer and work your way to the inside layer
panel_35 = Panel("""Cavity Wall
Internal partition
Internal ceiling
Singe glazing
Solid ground floor
Pitched roof""")
number_6 = Number(insla)
number_7 = Number(insth)
multiplication_2 = Multiplication(A=number_6, B="0.005")
multiplication_3 = Multiplication(A=number_7, B="5")
callfromepconstrlibrary = Honeybee_CallFromEPConstructionLibrary(keywords=panel_35)  # -> ThermMaterials, EPMaterials, EPWindowMaterials, EPConstructions; plug-in component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
addition_3 = Addition(A="0.020", B=multiplication_2)
division_2 = Division(A=multiplication_3, B="100")
format_5 = Format(Format="{0}_{1:0.000}", Culture=127, Data0=division_2, Data1=addition_3)
explode_tree_9 = ExplodeTree(Data=graft(callfromepconstrlibrary.EPConstructions))  # -> Branch0, Branch1, Branch2, Branch3, Branch4, Branch5
panel_36 = Panel(callfromepconstrlibrary.EPConstructions)
panel_37 = Panel(format_5)
panel_38 = Panel(division_2)
panel_39 = Panel(addition_3)
epwindowmat = Honeybee_EnergyPlusWindowMaterial(name=concatenate, U_Value=number_2, SHGC=shgc, VT=shgc)  # -> EPMaterial; plug-in component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
epopaquemat_3 = Honeybee_EnergyPlusOpaqueMaterial(name=panel_37, roughness="Rough", thickness=panel_38, conductivity=panel_39, density="30", specificHeat="1000")  # -> EPMaterial; plug-in component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
epconstruction_2 = Honeybee_EnergyPlusConstruction(name=concatenate, layer_1=epwindowmat)  # -> EPConstruction; plug-in component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
setepzonecnstr = Honeybee_SetEPZoneConstruction(
    HBZones=flatten(addhbglz),
    wallEPConstruction=explode_tree_9.Branch0,
    windowEPConstruction=epconstruction_2,
    roofEPConstruction=explode_tree_9.Branch3,
    floorEPConstruction=epconstruction)  # -> simplify(modifiedHBZones); plug-in component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
decomposeepconstruction_2 = Honeybee_DecomposeEPConstruction(cnstrName=panel_16)  # -> materials, comments, UValue_SI, UValue_IP, RValue_SI, RValue_IP; plug-in component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
panel_40 = Panel(decomposeepconstruction_2.UValue_SI)

# ----
panel_41 = Panel(epwindowmat)

# ---- group: Materials
# Radiant Ceiling
data_3 = Data(epopaquemat)
panel_42 = Panel("RadiantCeiling")
panel_43 = Panel("Internal Source")
epconstruction_3 = Honeybee_EnergyPlusConstruction(
    name=panel_42,
    layer_1=epopaquemat_3,
    layer_2="M11 100mm lightweight concrete",
    layer_3="F05 Ceiling air space resistance",
    layer_4=data_3,
    layer_5=panel_43,
    layer_6=data_3)  # -> EPConstruction; plug-in component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

# Attic Floor
panel_44 = Panel("M11 100mm lightweight concrete")
epconstruction_4 = Honeybee_EnergyPlusConstruction(
    name="AtticFloor",
    layer_1=data_3,
    layer_2=panel_43,
    layer_3=data_3,
    layer_4="F05 Ceiling air space resistance",
    layer_5=panel_44,
    layer_6=epopaquemat_3)  # -> EPConstruction; plug-in component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

# ----
decomposeepconstruction_3 = Honeybee_DecomposeEPConstruction(cnstrName=panel_42)  # -> materials, comments, UValue_SI, UValue_IP, RValue_SI, RValue_IP; plug-in component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
panel_45 = Panel(decomposeepconstruction_3.materials)

# ---- group: Materials (continued)
setepzoneintcnstr = Honeybee_SetEPZoneInteriorConstruction(
    HBZones=setepzonecnstr,
    intWallEPConstruction=explode_tree_9.Branch2,
    intFloorEPConstruction=epconstruction_4,
    intCeilingEPConstruction=epconstruction_3)  # -> simplify(modifiedHBZones); plug-in component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

# ----
separatezonesbyfloor = Honeybee_SeparateZonesByFloor(HBZones=flatten(setepzoneintcnstr))  # -> floorHeights, HBZones; plug-in component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
explode_tree_10 = ExplodeTree(Data=separatezonesbyfloor.HBZones)  # -> Branch0, Branch1
separatezonesbyorientation = Honeybee_SeparateZonesByOrientation(HBZones=flatten(explode_tree_10.Branch0))  # -> orientations, HBZones; plug-in component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
explode_tree_11 = ExplodeTree(Data=separatezonesbyorientation.HBZones)  # -> Branch0, Branch1, Branch2, Branch3

# ---- group: Attic
# Offices
# Attic
data_4 = Data(explode_tree_10.Branch1)
ach2m3_s_m2_calculator = Honeybee_infORventPerAreaCalculator(HBZones=flatten(data_4), airFlowRate=division)  # -> out, infPerAreaFacade, ventPerAreaFloor, allExposed, allFloors; plug-in component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
setepzoneloads = Honeybee_SetEnergyPlusZoneLoads(
    HBZones=data_4,
    equipmentLoadPerArea="0",
    infilRatePerArea_Facade=ach2m3_s_m2_calculator.infPerAreaFacade,
    lightingDensityPerArea="0",
    numOfPeoplePerArea="0",
    ventilationPerArea="0",
    ventilationPerPerson="0",
    recirculatedAirPerArea="0")  # -> loads, HBZones; plug-in component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
setepzoneschedules = Honeybee_SetEnergyPlusZoneSchedules(HBZones=setepzoneloads.HBZones, infiltrationSchedules=explode_tree_8.Branch6)  # -> schedules, simplify(HBZones); plug-in component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

# ---- group: Offcies
# Reception
data_5 = Data(flatten([explode_tree_11.Branch3, explode_tree_11.Branch1, explode_tree_11.Branch2]))

# ----
ach2m3_s_m2_calculator_2 = Honeybee_infORventPerAreaCalculator(HBZones=flatten(data_5), airFlowRate=division)  # -> out, infPerAreaFacade, ventPerAreaFloor, allExposed, allFloors; plug-in component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

# ---- group: Offcies (continued)
setepzoneloads_2 = Honeybee_SetEnergyPlusZoneLoads(
    HBZones=data_5,
    equipmentLoadPerArea=explode_tree_4.Branch0,
    infilRatePerArea_Facade=ach2m3_s_m2_calculator_2.infPerAreaFacade,
    lightingDensityPerArea=explode_tree_4.Branch2,
    numOfPeoplePerArea=one_over_x,
    ventilationPerArea=explode_tree_4.Branch4,
    ventilationPerPerson=panel_20,
    recirculatedAirPerArea=explode_tree_4.Branch4)  # -> loads, HBZones; plug-in component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
setepzoneschedules_2 = Honeybee_SetEnergyPlusZoneSchedules(
    HBZones=setepzoneloads_2.HBZones,
    occupancySchedules=explode_tree_8.Branch1,
    occupancyActivitySchs=explode_tree_8.Branch2,
    heatingSetPtSchedules=explode_tree_6.Branch0,
    coolingSetPtSchedules=explode_tree_7.Branch0,
    lightingSchedules=explode_tree_8.Branch4,
    equipmentSchedules=explode_tree_8.Branch5,
    infiltrationSchedules=explode_tree_8.Branch6)  # -> schedules, simplify(HBZones); plug-in component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
setepzonethresholds = Honeybee_SetEnergyPlusZoneThresholds(HBZones=setepzoneschedules_2.HBZones, maxHumidity=number_slider, minHumidity=number_slider_2)  # -> out, HBZones; plug-in component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

# ----
epwindowshades = Honeybee_EnergyPlusWindowShadeGenerator(HBObjects=flatten(setepzonethresholds.HBZones), depth=sd, numOfShds=number_4, horOrVertical=data_2, runIt=Toggle(True))  # -> readMe, port, HBObjWShades, port_2, windowBreps, shadeBreps, port_3, shadeMatName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; plug-in component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
hb_epcontextsrf = HoneybeeEPContextSurfaces(shdSurfaces=flatten(epwindowshades.shadeBreps))  # -> HBContext; inputs shdSurfaces: list of Brep, justBoundingBox: Boolean
# ---------- hb_epcontextsrf: Python ----------
"""
prepare shading/context geometries

    Args:
        northVectorOrRotation: A vector that shows North or a number that shows
                               the rotation of the North from the Y axis
        bldgMasses: List of closed Breps as thermal zones.
    Returns:
        report: ...
        thermalZones: Thermal zone's geometries for visualiza
"""

ghenv.Component.Name = 'Honeybee EP context Surfaces'
ghenv.Component.NickName = 'HB_EPContextSrf'
ghenv.Component.Message = 'VER 0.0.65\nJAN_01_2020'
ghenv.Component.IconDisplayMode = ghenv.Component.IconDisplayMode.application
ghenv.Component.Category = "Honeybee"
ghenv.Component.SubCategory = "10 | Energy | Energy"
#compatibleHBVersion = VER 0.0.57\nNOV_04_2016
#compatibleLBVersion = VER 0.0.59\nFEB_01_2015
ghenv.Component.AdditionalHelpFromDocStrings = "2"

import rhinoscriptsyntax as rs
import Rhino as rc
import scriptcontext as sc
import os
import System
import Grasshopper.Kernel as gh
import uuid

tolerance = sc.doc.ModelAbsoluteTolerance
import math


def main(shdSurfaces, EPTransSchedule, meshingSettings, justBoundingBox):
    
    # import the classes
    if sc.sticky.has_key('honeybee_release'):

        try:
            if not sc.sticky['honeybee_release'].isCompatible(ghenv.Component): return -1
            if sc.sticky['honeybee_release'].isInputMissing(ghenv.Component): return -1
        except:
            warning = "You need a newer version of Honeybee to use this compoent." + \
            " Use updateHoneybee component to update userObjects.\n" + \
            "If you have already updated userObjects drag Honeybee_Honeybee component " + \
            "into canvas and try again."
            w = gh.GH_RuntimeMessageLevel.Warning
            ghenv.Component.AddRuntimeMessage(w, warning)
            return -1
        
        # don't customize this part
        hb_EPSrf = sc.sticky["honeybee_EPSurface"]
        hb_EPSHDSurface = sc.sticky["honeybee_EPShdSurface"]
        hb_RADMaterialAUX = sc.sticky["honeybee_RADMaterialAUX"]
        hb_EPObjectsAux = sc.sticky["honeybee_EPObjectsAUX"]()
        HBScheduleList = sc.sticky["honeybee_ScheduleLib"].keys()

        ########################################################################
        #----------------------------------------------------------------------#
        shdBreps = []
        # create bounding box of shading geometries
        if justBoundingBox:
            for brep in shdSurfaces:
                if brep.Faces.Count>1 or not brep.Faces[0].IsPlanar(sc.doc.ModelAbsoluteTolerance):
                    shdBreps.append(brep.GetBoundingBox(True).ToBrep())
                else:
                    shdBreps.append(brep)
        else:
            shdBreps = shdSurfaces
        
        shadingClasses = []
        shadingMeshPreview = []
        
        if meshingSettings == None:
            mp = rc.Geometry.MeshingParameters.Minimal
            mp.SimplePlanes = True
        else:
            mp = meshingSettings
        
        def getRadMaterialName(radMaterial):
            nameStr = radMaterial.split(" ")[2]
            name =  nameStr.split("\n")[0]
            return name
        
        for brepCount, brep in enumerate(shdBreps):
            if brep != None:
                isPlanar = True
                # check planarity
                for face in brep.Faces:
                    if not face.IsPlanar(tolerance):
                        isPlanar = False
                        break
                
                shadingBreps = []
                if not isPlanar:
                    meshArray = rc.Geometry.Mesh.CreateFromBrep(brep, mp)
                    for mesh in meshArray:
                        for meshFace in range(mesh.Faces.Count):
                            vertices = list(mesh.Faces.GetFaceVertices(meshFace))[1:]
                            vertices = vertices + [sc.doc.ModelAbsoluteTolerance]
                            # create the brep from mesh
                            shdBrep = rc.Geometry.Brep.CreateFromCornerPoints(*vertices)
                            shadingBreps.append(shdBrep)
                else:
                    for face in brep.Faces:
                        shadingBreps.append(face.DuplicateFace(False))
                
                for faceCount, shdBrep in enumerate(shadingBreps):
                        thisShading = hb_EPSHDSurface(shdBrep, 1000*brepCount + faceCount, 'shdSrf_' + `brepCount` + '_' + `faceCount` + "_" + str(uuid.uuid4()))
                        
                        # add transmittance schedule if any
                        if EPTransSchedule!=None:
                            schedule= EPTransSchedule.upper()
                            if schedule!=None and not schedule.lower().endswith(".csv") and schedule not in HBScheduleList:
                                msg = "Cannot find " + schedule + " in Honeybee schedule library."
                                print msg
                                ghenv.Component.AddRuntimeMessage(gh.GH_RuntimeMessageLevel.Warning, msg)
                                return -1
                            elif schedule!=None and schedule.lower().endswith(".csv"):
                                # check if csv file is existed
                                if not os.path.isfile(schedule):
                                    msg = "Cannot find the shchedule file: " + schedule
                                    print msg
                                    ghenv.Component.AddRuntimeMessage(gh.GH_RuntimeMessageLevel.Warning, msg)
                                    return -1
                            
                            thisShading.TransmittanceSCH = schedule
                        
                        # add the Rad Material if any
                        if RADMaterial!=None:
                            # if it is just the name of the material make sure it is already defined
                            if len(RADMaterial.split(" ")) == 1:
                                # if the material is not in the library add it to the library
                                if not hb_RADMaterialAUX.isMatrialExistInLibrary(RADMaterial):
                                    warningMsg = "Can't find " + RADMaterial + " in RAD Material Library.\n" + \
                                                "Add the material to the library and try again."
                                    ghenv.Component.AddRuntimeMessage(gh.GH_RuntimeMessageLevel.Warning, warningMsg)
                                    return
                                
                                try:
                                    thisShading.setRADMaterial(RADMaterial)
                                except Exception, e:
                                    print e
                                    warningMsg = "You are using an old version of Honeybee_Honeybee! Update your files and try again."
                                    print warningMsg
                                    ghenv.Component.AddRuntimeMessage(gh.GH_RuntimeMessageLevel.Warning, warningMsg)
                                    return
                                
                                addedToLib = True
                            else:
                                
                                # try to add the material to the library
                                addedToLib, thisShading.RadMaterial = hb_RADMaterialAUX.analyseRadMaterials(RADMaterial, True)
                                
                            if addedToLib==False:
                                warningMsg = "Failed to add " + RADMaterial + " to the Library."
                                ghenv.Component.AddRuntimeMessage(gh.GH_RuntimeMessageLevel.Warning, warningMsg)
                                return
                        
                        # add shading to the list
                        shadingClasses.append(thisShading)
                
        # add to the hive
        hb_hive = sc.sticky["honeybee_Hive"]()
        HBContext  = hb_hive.addToHoneybeeHive(shadingClasses, ghenv.Component)
        return HBContext
        ################################################################################################
    else:
        print "You should first let Honeybee to fly..."
        w = gh.GH_RuntimeMessageLevel.Warning
        ghenv.Component.AddRuntimeMessage(w, "You should first let Honeybee to fly...")
        return -1
        

if _shdSurfaces and _shdSurfaces[0]!=None:
    # add cleaning function
    result= main(_shdSurfaces, EPTransSchedule_, meshingSettings_, justBoundingBox_)
    
    if result != -1: HBContext = result
# ---------- end hb_epcontextsrf ----------

# ---- group: Reception
data_6 = Data(explode_tree_11.Branch0)

# ----
ach2m3_s_m2_calculator_3 = Honeybee_infORventPerAreaCalculator(HBZones=flatten(data_6), airFlowRate=division)  # -> out, infPerAreaFacade, ventPerAreaFloor, allExposed, allFloors; plug-in component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

# ---- group: Reception (continued)
setepzoneloads_3 = Honeybee_SetEnergyPlusZoneLoads(
    HBZones=data_6,
    equipmentLoadPerArea=explode_tree_5.Branch0,
    infilRatePerArea_Facade=ach2m3_s_m2_calculator_3.infPerAreaFacade,
    lightingDensityPerArea=explode_tree_5.Branch2,
    numOfPeoplePerArea=one_over_x_2,
    ventilationPerArea=explode_tree_5.Branch4,
    ventilationPerPerson=panel_20,
    recirculatedAirPerArea=explode_tree_5.Branch4)  # -> loads, HBZones; plug-in component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
setepzoneschedules_3 = Honeybee_SetEnergyPlusZoneSchedules(
    HBZones=setepzoneloads_3.HBZones,
    occupancySchedules=explode_tree_8.Branch0,
    occupancyActivitySchs=explode_tree_8.Branch3,
    heatingSetPtSchedules=explode_tree_6.Branch1,
    coolingSetPtSchedules=explode_tree_7.Branch1,
    lightingSchedules=explode_tree_8.Branch4,
    equipmentSchedules=explode_tree_8.Branch5,
    infiltrationSchedules=explode_tree_8.Branch6)  # -> schedules, simplify(HBZones); plug-in component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
setepzonethresholds_2 = Honeybee_SetEnergyPlusZoneThresholds(HBZones=setepzoneschedules_3.HBZones, maxHumidity=number_slider, minHumidity=number_slider_2)  # -> out, HBZones; plug-in component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

# ---- group: HB Zones
office_and_reception = Data([setepzonethresholds_2.HBZones, setepzonethresholds.HBZones])
attic = Data(setepzoneschedules.HBZones)
all_zones = Data(flatten([attic, office_and_reception]))

# ----
# Radiant Panel
boolean_toggle_6 = BooleanToggle(True)
ironbug_outputparams_2 = Ironbug_OutputParams(
    ZoneRadiantHVACInletTemperature=boolean_toggle_6,
    ZoneRadiantHVACMoistureCondensationTime=boolean_toggle_6,
    outputFrequency=1)
panel_46 = Panel("""Ceilings
Floors
CeilingsAndFloors
AllSurfaces""")
panel_47 = Panel(radctrth)
objparams_13 = Ironbug_ObjParams(HeatingControlThrottlingRange=panel_47, DataFieldSetType="Ironbug.HVAC.IB_CoilHeatingLowTempRadiantVarFlow_FieldSet")
objparams_14 = Ironbug_ObjParams(CoolingControlThrottlingRange=panel_47, DataFieldSetType="Ironbug.HVAC.IB_CoilCoolingLowTempRadiantVarFlow_FieldSet")
list_item_5 = ListItem(List=panel_46, Index=radsurftype, Wrap=True)
panel_48 = Panel(list_item_5)
lng = ListLength(List=office_and_reception)
data_7 = Data(lng)
panel_49 = Panel(addition)
panel_50 = Panel(radcoillowt)
objparams_15 = Ironbug_ObjParams(RadiantSurfaceType=panel_48, DataFieldSetType="Ironbug.HVAC.IB_ZoneHVACLowTempRadiantVarFlow_FieldSet")
coilhtn_lowtradv = Ironbug_CoilHeatingLowTempRadiantVarFlow(LowAirTemperature=panel_50, Parameters_=objparams_13, DuplicateNumber_=data_7, dupNum=True)  # -> CoilHeatingLowTempRadiantVarFlow, graft(WaterSide_CoilHeatingLowTempRadiantVarFlow)
coilcln_lowtradv = Ironbug_CoilCoolingLowTempRadiantVarFlow(HighAirTemperature=panel_49, Parameters_=objparams_14, DuplicateNumber_=data_7, dupNum=True)  # -> CoilCoolingLowTempRadiantVarFlow, graft(WaterSide_CoilCoolingLowTempRadiantVarFlow)
radiantvflow = Ironbug_ZoneHVACLowTempRadiantVarFlow(
    HeatingCoil=coilhtn_lowtradv.CoilHeatingLowTempRadiantVarFlow,
    CoolingCoil=coilcln_lowtradv.CoilCoolingLowTempRadiantVarFlow,
    Parameters_=[objparams_15, ironbug_outputparams_2],
    dupNum=False)

# ----
# Chilled water loop
toggle = BooleanToggle(False)
outputparams = Ironbug_OutputParams(PumpMassFlowRate=toggle, PumpOutletTemperature=toggle, outputFrequency=1)
c_script = CSharpScript(GPM="950")  # -> m3s; inputs GPM: Double
# ---------- c_script: C# ----------
    m3s = GPM * 0.0000630902;
# ---------- end c_script ----------
objparams_16 = Ironbug_ObjParams(
    Coefficient1OfthePartLoadPerformanceCurve="0",
    Coefficient2OfthePartLoadPerformanceCurve="0.0216",
    Coefficient3OfthePartLoadPerformanceCurve="-0.0325",
    Coefficient4OfthePartLoadPerformanceCurve="1.0095",
    Name="HP_CHW_PUMP",
    RatedFlowRate=c_script,
    DataFieldSetType="Ironbug.HVAC.IB_PumpVariableSpeed_FieldSet")
branches = PlantBranches(B2=graft(coilcln_lowtradv.WaterSide_CoilCoolingLowTempRadiantVarFlow), mapBranchToLoop=False)
objparams_17 = Ironbug_ObjParams(DesignLoopExitTemperature="15", DataFieldSetType="Ironbug.HVAC.IB_SizingPlant_FieldSet")
objparams_18 = Ironbug_ObjParams(MaximumLoopTemperature="98", MinimumLoopTemperature="1", DataFieldSetType="Ironbug.HVAC.IB_PlantLoop_FieldSet")
pumpvariable = Ironbug_PumpVariableSpeed(Parameters=[objparams_16, outputparams], dupNum=False)
branches_2 = PlantBranches(B1=centralheatpumpsystem.ToCW_Supply, B2=pipeadiabatic, mapBranchToLoop=False)
spm_dual = Ironbug_SetpointManagerScheduledDualSetpoint(HighTemperature="20", LowTemperature="15", dupNum=False)
sizingplant = Ironbug_SizingPlant(Parameters_=objparams_17, dupNum=False)
cwloop = Ironbug_ChilledWaterPlantLoop(
    Supply=[pumpvariable, branches_2, spm_dual],
    Demand=branches,
    SizingLoop=sizingplant,
    Parameters_=objparams_18,
    dupNum=False)

# ----
# Hot water loop
toggle_2 = BooleanToggle(False)
outputparams_2 = Ironbug_OutputParams(PumpMassFlowRate=toggle_2, PumpOutletTemperature=toggle_2, outputFrequency=1)
objparams_19 = Ironbug_ObjParams(DataFieldSetType="Ironbug.HVAC.IB_PlantLoop_FieldSet")
pipeadiabatic_2 = Ironbug_PipeAdiabatic(dupNum=False)
objparams_20 = Ironbug_ObjParams(DesignLoopExitTemperature="40", DataFieldSetType="Ironbug.HVAC.IB_SizingPlant_FieldSet")
branches_3 = PlantBranches(B2=graft(coilhtn_lowtradv.WaterSide_CoilHeatingLowTempRadiantVarFlow), mapBranchToLoop=False)
pumpvariable_2 = Ironbug_PumpVariableSpeed(Parameters=[objparams_8, outputparams_2], dupNum=False)
spm_scheduled = Ironbug_SetpointManagerScheduled(Temperature="40", dupNum=False)
plantbranches = PlantBranches(Branch1=centralheatpumpsystem.ToHW_Supply, Branch=pipeadiabatic_2, mapBranchToLoop=False)
sizingplant_2 = Ironbug_SizingPlant(Parameters_=objparams_20, dupNum=False)
hwloop = Ironbug_HotWaterPlantLoop(
    Supply=[pumpvariable_2, plantbranches, spm_scheduled],
    Demand=branches_3,
    SizingLoop=sizingplant_2,
    Parameters=objparams_19,
    dupNum=False)

thermalzone = Ironbug_ThermalZone(
    HoneybeeZonesOrOsZones=office_and_reception,
    ZoneEquipment=radiantvflow,
    IsAirTerminalPriorToZoneEquipments=True,
    dupNum=False)

# ----
# DOAS
panel_51 = Panel("350")
objparams_21 = Ironbug_ObjParams(
    AvailabilitySchedule=ironbug_schedule,
    Name="FAN",
    PressureRise=panel_51,
    DataFieldSetType="Ironbug.HVAC.IB_FanVariableVolume_FieldSet")
panel_52 = Panel("VentilationRequirement")
panel_53 = Panel("1")
ironbug_oacontroller = Ironbug_OAController(ControllerMechanicalVentilation=ironbug_controllermechanicalventilation, Parameters_=objparams_10, dupNum=False)
objparams_22 = Ironbug_ObjParams(DataFieldSetType="Ironbug.HVAC.IB_SizingSystem_FieldSet")
ironbug_heatexchangerairtoairsensibleand = Ironbug_HeatExchangerAirToAirSensibleAndLatent(Parameters_=objparams_11, dupNum=False)
ironbug_outdoorairsystem = Ironbug_OutdoorAirSystem(HeatRecovery=ironbug_heatexchangerairtoairsensibleand, Controller=ironbug_oacontroller)
fanvariable = Ironbug_FanVariableVolume(Parameters_=objparams_21, dupNum=False)
coilclndx1 = Ironbug_CoilCoolingDXSingleSpeed(dupNum=False)
airloopbranches = AirLoopBranches(Branch1=thermalzone)
objparams_23 = Ironbug_ObjParams(AvailabilitySchedule=ironbug_schedule, Name="DOAS", DataFieldSetType="Ironbug.HVAC.IB_AirLoopHVAC_FieldSet")
sizingsystem = Ironbug_SizingSystem(Parameters_=objparams_22, dupNum=False)
merge_3 = Merge(
    Data1=ironbug_outdoorairsystem,
    Data2=coilclndx1,
    Data3=ironbug_coilheatingelectric,
    Data5=fanvariable,
    Data6=ironbug_setpointmanagerscheduleddualsetp)
airloop = Ironbug_AirLoopHVAC(Supply=merge_3, Demand=airloopbranches, SizingSystem=sizingsystem, Parameters_=objparams_23, dupNum=False)

# ----
# GeoThermal Heat Pump Loop
toggle_3 = BooleanToggle(False)
pipeadiabatic_3 = Ironbug_PipeAdiabatic(dupNum=False)
outputparams_3 = Ironbug_OutputParams(PumpMassFlowRate=toggle_3, PumpOutletTemperature=toggle_3, outputFrequency=1)
pipeadiabatic_4 = Ironbug_PipeAdiabatic(dupNum=False)
plantbranches_2 = PlantBranches(B1=groundhxvertical, B2=pipeadiabatic_3, mapBranchToLoop=False)
objparams_24 = Ironbug_ObjParams(Name="Heat Pump Loop", DataFieldSetType="Ironbug.HVAC.IB_PlantLoop_FieldSet")
spm_scheduled_2 = Ironbug_SetpointManagerScheduled(Temperature="20", dupNum=False)
plantbranches_3 = PlantBranches(B1=pipeadiabatic_4, B2=centralheatpumpsystem.ToDW_Demand, mapBranchToLoop=False)

c_script_2 = CSharpScript(GPM="1020")  # -> m3s; inputs GPM: Double; same code as c_script
objparams_25 = Ironbug_ObjParams(
    Coefficient1OfthePartLoadPerformanceCurve="0",
    Coefficient2OfthePartLoadPerformanceCurve="0.0216",
    Coefficient3OfthePartLoadPerformanceCurve="-0.0325",
    Coefficient4OfthePartLoadPerformanceCurve="1.0095",
    Name="GEO_PUMP",
    RatedFlowRate=c_script_2,
    DataFieldSetType="Ironbug.HVAC.IB_PumpVariableSpeed_FieldSet")
pumpvariable_3 = Ironbug_PumpVariableSpeed(Parameters=[outputparams_3, objparams_25], dupNum=False)

merge_4 = Merge(Data1=pumpvariable_3, Data2=plantbranches_2, Data3=spm_scheduled_2)
condenserwaterloop = Ironbug_CondenserWaterPlantLoop(Supply=merge_4, Demand=plantbranches_3, Parameters_=objparams_24, dupNum=False)

merge_5 = Merge(Data1=condenserwaterloop, Data2=cwloop, Data3=hwloop)
hvacsystem = Ironbug_HVACSystem(AirLoops=flatten(airloop), PlantLoops=flatten(merge_5))

# ----
# Simulation
conv_alg = Panel("TARP")
duplicate_data_7 = DuplicateData(Data=conv_alg, Number="5", Order=True)
setzoneprop = Honeybee_SetZoneProperties(HBZones=all_zones, inConvAlg=duplicate_data_7, outConvAlg=duplicate_data_7)  # -> HBZones; plug-in component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
panel_54 = Panel("C:\Users\BT\OneDrive - University College London\2.Integrated Building Systems Simulation\Grasshopper\edit_fraction_radiant")
lights = Slider(0.37, range=0..1)
equipment = Slider(0.2, range=0..1)
people = Slider(0.5, range=0..1)
panel_55 = Panel("""timestep
hourly
daily
monthly
annual""")
duplicate_data_8 = DuplicateData(Data="14", Number="12", Order=True)
boolean_toggle_7 = BooleanToggle(True)
item_selector = ItemSelector(panel_55, {"timestep", "hourly", "daily", "monthly", "annual"}, selected="hourly")
gatwick_weather_file = Panel("https://www.energyplus.net/weather-download/europe_wmo_region_6/GBR//GBR_London.Gatwick.037760_IWEC/all")
edit_fraction_radiant = EditFractionRadiantOfLightingAndEquipment(port=panel_54, Lights_Fraction_Radiant=lights, Equipment_Fraction_Radiant=equipment, People_Fraction_Radiant=people)  # -> out, OSMeasure; plug-in component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
sizing = Panel("1")
fullexterior = Panel("1")
timestep = Panel("6")
epoutput = Honeybee_GenerateEPOutput(
    zoneEnergyUse=boolean_toggle_7,
    zoneGainsAndLosses="False",
    zoneComfortMetrics=boolean_toggle_7,
    zoneHVACParams=boolean_toggle_7,
    surfaceTempAnalysis="False",
    timestep=item_selector)  # -> out, flatten(simulationOutputs); plug-in component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
energysimpar = Honeybee_EnergySimulationPar(
    timestep=timestep,
    solarDistribution=fullexterior,
    startDayOfWeek=sun,
    heatingSizingFactor=sizing,
    coolingSizingFactor=sizing,
    terrain="Suburbs",
    monthlyGrndTemps=duplicate_data_8)  # -> energySimPar; plug-in component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
epw_stat = Ladybug_OpenEPWAndSTATWeatherFiles(weatherFileURL=gatwick_weather_file)  # -> epwFile, statFile; plug-in component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
false_start_toggle_2 = FalseStartToggle(True)
panel_56 = Panel("Ladybug")
exporttoopenstudio = Honeybee_ExportToOpenStudio(
    epwWeatherFile=epw_stat.epwFile,
    energySimPar=energysimpar,
    HBZones=flatten(setzoneprop),
    HVACSystem=flatten(hvacsystem),
    HBContext=flatten(hb_epcontextsrf),
    simulationOutputs=flatten(epoutput.simulationOutputs),
    OSMeasures=flatten(edit_fraction_radiant.OSMeasure),
    writeOSM=false_start_toggle_2,
    runSimulation=Slider(1, range=0..3),
    fileName=format_4,
    workingDir="C:\ladybug\BENV0088_CW\S13")  # -> out, osmFileAddress, idfFileAddress, resultFileAddress, eioFileAddress, rddFileAddress, htmlReport, studyFolder, model; plug-in component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

wires = BrepWireframe(Brep=[hb_epcontextsrf, setzoneprop], Density=-1)
ext = ExtendCurve(Curve=wires, Type=0, Start=number_slider_3, End=number_slider_3)
epcustomresult = Honeybee_ReadEPCustomResult(resultFileAddress=exporttoopenstudio.resultFileAddress, keywords="hvac")  # -> results; plug-in component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
epcustomresult_2 = Honeybee_ReadEPCustomResult(resultFileAddress=exporttoopenstudio.resultFileAddress, keywords="Heatpump")  # -> results; plug-in component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
bang = ExplodeTree(Data=epcustomresult)  # -> Branch0, Branch1, Branch2, Branch3, Branch4, Branch5, Branch6, Branch7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
item = ListItem(List=epcustomresult, Index="2", Wrap=True)  # -> flatten(Item)
readeio = Honeybee_ReadHVACSizing(eioFile=exporttoopenstudio.eioFileAddress)  # -> zonePeakLoadObjs, zonePeakLoadVals, zoneSizingObjs, zoneSizingValues, systemSizingObjs, systemSizingVals, componentSizObjs, componentSizVals, coolDesignDayLoad, heatDesignDayLoad; plug-in component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

# ----
# Moisture Condensation Time [hours]
panel_57 = Panel("""1
3
5
7""")
tree_branch = TreeBranch(Tree=epcustomresult, Path=panel_57, MaintainPaths=True)
strnum = Ladybug_SeparateData(inputList=flatten(tree_branch))  # -> numbers, strings; plug-in component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
mass_addition = MassAddition(Input=flatten(strnum.numbers))  # -> Result, PartialResults
division_3 = Division(A=mass_addition.Result, B="3600")
condensation = Number(division_3)
panel_58 = Panel(condensation)

strnum_2 = Ladybug_SeparateData(inputList=flatten(epcustomresult_2))  # -> numbers, strings; plug-in component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
data_8 = Data(exporttoopenstudio.resultFileAddress)
strnum_3 = Ladybug_SeparateData(inputList=flatten(bang.Branch0))  # -> numbers, strings; plug-in component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
panel_59 = Panel(readeio.componentSizObjs)
panel_60 = Panel(item)

# ---- group: Results
readepresult = Honeybee_ReadEPResult(resultFileAddress=data_8)  # -> port, port_2, cooling, heating, electricLight, electricEquip, fanElectric, pumpElectric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; plug-in component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
strnum_4 = Ladybug_SeparateData(inputList=flatten(readepresult.electricLight))  # -> numbers, strings; plug-in component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
strnum_5 = Ladybug_SeparateData(inputList=flatten(readepresult.electricEquip))  # -> numbers, strings; plug-in component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
strnum_6 = Ladybug_SeparateData(inputList=flatten(readepresult.fanElectric))  # -> numbers, strings; plug-in component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
strnum_7 = Ladybug_SeparateData(inputList=flatten(readepresult.cooling))  # -> numbers, strings; plug-in component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
strnum_8 = Ladybug_SeparateData(inputList=flatten(readepresult.heating))  # -> numbers, strings; plug-in component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
strnum_9 = Ladybug_SeparateData(inputList=flatten(readepresult.pumpElectric))  # -> numbers, strings; plug-in component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
mass_addition_2 = MassAddition(Input=flatten(strnum_4.numbers))  # -> Result, PartialResults
mass_addition_3 = MassAddition(Input=flatten(strnum_5.numbers))  # -> Result, PartialResults
mass_addition_4 = MassAddition(Input=flatten(strnum_6.numbers))  # -> Result, PartialResults
mass_addition_5 = MassAddition(Input=flatten(strnum_9.numbers))  # -> Result, PartialResults
mass_addition_6 = MassAddition(Input=strnum_7.numbers)  # -> Result, PartialResults
mass_addition_7 = MassAddition(Input=strnum_8.numbers)  # -> Result, PartialResults
heating_2 = Panel(mass_addition_7.Result)
cooling_2 = Panel(mass_addition_6.Result)
light = Panel(mass_addition_2.Result)
equip = Panel(mass_addition_3.Result)
fan = Panel(mass_addition_4.Result)
pump = Panel(mass_addition_5.Result)

# ----
explode_tree_12 = ExplodeTree(Data=strnum_2.numbers)  # -> Branch0, Branch1, Branch2, Branch3
quick_graph_10 = QuickGraph(strnum_2.numbers, SortOrder=0)
panel_61 = Panel(strnum_2.strings)
panel_62 = Panel(readeio.systemSizingObjs)
panel_63 = Panel(readeio.zonePeakLoadObjs)
graph = QuickGraph(strnum_3.numbers, SortOrder=0)
division_4 = Division(A=explode_tree_12.Branch2, B=explode_tree_12.Branch1)
item_2 = ListItem(List=strnum_3.strings, Index="2", Wrap=True)  # -> flatten(Item)
panel_64 = Panel(readeio.systemSizingVals)
panel_65 = Panel(readeio.zonePeakLoadVals)
panel_66 = Panel(readeio.componentSizVals)
panel_67 = Panel(item_2)
replace_nulls = ReplaceNulls(Items=division_4, Replacements="0")  # -> Items, Count
list_item_6 = ListItem(List=readeio.zonePeakLoadVals, Index=heating, Wrap=True)
list_item_7 = ListItem(List=readeio.zonePeakLoadVals, Index=cooling, Wrap=True)
quick_graph_11 = QuickGraph(replace_nulls.Items, SortOrder=0)
list_item_8 = ListItem(List=strnum_7.strings, Index="2", Wrap=True)
list_item_9 = ListItem(List=strnum_8.strings, Index="2", Wrap=True)
mass_addition_8 = MassAddition(Input=flatten(list_item_6))  # -> Result, PartialResults
mass_addition_9 = MassAddition(Input=flatten(list_item_7))  # -> Result, PartialResults
mass_addition_10 = MassAddition(Input=explode_tree_12.Branch2)  # -> Result, PartialResults
multiplication_4 = Multiplication(A=replace_nulls.Items, B=explode_tree_12.Branch2)
panel_68 = Panel(list_item_8)
panel_69 = Panel(list_item_9)
mass_addition_11 = MassAddition(Input=multiplication_4)  # -> Result, PartialResults
round = Round(Number=mass_addition_8.Result)  # -> Nearest, Floor, Ceiling
round_2 = Round(Number=mass_addition_9.Result)  # -> Nearest, Floor, Ceiling
division_5 = Division(A=mass_addition_11.Result, B=mass_addition_10.Result)
peakcl = Number(round_2.Nearest)
peakhl = Number(round.Nearest)
panel_70 = Panel(peakcl)
ghpython_script = GhPythonScript(x=division_5)  # -> out, flatten(a)
# ---------- ghpython_script: Python ----------
__author__ = "BT"
__version__ = "2020.04.30"

import rhinoscriptsyntax as rs
a=round(x,2)
# ---------- end ghpython_script ----------
panel_71 = Panel(peakhl)

honeybee_zone_attribute_list = Honeybee_ZoneAttributeList({"Name": "name", "Zone Program": "zoneProgram", "Zone Floor Area": "zoneFloorArea", "Zone Volume": "zoneVolume", "Building Program": "bldgProgram", "Is Conditioned": "isConditioned", "HVAC System Type": "HVACSystem", "Occupancy Schedule": "occupancySchedule", "Occupancy Activity Schedule": "occupancyActivitySch", "Heating SetPoint Schedule": "heatingSetPtSchedule"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}, selected="Zone Floor Area")
labelzones = Honeybee_LabelZones(HBZones=flatten(setzoneprop), attribute=honeybee_zone_attribute_list)  # -> zoneTxtLabels, labelBasePts, brepTxtLabels, zoneWireFrames; plug-in component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

hp_scop = Number(ghpython_script.a)
scop = Panel(hp_scop)
text_split = TextSplit(Text=data_8, Separators="\")  # -> simplify(Result)
cull_index = CullIndex(List=labelzones.labelBasePts, Indices="0", Wrap=True)
flip_matrix_2 = FlipMatrix(Data=text_split)
tree_branch_2 = TreeBranch(Tree=simplify(flip_matrix_2), Path=Slider(4, range=0..10), MaintainPaths=True)
move = Move(Geometry=cull_index, Motion=vector_xyz.Vector)  # -> Geometry, Transform
geo = Geometry(flatten(wires))
text_split_2 = TextSplit(Text=tree_branch_2, Separators="_")
flip_matrix_3 = FlipMatrix(Data=text_split_2)
data_9 = Data(setzoneprop)
tree_branch_3 = TreeBranch(Tree=simplify(flip_matrix_3), Path=series_5, MaintainPaths=True)
list_item_10 = ListItem(List=data_9, Index=remove_attic, Wrap=True)
number_8 = Number(tree_branch_3)
explode_tree_13 = ExplodeTree(Data=number_8)  # -> Branch0, Branch1, Branch2, Branch3, Branch4, Branch5, Branch6, Branch7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
format_6 = Format(
    Format=panel_29,
    Culture=127,
    Data0=explode_tree_13.Branch0,
    Data1=explode_tree_13.Branch1,
    Data2=explode_tree_13.Branch2,
    Data3=explode_tree_13.Branch3,
    Data4=explode_tree_13.Branch4,
    Data5=explode_tree_13.Branch5,
    Data6=explode_tree_13.Branch6,
    Data7=explode_tree_13.Branch7,
    Data8=explode_tree_13.Branch8,
    Data9=explode_tree_13.Branch9,
    Data10=explode_tree_13.Branch10,
    Data11=explode_tree_13.Branch11,
    Data12=explode_tree_13.Branch12,
    Data13=explode_tree_13.Branch13,
    Data14=explode_tree_13.Branch14,
    Data15=explode_tree_13.Branch15,
    Data16=explode_tree_13.Branch16,
    Data17=explode_tree_13.Branch17,
    Data18=explode_tree_13.Branch18,
    Data19=explode_tree_13.Branch19)
input = Panel(format_6)

# ----
# Objective 2
# Minimize  -min(zones PPD < 10%)
remove_attic_2 = Panel("""1
2
3
4""")
tree_branch_4 = TreeBranch(Tree=readepresult.meanRadTemperature, Path=remove_attic_2, MaintainPaths=True)
tree_branch_5 = TreeBranch(Tree=readepresult.relativeHumidity, Path=remove_attic_2, MaintainPaths=True)
tree_branch_6 = TreeBranch(Tree=readepresult.airTemperature, Path=remove_attic_2, MaintainPaths=True)
strnum_10 = Ladybug_SeparateData(inputList=flatten(tree_branch_4))  # -> numbers, strings; plug-in component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
strnum_11 = Ladybug_SeparateData(inputList=flatten(tree_branch_5))  # -> numbers, strings; plug-in component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
strnum_12 = Ladybug_SeparateData(inputList=flatten(tree_branch_6))  # -> numbers, strings; plug-in component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
boolean_occupancy = Data([False, False, False, False, False, False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])
convertepschvalues = Honeybee_ConvertEnergyPlusScheduleToValues(schName="ClothingS")  # -> values, holidays; plug-in component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
strnum_13 = Ladybug_SeparateData(inputList=flatten(convertepschvalues.values))  # -> numbers, strings; plug-in component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
cull_pattern = CullPattern(List=strnum_10.numbers, CullPattern=boolean_occupancy)
cull_pattern_2 = CullPattern(List=strnum_11.numbers, CullPattern=boolean_occupancy)
cull_pattern_3 = CullPattern(List=strnum_12.numbers, CullPattern=boolean_occupancy)
cull_pattern_4 = CullPattern(List=strnum_13.numbers, CullPattern=boolean_occupancy)
list_item_11 = ListItem(List=strnum_10.strings, Index="2", Wrap=True)
met = Panel("""1.2
1.4
1.2
1.2""")
false_start_toggle_3 = FalseStartToggle(True)
wind_speed_m_s = Panel("0.137")
pmvcomfortcalculator = Ladybug_PMVComfortCalculator(
    dryBulbTemperature=cull_pattern_3,
    meanRadiantTemperature=cull_pattern,
    windSpeed=wind_speed_m_s,
    relativeHumidity=cull_pattern_2,
    metabolicRate=graft(met),
    clothingLevel=cull_pattern_4,
    calcBalanceTemperature=False,
    runIt=false_start_toggle_3)  # -> readMe, port, predictedMeanVote, percentPeopleDissatisfied, standardEffectiveTemperature, port_2, comfortableOrNot, percentOfTimeComfortable, port_3, balanceTemperature; plug-in component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
text_fragment = TextFragment(Text=list_item_11, Start=Slider(24, range=10..40))
ghpython_script_2 = GhPythonScript(x=pmvcomfortcalculator.percentOfTimeComfortable, y=text_fragment)  # -> out, flatten(a)
# ---------- ghpython_script_2: Python ----------
__author__ = "BT"
__version__ = "2020.04.30"

import rhinoscriptsyntax as rs
a=y+"_"+str(round(x,1))+"% "
# ---------- end ghpython_script_2 ----------
sort_list = SortList(Keys=flatten(pmvcomfortcalculator.percentOfTimeComfortable))  # -> Keys, ValuesValuesA
list_item_12 = ListItem(List=sort_list.Keys, Index="0", Wrap=True)
negative_2 = Negative(Value=list_item_12)
# Radiant
# Humidity
comf_time = Number(negative_2)

tree_branch_7 = TreeBranch(Tree=readepresult.operativeTemperature, Path=remove_attic_2, MaintainPaths=True)
strnum_14 = Ladybug_SeparateData(inputList=flatten(tree_branch_7))  # -> numbers, strings; plug-in component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
cull_pattern_5 = CullPattern(List=strnum_14.numbers, CullPattern=boolean_occupancy)
quick_graph_12 = QuickGraph(cull_pattern, SortOrder=0)
quick_graph_13 = QuickGraph(cull_pattern_3, SortOrder=0)
quick_graph_14 = QuickGraph(cull_pattern_5, SortOrder=0)
quick_graph_15 = QuickGraph(cull_pattern_2, SortOrder=0)
sort_list_2 = SortList(Keys=flatten(pmvcomfortcalculator.percentOfTimeComfortable), ValuesValuesA=flatten(ghpython_script_2.a))  # -> Keys, ValuesValuesA
list_item_13 = ListItem(List=ghpython_script_2.a, Index=panel_32, Wrap=True)
screen_oriented_text_2 = ScreenOrientedText(Text=list_item_13, Justification=7, Location=move.Geometry, SizeFactor=Slider(14, range=0..100), Depth=0, Absolute=False)
panel_72 = Panel(sort_list_2.ValuesValuesA)
ghpython_script_3 = GhPythonScript(x=list_item_12)  # -> out, flatten(a); same code as ghpython_script

panel_73 = Panel(ghpython_script_3.a)

comf_time_2 = Number(ghpython_script_3.a)
quick_graph_16 = QuickGraph(pmvcomfortcalculator.standardEffectiveTemperature, SortOrder=0)
colorzones = Honeybee_ColorZonesByEPResult(
    zoneData=tree_branch_7,
    HBZones=flatten(list_item_10),
    analysisPeriod=analysisperiod_2.analysisPeriod,
    legendPar=legendpar,
    runIt=false_start_toggle)  # -> readMe, zoneColoredMesh, zoneWireFrame, legend, legendBasePt, analysisTitle, zoneBreps, zoneColors, zoneValues, relevantZoneData; plug-in component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
mesh = Mesh([colorzones.zoneColoredMesh, colorzones.legend, colorzones.analysisTitle])
format_7 = Format(Format="{0:00.00}", Culture=127, Data0=comf_time)

# ----
# Objective 1
# Minimize  CO2
panel_74 = Panel("2")
list_item_14 = ListItem(List=strnum_8.strings, Index=panel_74, Wrap=True)
panel_75 = Panel("""boiler
gas""")
match_text = MatchText(Text=list_item_14, RegEx=panel_75, Case=Toggle(False))
list_item_15 = ListItem(List=match_text, Index="0", Wrap=True)
list_item_16 = ListItem(List=match_text, Index="1", Wrap=True)
gate_or = GateOr(A=list_item_15, B=list_item_16)
ghpython_script_4 = GhPythonScript(x=gate_or, y=heating_2)  # -> out, flatten(a), flatten(b)
# ---------- ghpython_script_4: Python ----------
__author__ = "BT"
__version__ = "2020.04.23"

import rhinoscriptsyntax as rs
a=0
b=0
if x == True:
    a=y
    b=0
else:
    b=y
    a=0
# ---------- end ghpython_script_4 ----------
mass_addition_12 = MassAddition(Input=ghpython_script_4.a)  # -> Result, PartialResults
mass_addition_13 = MassAddition(Input=[light, equip, fan, pump, cooling_2, ghpython_script_4.b])  # -> Result, PartialResults
kwh_to_co2 = Panel("0.19")
kwh_to_co2_2 = Panel("0.55")
fossil = Panel(mass_addition_12.Result)
electricity = Panel(mass_addition_13.Result)
multiplication_5 = Multiplication(A=kwh_to_co2, B=mass_addition_12.Result)
multiplication_6 = Multiplication(A=mass_addition_13.Result, B=kwh_to_co2_2)
mass_addition_14 = MassAddition(Input=flatten([multiplication_6, multiplication_5]))  # -> Result, PartialResults
kgco2 = Panel(multiplication_5)
kgco2_2 = Panel(multiplication_6)

round_3 = Round(Number=mass_addition_14.Result)  # -> Nearest, Floor, Ceiling

kgco2_3 = Panel(round_3.Nearest)
# Operative
# Dry-bulb
kgco2_4 = Number(round_3.Nearest)

image_setting = ImageSetting(ImageSaveAsName="defaultName", RhinoViewNames="Top", Width="800", Height="800")
colibri_parameters = ColibriParameters(
    kgCO2=flatten(kgco2_4),
    Comf_time=flatten(comf_time_2),
    Condensation=flatten(condensation),
    HP_SCOP=flatten(hp_scop),
    PeakCL=flatten(peakcl),
    PeakHL=flatten(peakhl))
false_start_toggle_4 = FalseStartToggle(False)
colibri_aggregator = ColibriAggregator(
    Folder="C:\Users\BT\Google Drive\Colibri",
    IterationGenomeID=colibri_iterator.Iteration_Genome,
    IterationPhenomeResults=colibri_parameters,
    ImgSetting=image_setting,
    _3DObjects=flatten([geo, mesh]),
    Write=false_start_toggle_4,
    recordingMode=3)

panel_76 = Panel(colibri_aggregator)
entwine = Entwine(Branch00=format_6, Branch01=kgco2_4, Branch02=comf_time, FlattenInputs=True)  # -> simplify(Result)
data_recorder = DataRecorder(entwine, DataLimit=-10, RecordData=True)
panel_77 = Panel(entwine)
tree_branch_8 = TreeBranch(Tree=data_recorder, Path="1", MaintainPaths=True)
tree_branch_9 = TreeBranch(Tree=data_recorder, Path="0", MaintainPaths=True)
tree_branch_10 = TreeBranch(Tree=data_recorder, Path="2", MaintainPaths=True)
format_8 = Format(Format="{0} {1} {2}", Culture=127, Data0=tree_branch_9, Data1=tree_branch_8, Data2=tree_branch_10)
entwine_2 = Entwine(Branch00=kgco2_4, Branch01=format_7, FlattenInputs=True)  # -> simplify(Result)
panel_78 = Panel(format_8)
panel_79 = Panel(entwine_2)
