# Grasshopper definition Prototype workflow.gh (Grasshopper 1.0.7)
# plug-ins: Rhino.Inside for Autodesk Revit, VoxelTools, Human, GH_CPython, Kangaroo2 Components

# ---- group: Load BIM data
# Context
# Set Level 1 - Plenum
model = ModelCategoriesPicker({"Abutments": -2006130, "Air Systems": -2001008, "Air Terminals": -2008013, "Analysis Display Style": -2000304, "Analysis Results": -2000303, "Areas": -2003200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}, selected="Spaces": -2003600)
level = DocumentLevelsPicker({"Level 2": "73c47c9a-91ec-4a49-8a66-0ef316750d45-d8eff220-72ca-4c7c-86f8-dac2f1f2e7c9-0014c622", "Level 1 - Plenum": "73c47c9a-91ec-4a49-8a66-0ef316750d45-43c66069-cb15-44a7-bd6c-a30b135d8ff5-00144d6c", "Level 1": "73c47c9a-91ec-4a49-8a66-0ef316750d45-e3e052f9-0156-11d5-9301-0000863f27ad-00000137"}, selected="Level 1 - Plenum")
category_filter = CategoryFilter(Categories=model, Inverted=False)
level_filter = LevelFilter(Levels=level, Inverted=False)
logical_and_filter = LogicalAndFilter(FilterA=category_filter, FilterB=level_filter)
model_2 = ModelCategoriesPicker({"Abutments": -2006130, "Air Systems": -2001008, "Air Terminals": -2008013, "Analysis Display Style": -2000304, "Analysis Results": -2000303, "Areas": -2003200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}, selected="Floors": -2000032)
model_3 = ModelCategoriesPicker({"Abutments": -2006130, "Air Systems": -2001008, "Air Terminals": -2008013, "Analysis Display Style": -2000304, "Analysis Results": -2000303, "Areas": -2003200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}, selected="Walls": -2000011)
model_4 = ModelCategoriesPicker({"Abutments": -2006130, "Air Systems": -2001008, "Air Terminals": -2008013, "Analysis Display Style": -2000304, "Analysis Results": -2000303, "Areas": -2003200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}, selected="Ceilings": -2000038)
document_elements = DocumentElements(Filter=logical_and_filter)
element_geometry = ElementGeometry(DetailLevel=3, Elements=document_elements)  # -> flatten(Geometry)
category_filter_2 = CategoryFilter(Categories=[model_4, model_2, model_3], Inverted=False)
bounding_box = BoundingBox(Content=element_geometry, Plane=PlaneXY(0, 0, 0), UnionBox=True)  # -> Box, Box_2
document_elements_2 = DocumentElements(Filter=category_filter_2)
number_slider = Slider(0.97, range=0.1..1.1)
evaluate_box = EvaluateBox(Box=bounding_box.Box, UParameter=0.5, VParameter=0.5, WParameter=0.5)  # -> Plane, Point, Include
element_geometry_2 = ElementGeometry(DetailLevel=3, Elements=document_elements_2)  # -> flatten(Geometry)
scale_nu = ScaleNU(
    Geometry=bounding_box.Box,
    Plane=evaluate_box.Plane,
    ScaleX=number_slider,
    ScaleY=number_slider,
    ScaleZ=Slider(0.8, range=0.1..1))  # -> Geometry, Transform
model_5 = ModelCategoriesPicker({"Abutments": -2006130, "Air Systems": -2001008, "Air Terminals": -2008013, "Analysis Display Style": -2000304, "Analysis Results": -2000303, "Areas": -2003200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}, selected="Duct Accessories": -2008016)
model_6 = ModelCategoriesPicker({"Abutments": -2006130, "Air Systems": -2001008, "Air Terminals": -2008013, "Analysis Display Style": -2000304, "Analysis Results": -2000303, "Areas": -2003200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}, selected="Duct Fittings": -2008010)
model_7 = ModelCategoriesPicker({"Abutments": -2006130, "Air Systems": -2001008, "Air Terminals": -2008013, "Analysis Display Style": -2000304, "Analysis Results": -2000303, "Areas": -2003200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}, selected="Duct Placeholders": -2008160)
model_8 = ModelCategoriesPicker({"Abutments": -2006130, "Air Systems": -2001008, "Air Terminals": -2008013, "Analysis Display Style": -2000304, "Analysis Results": -2000303, "Areas": -2003200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}, selected="Air Terminals")
model_9 = ModelCategoriesPicker({"Abutments": -2006130, "Air Systems": -2001008, "Air Terminals": -2008013, "Analysis Display Style": -2000304, "Analysis Results": -2000303, "Areas": -2003200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}, selected="Ducts": -2008000)
category_filter_3 = CategoryFilter(Categories=[model_6, model_9, model_7, model_5, model_8], Inverted=False)
document_elements_3 = DocumentElements(Filter=category_filter_3)
element_geometry_3 = ElementGeometry(DetailLevel=Slider(2, range=1..3), Elements=document_elements_3)  # -> flatten(Geometry)
custom_preview = CustomPreview(Geometry=element_geometry_3, Material=ColourSwatch(SwatchColor=RGB(52, 70, 94)))

# ----
solid_union = SolidUnion(Breps=element_geometry_3)
settings_speed = SettingsSpeed()
obstacles = Brep([solid_union, element_geometry_2])
mesh_brep = MeshBrep(Brep=obstacles, Settings=settings_speed)
panel = Panel("""dijkstra_path
astar_path
bellman_ford_path
shortest_path""")
panel_2 = Panel("""gexf
gpickle
graphml
sparse6
pajek""")
sourceindex = Slider(0, range=0..2000)
targetindex = Slider(904, range=0..1000)
list = ItemSelector(panel, {"dijkstra_path", "astar_path", "bellman_ford_path", "shortest_path"}, selected="shortest_path")
# Graph file location: C:\Program Files\Autodesk\Revit 2021\Graph.graphml
list_2 = ItemSelector(panel_2, {"gexf", "gpickle", "graphml", "sparse6", "pajek"}, selected="graphml")

# ----
# Placeholders
# 2nd Clash Detection
# 1st Clash Detection
# 3rd Clash Detection
# With collision
# With collision
# With collision
# Without collision
# Without collision
# Without collision
# Walls
# Holes
x_divider = Slider(6, range=1..10)
y_divider = Slider(6, range=1..10)
z_divider = Slider(2, range=1..10)
domain = Brep(scale_nu.Geometry)
bounding_box_2 = BoundingBox(Content=domain, Plane=PlaneXY(0, 0, 0), UnionBox=True)  # -> graft(Box), Box_2
deconstruct_box = DeconstructBox(Box=bounding_box_2.Box)  # -> Plane, X, Y, Z
Z = Number(deconstruct_box.Z)
Y = Number(deconstruct_box.Y)
X = Number(deconstruct_box.X)
division = Division(A=[X, Y, Z], B=[x_divider, y_divider, z_divider])  # -> simplify(graft(Result))
explode_tree = ExplodeTree(Data=division)  # -> Branch0, Branch1, Branch2
panel_3 = Panel(division)
create_voxelgrid = CreateVoxelGrid(BoundingBox=bounding_box_2.Box, SizeX=explode_tree.Branch0, SizeY=explode_tree.Branch1, SizeZ=explode_tree.Branch2)
voxelategeometry = VoxelateGeometry(Geometry=domain, VoxelGrid=create_voxelgrid, Distance=0)  # -> simplify(VoxelGrid)
min_clash_dist = Slider(5, range=1..210)
voxelgrid_to_boxes = VoxelGridToBoxes(VoxelGrid=voxelategeometry, Selection="1")  # -> simplify(Boxes), Points
clash = Clash(FirstSet=mesh_brep, SecondSet=voxelgrid_to_boxes.Boxes, Distance=min_clash_dist, ResultLimit=100)  # -> ClashCount, ClashPoints, ClashRadii, FirstIndex, SecondIndex
x_divider_2 = Slider(3, range=1..10)
y_divider_2 = Slider(3, range=1..10)
z_divider_2 = Slider(2, range=1..10)
x_divider_3 = Slider(2, range=1..10)
y_divider_3 = Slider(2, range=1..10)
z_divider_3 = Slider(2, range=1..10)
model_10 = ModelCategoriesPicker({"Abutments": -2006130, "Air Systems": -2001008, "Air Terminals": -2008013, "Analysis Display Style": -2000304, "Analysis Results": -2000303, "Areas": -2003200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}, selected="Walls": -2000011)
category_filter_4 = CategoryFilter(Categories=model_10, Inverted=False)
document_elements_4 = DocumentElements(Filter=category_filter_4)
element_geometry_4 = ElementGeometry(DetailLevel=3, Elements=document_elements_4)  # -> flatten(Geometry)
settings_speed_2 = SettingsSpeed()
panel_4 = Panel("""2
3""")
list_item = ListItem(List=element_geometry_4, Index=panel_4, Wrap=True)
mesh_brep_2 = MeshBrep(Brep=element_geometry_4, Settings=settings_speed_2)
custom_preview_2 = CustomPreview(Geometry=element_geometry_4, Material=ColourSwatch(SwatchColor=RGBA(138, 138, 138, 131)))
bounding_box_3 = BoundingBox(Content=list_item, Plane=PlaneXY(0, 0, 0))  # -> Box, Box_2
solid_difference = SolidDifference(BrepsA=bounding_box_3.Box, BrepsB=list_item)
custom_preview_3 = CustomPreview(Geometry=solid_difference, Material=ColourSwatch(SwatchColor=RGBA(72, 255, 0, 124)))
mep = Geometry(solid_union)

create_set = CreateSet(List=clash.SecondIndex)  # -> Set, Map

cull_index = CullIndex(List=voxelgrid_to_boxes.Boxes, Indices=create_set.Set, Wrap=True)
list_item_2 = ListItem(List=voxelgrid_to_boxes.Boxes, Index=create_set.Set, Wrap=True)
list_item_3 = ListItem(List=list_item_2, Index=0, Wrap=True)
deconstruct_box_2 = DeconstructBox(Box=list_item_3)  # -> Plane, X, Y, Z
Y_2 = Number(deconstruct_box_2.Y)
X_2 = Number(deconstruct_box_2.X)
Z_2 = Number(deconstruct_box_2.Z)
deconstruct_brep = DeconstructBrep(Brep=cull_index)  # -> Faces, Edges, Vertices
division_2 = Division(A=[X_2, Y_2, Z_2], B=[x_divider_2, y_divider_2, z_divider_2])  # -> simplify(graft(Result))
explode_tree_2 = ExplodeTree(Data=division_2)  # -> Branch0, Branch1, Branch2
panel_5 = Panel(division_2)
create_voxelgrid_2 = CreateVoxelGrid(BoundingBox=list_item_2, SizeX=explode_tree_2.Branch0, SizeY=explode_tree_2.Branch1, SizeZ=explode_tree_2.Branch2)
voxelategeometry_2 = VoxelateGeometry(Geometry=list_item_2, VoxelGrid=create_voxelgrid_2, Distance=0)
voxelgrid_to_boxes_2 = VoxelGridToBoxes(VoxelGrid=voxelategeometry_2, Selection="1")  # -> flatten(Boxes), Points
clash_2 = Clash(FirstSet=mesh_brep, SecondSet=voxelgrid_to_boxes_2.Boxes, Distance=min_clash_dist, ResultLimit=100)  # -> ClashCount, ClashPoints, ClashRadii, FirstIndex, SecondIndex

custom_preview_4 = CustomPreview(Geometry=cull_index, Material=ColourSwatch(SwatchColor=RGB(255, 99, 99)))
create_set_2 = CreateSet(List=clash_2.SecondIndex)  # -> Set, Map

cull_index_2 = CullIndex(List=voxelgrid_to_boxes_2.Boxes, Indices=create_set_2.Set, Wrap=True)
list_item_4 = ListItem(List=voxelgrid_to_boxes_2.Boxes, Index=create_set_2.Set, Wrap=True)
list_item_5 = ListItem(List=list_item_4, Index=0, Wrap=True)
deconstruct_box_3 = DeconstructBox(Box=list_item_5)  # -> Plane, X, Y, Z
brep_edges = BrepEdges(Brep=cull_index_2)  # -> Naked, Interior, NonManifold
X_3 = Number(deconstruct_box_3.X)
Y_3 = Number(deconstruct_box_3.Y)
Z_3 = Number(deconstruct_box_3.Z)
division_3 = Division(A=[X_3, Y_3, Z_3], B=[x_divider_3, y_divider_3, z_divider_3])  # -> simplify(graft(Result))
explode_tree_3 = ExplodeTree(Data=division_3)  # -> Branch0, Branch1, Branch2
panel_6 = Panel(division_3)
create_voxelgrid_3 = CreateVoxelGrid(BoundingBox=list_item_4, SizeX=explode_tree_3.Branch0, SizeY=explode_tree_3.Branch1, SizeZ=explode_tree_3.Branch2)
voxelategeometry_3 = VoxelateGeometry(Geometry=list_item_4, VoxelGrid=create_voxelgrid_3, Distance=0)
voxelgrid_to_boxes_3 = VoxelGridToBoxes(VoxelGrid=voxelategeometry_3, Selection="1")  # -> flatten(Boxes), Points
clash_3 = Clash(FirstSet=mesh_brep, SecondSet=voxelgrid_to_boxes_3.Boxes, Distance=min_clash_dist, ResultLimit=100)  # -> ClashCount, ClashPoints, ClashRadii, FirstIndex, SecondIndex

custom_preview_5 = CustomPreview(Geometry=cull_index_2, Material=ColourSwatch(SwatchColor=RGB(255, 41, 41)))
create_set_3 = CreateSet(List=clash_3.SecondIndex)  # -> Set, Map

list_item_6 = ListItem(List=voxelgrid_to_boxes_3.Boxes, Index=create_set_3.Set, Wrap=True)
cull_index_3 = CullIndex(List=voxelgrid_to_boxes_3.Boxes, Indices=create_set_3.Set, Wrap=True)
# Wall piercing
clash_4 = Clash(FirstSet=list_item_6, SecondSet=mesh_brep_2, Distance=1, ResultLimit=100)  # -> ClashCount, ClashPoints, ClashRadii, FirstIndex, SecondIndex
list_item_7 = ListItem(List=list_item_6, Index=clash_4.FirstIndex, Wrap=True)
brep_edges_2 = BrepEdges(Brep=list_item_7)  # -> Naked, flatten(Interior), NonManifold
brep_edges_3 = BrepEdges(Brep=cull_index_3)  # -> Naked, Interior, NonManifold
removeduplicatelines = RemoveDuplicateLines(Lines=brep_edges_2.Interior, Tolerance=0.01)
merge = Merge(Data1=deconstruct_brep.Edges, Data2=brep_edges.Interior, Data3=brep_edges_3.Interior)  # -> flatten(Result)
collision_one_many = CollisionOneMany(Collider=removeduplicatelines, Obstacles=mep)  # -> Collision, Index
cull_pattern = CullPattern(List=removeduplicatelines, CullPattern=collision_one_many.Index)
removeduplicatelines_2 = RemoveDuplicateLines(Lines=flatten([merge, cull_pattern]), Tolerance=0.01)
line = Line(removeduplicatelines_2)

custom_preview_6 = CustomPreview(Geometry=cull_index_3, Material=ColourSwatch(SwatchColor=RGB(128, 0, 0)))

# ----
# Knowledge items
dn = Panel("""1
25
50
65
80
100
125
150
200
300
400
500""")
division_4 = Division(A=dn, B="2")
radius = Data(division_4)
negative = Negative(Value=radius)
data = Data(simplify(graft(removeduplicatelines_2)))
list_length = ListLength(List=removeduplicatelines_2)
list_length_2 = ListLength(List=division_4)
dn_2 = Number(dn)
construct_domain = ConstructDomain(DomainStart=negative, DomainEnd=radius)
plane = Plane(data)
panel_7 = Panel(list_length)
series = Series(Start=0, Step=list_length, Count=list_length_2)
sort_list = SortList(Keys=dn_2)  # -> Keys, ValuesValuesA
rectangle = Rectangle(Plane=plane, XSize=construct_domain, YSize=construct_domain, Radius=0)  # -> Rectangle, Length
flip_matrix = FlipMatrix(Data=data)
cull_index_4 = CullIndex(List=dn_2, Indices="0", Wrap=True)
series_2 = Series(Start=series, Step=list_length, Count="2")  # -> simplify(Series)
flip_matrix_2 = FlipMatrix(Data=rectangle.Rectangle)
list_item_8 = ListItem(List=sort_list.Keys, Index="-1", Wrap=True)
vector = Vector(flip_matrix)
move = Move(Geometry=flip_matrix_2, Motion=vector)  # -> Geometry, Transform
flip_matrix_3 = FlipMatrix(Data=series_2)
explode_tree_4 = ExplodeTree(Data=flip_matrix_3)  # -> Branch0, Branch1
entwine = Entwine(Branch00=flatten(move.Geometry), Branch01=flatten(flip_matrix_2), FlattenInputs=True)  # -> simplify(Result)
min_clash_radius = Slider(5, range=0..210)
duplicate_data = DuplicateData(Data=list_item_8, Number=list_length, Order=True)
construct_domain_2 = ConstructDomain(DomainStart=explode_tree_4.Branch0, DomainEnd=expr("x-1", explode_tree_4.Branch1))
flip_matrix_4 = FlipMatrix(Data=entwine)
length = Length(Curve=line)
bounding_box_4 = BoundingBox(Content=flip_matrix_4, Plane=PlaneXY(0, 0, 0), UnionBox=True)  # -> flatten(Box), Box_2
sub_list = SubList(List=bounding_box_4.Box, Domain=construct_domain_2, Wrap=True)  # -> simplify(List), Index
clash_5 = Clash(FirstSet=mesh_brep, SecondSet=sub_list.List, Distance=min_clash_radius, ResultLimit=1)  # -> flatten(ClashCount), ClashPoints, ClashRadii, FirstIndex, simplify(SecondIndex)
panel_8 = Panel(clash_5.ClashCount)
replace_items = ReplaceItems(List=duplicate_data, Item=graft(dn_2), Indices=clash_5.SecondIndex, Wrap=False)  # -> simplify(List)
flip_matrix_5 = FlipMatrix(Data=replace_items)
# Make sure there is one connected graph after culling edges.
# Remove unconnected edges.
create_set_4 = CreateSet(List=flip_matrix_5)  # -> Set, Map

# ----
# Structure
round = Round(Number=length)  # -> Nearest, Floor, Ceiling
edges = GhPythonScript(edges=line)  # -> StartPoint, EndPoint; inputs edges: list of Curve
# ---------- edges: Python ----------
__author__ = "amd"
__version__ = "2020.07.10"
import rhinoscriptsyntax as rs

#output start and end points for each edge
#NEW
StartPoints = [rs.CurveStartPoint(edge) for edge in edges]
EndPoints = [rs.CurveEndPoint(edge) for edge in edges]
StartPoint = ["({:.0f},{:.0f},{:.0f})".format(StartPoints[point][0], StartPoints[point][1], StartPoints[point][2]) for point in range(len(StartPoints))]
EndPoint = ["({:.0f},{:.0f},{:.0f})".format(EndPoints[point][0], EndPoints[point][1], EndPoints[point][2]) for point in range(len(EndPoints))]

#OLD
#StartPoint = ["({:.0f},{:.0f},{:.0f})".format(rs.CurveStartPoint(edge).X, rs.CurveStartPoint(edge).Y, rs.CurveStartPoint(edge).Z) for edge in edges]
#EndPoint = ["({:.0f},{:.0f},{:.0f})".format(rs.CurveEndPoint(edge).X, rs.CurveEndPoint(edge).Y, rs.CurveEndPoint(edge).Z) for edge in edges]


#pr = precision
#StartPoint = ["({:.0f},{:.0f},{:.0f})".format(rss.CurveStartPoint(edge).X, round(rss.CurveStartPoint(edge).Y,pr), round(rss.CurveStartPoint(edge).Z,pr)) for edge in edges]
#EndPoint = ["({:.0f},{:.0f},{:.0f})".format(round(rss.CurveEndPoint(edge).X,pr), round(rss.CurveEndPoint(edge).Y,pr), round(rss.CurveEndPoint(edge).Z,pr)) for edge in edges]
# ---------- end edges ----------
min = GhPythonScript(x=create_set_4.Set)  # -> flatten(a); inputs x: list
# ---------- min: Python ----------
__author__ = "amd"
__version__ = "2020.09.04"

a = min(x)
# ---------- end min ----------

item_selector = ItemSelector(cull_index_4, {"25", "50", "65", "80", "100", "125", "150", "200", "300", "400", "500"}, selected="100")
tree_branch = TreeBranch(Tree=clash_5.SecondIndex, Path="0", MaintainPaths=True)
# Edges that pierce walls
list_item_9 = ListItem(List=removeduplicatelines_2, Index=tree_branch, Wrap=True)
panel_9 = Panel(item_selector)
custom_preview_7 = CustomPreview(Geometry=list_item_9, Material=ColourSwatch(SwatchColor=RGB(255, 255, 255)))

# ----
# Algorithm
graph_byedges = GraphByEdges(
    sourceI=sourceindex,
    targetI=targetindex,
    StartPoint=edges.StartPoint,
    EndPoint=edges.EndPoint,
    DN=panel_9,
    MaxD=min,
    Length=round.Floor,
    PiercingWeight=Slider(100, range=0..100),
    SampleSize=Slider(1, range=1..200),
    Algorithm=list,
    GraphFileFormat=list_2)  # -> sourceP, targetP, NodesCount, EdgeCount, ShortestPaths; inputs sourceI: list, targetI: list, StartPoint: list, EndPoint: list, DN: list, MaxD: list, Length: list, PiercingWeight: list, SampleSize: list, Algorithm: list, GraphFileFormat: list
#   port SampleSize: [optional] - [type = int] - [default = 1] Descripe your input here * bullet point. * bullet point
#   port Algorithm: [optional] - [type = string] - [default = shortest_path] Descripe your input here * astar_path * dijkstra_path * bellman_ford_path * shortest_path
# ---------- graph_byedges: Python ----------
# -*- coding: utf-8 -*-

import networkx as nx
G = nx.Graph()

if len(StartPoint) == len(EndPoint) or len(StartPoint) == len(Dictionaries):
    DNset = set(MaxD)
    DNset.remove(1)
    MaxDN = max(DNset)
    #print(DNset)
    for x in range(len(StartPoint)):
        G.add_edge(StartPoint[x], EndPoint[x], cost = Length[x], maxD = MaxD[x])
    for (u, v, wt) in G.edges.data('maxD'):
        if wt == 1:
            G[u][v]['cost'] *= PiercingWeight
            G[u][v]['maxD'] = MaxDN + 1
else:
    output = "StartPoint, EndPoint and Dictionaries length must be equal"

NodesCount = G.number_of_nodes()
EdgeCount = G.number_of_edges()

if GraphFileFormat != None:
    eval("nx.write_"+GraphFileFormat+"(G,'Graph."+GraphFileFormat+"')")
    print("File saved as:", GraphFileFormat)

from random import choice
ShortestPaths = []
Diameters = []
for i in range(SampleSize):
    #pick random diameter
    def filter_edge_minD(n1,n2):
        return G[n1][n2].get('maxD') >= DN
    #subgraph
    view = nx.subgraph_view(G,filter_edge=filter_edge_minD)
    H = G.edge_subgraph(view.edges())
    #eval("nx.write_"+GraphFileFormat+"(H,'HGraph."+GraphFileFormat+"')")
    #generate start & end points
    source = list(H.nodes())[sourceI]
    target = list(H.nodes())[targetI]

    sourceP = str(source)
    targetP = str(target)

    #find paths
    if nx.has_path(H,source,target)==True:
        ShortestPath = eval("nx."+Algorithm+"(H, source, target, weight='cost')")
        G.remove_nodes_from(ShortestPath)
        ShortestPath = str(ShortestPath).replace("), ",";").replace("(","").replace("[","").replace("]","").replace(")","")
        
        ShortestPaths.append(ShortestPath)
    else: 
        print("Path not found")

#save to txt file
#FilePath = r"C:\Users\amd\Documents\Dissertation\Grasshopper\ShortestPath.txt"
#FileName = "ShortestPaths.txt"
#File_object = open(FileName,"w+")
#for path in ShortestPaths:
#    File_object.write(path+'\n')
#File_object.close()

ShortestPaths = [Path.replace(", ","_") for Path in ShortestPaths]
# ---------- end graph_byedges ----------

panel_10 = Panel(graph_byedges.NodesCount)
panel_11 = Panel(graph_byedges.EdgeCount)
list_length_3 = ListLength(List=graph_byedges.ShortestPaths)
dataprocessing = GhPythonScript(paths=graph_byedges.ShortestPaths)  # -> points
# ---------- dataprocessing: Python ----------
__author__ = "amd"
__version__ = "2020.07.11"

import rhinoscriptsyntax as rs
import Rhino.Geometry as rg

path = paths.replace("'","").replace("_",",").split(";")
points=[]
for point in path:
    point = point.split(",")
    points.append(rg.Point3d(float(point[0]),float(point[1]),float(point[2])))
#print(points)
# ---------- end dataprocessing ----------
ghpython_script = GhPythonScript(x=[graph_byedges.targetP, graph_byedges.sourceP])  # -> a
# ---------- ghpython_script: Python ----------
__author__ = "amd"
__version__ = "2020.09.04"

import rhinoscriptsyntax as rs

a = x.replace("(","{").replace(")","}")
# ---------- end ghpython_script ----------
point = Point(ghpython_script)
panel_12 = Panel(list_length_3)
pline = PolyLine(Vertices=dataprocessing, Closed=False)  # -> flatten(Polyline)
sphere = Sphere(Base=point, Radius="300")
simplify_curve = SimplifyCurve(Curve=pline)  # -> Curve, Simplified
explode = Explode(Curve=simplify_curve.Curve, Recursive=True)  # -> simplify(Segments), Vertices
division_5 = Division(A=panel_9, B=2)
list_length_4 = ListLength(List=explode.Segments)
pipe = Pipe(Curve=explode.Segments, Radius=graft(division_5), Caps="1")  # -> flatten(Pipe)
subtraction = Subtraction(A=list_length_4, B=1)
bend_count = Panel(subtraction)
custom_preview_8 = CustomPreview(Geometry=[sphere, pipe], Material=ColourSwatch(SwatchColor=RGB(209, 0, 0)))
